# Dynamo custom node AdaptiveComponent.PlacementPointElements.dyf (Dynamo 2.0.3.8810)
# category: Antler.AdaptiveComponent
# Gets Placement Adaptive Point Element Refs to which the instance geometry adapts.

adaptive_component = Input(adaptive_component: var[]..[])
python_script = Python(IN[0]=adaptive_component)
# ---------- python_script.python (34 lines) ----------
# Enable Python support and load DesignScript library
import clr

# Import RevitAPI
clr.AddReference("RevitAPI")
from Autodesk.Revit import DB

# Import DocumentManager and TransactionManager
clr.AddReference ("RevitServices")
import RevitServices
from RevitServices.Persistence import DocumentManager
from RevitServices.Transactions import TransactionManager

doc = DocumentManager.Instance.CurrentDBDocument
uiapp = DocumentManager.Instance.CurrentUIApplication
app = uiapp.Application

#The inputs to this node will be stored as a list in the IN variable.
elements = IN[0]

def function(element):
	if isinstance(element, (list, tuple)):
		return [function(e) for e in element]
	else:
		# Code follows here:
		element = UnwrapElement(element)
		
		placement_point_ids = DB.AdaptiveComponentInstanceUtils.GetInstancePlacementPointElementRefIds(element)
		
		placement_points = [doc.GetElement(id) for id in placement_point_ids]
		
		return placement_points

OUT = function(elements)
# ----------------------------------------
elements = Output(python_script)
