# Dynamo custom node Collector.All Categories.dyf "All Categories" (Dynamo 2.3.0.5885)
# category: Antler.Collector
# Collects all categories in project

python_script = Python()
# ---------- python_script.python (46 lines) ----------
import clr
clr.AddReference('ProtoGeometry')
from Autodesk.DesignScript.Geometry import *

# Import DocumentManager
clr.AddReference( "RevitServices")
import RevitServices
from RevitServices.Persistence import DocumentManager


doc = DocumentManager.Instance.CurrentDBDocument
uiapp = DocumentManager.Instance.CurrentUIApplication
app = uiapp.Application

ids = []
names = []
category_types = []

# Get settings of current document
documentSettings = doc.Settings

# Get all categories of current document
categories = documentSettings.Categories


for category in categories:
	ids.append(category.Id)
	names.append(category.Name)
	category_types.append(category.CategoryType)


# Show the number of all the categories to the user
#String prompt = "Number of all categories in current Revit document:" + groups.Size;

# get Floor category according to OST_Floors and show its name
# Category floorCategory = groups.get_Item(BuiltInCategory.OST_Floors);
# prompt += floorCategory.Name;

# Give the user some information
# TaskDialog.Show("Revit",prompt);




#Assign your output to the OUT variable.
OUT = (categories, ids, names, category_types)
# ----------------------------------------
code_block = CodeBlock(a=python_script) { a[0]; a[1]; a[2]; a[3]; }
categories = Output(code_block.out0)
ids = Output(code_block.out1)
category_types = Output(code_block.out3)
category_names = Output(code_block.out2)
