# Dynamo custom node Collector.AllElements.dyf (Dynamo 2.0.2.6826)
# category: Antler.Collectors
# Gets all elements in model of either Instances or Types (not both). Use with caution.

doc = Input(doc: var = null)
get_types = Input(get_types: bool = false)
python_script = Python(IN[0]=doc, IN[1]=get_types)
# ---------- python_script.python (64 lines) ----------
"""
Sources:
	https://thebuildingcoder.typepad.com/blog/2010/06/element-name-parameter-filter-correction.html
"""

# Enable Python support and load DesignScript library
import clr

clr.AddReference('ProtoGeometry')
from Autodesk.DesignScript.Geometry import *

# Import RevitAPI
clr.AddReference("RevitAPI")
from Autodesk.Revit.DB import *

# Import DocumentManager and TransactionManager
clr.AddReference("RevitServices")
import RevitServices
from RevitServices.Persistence import DocumentManager
from RevitServices.Transactions import TransactionManager

# Import ToDSType(bool) extension method
clr.AddReference("RevitNodes")
import Revit
clr.ImportExtensions(Revit.Elements)
clr.ImportExtensions(Revit.GeometryConversion)

clr.AddReference('System.Collections')
from System import *
from System.Collections.Generic import *

import sys
path = r"C:\Program Files (x86)\IronPython 2.7\Lib"
if not path in sys.path: sys.path.append(path)
import difflib

import operator

#The inputs to this node will be stored as a list in the IN variables.
doc = IN[0]
get_types = IN[1]

log = []

if not doc:
	doc = DocumentManager.Instance.CurrentDBDocument

collector = FilteredElementCollector(doc)


if get_types:
	collector.WhereElementIsElementType()
else:
	collector.WhereElementIsNotElementType()


try:
	elements = collector.ToElements()
except Exception as e:
	log.append(e)


#Assign your output to the OUT variable.
OUT = elements, log
# ----------------------------------------
code_block = CodeBlock(t=python_script) { t[0]; t[1]; }
elements = Output(code_block.out0)
log = Output(code_block.out1)
