# Dynamo custom node Collector.DesignOptions.dyf (Dynamo 2.3.0.5885)
# category: Antler.Collectors
# Collects all design options in project

designOptions = Python()  # "Collector.DesignOptions"; graph input
# ---------- designOptions.python (24 lines) ----------
import clr
clr.AddReference('ProtoGeometry')
from Autodesk.DesignScript.Geometry import *

# Import RevitAPI
clr.AddReference("RevitAPI")
import Autodesk
from Autodesk.Revit.DB import *

# Import DocumentManager and TransactionManager
clr.AddReference("RevitServices")
import RevitServices
from RevitServices.Persistence import DocumentManager

#The inputs to this node will be stored as a list in the IN variable.
dataEnteringNode = IN

doc = DocumentManager.Instance.CurrentDBDocument

collector = FilteredElementCollector(doc)
designOptions = collector.OfClass(DesignOption).ToElements()

#Assign your output to the OUT variable
OUT = designOptions
# ----------------------------------------
design_options = Output(designOptions)
