# Dynamo custom node Collector.Element from ID.dyf "Element from ID" (Dynamo 2.6.1.8786)
# category: Antler.Collector
# Get elements from element ID

Id = Input(Id: var[]..[])
element_from_id = Python(IN[0]=Id)
# ---------- element_from_id.python (55 lines) ----------
import clr

clr.AddReference('ProtoGeometry')
from Autodesk.DesignScript.Geometry import *

# Import RevitAPI
clr.AddReference("RevitAPI")
import Autodesk
from Autodesk.Revit.DB import *

# Import DocumentManager and TransactionManager
clr.AddReference("RevitServices")
import RevitServices
from RevitServices.Persistence import DocumentManager
from RevitServices.Transactions import TransactionManager

# Import ToDSType(bool) extension method
clr.AddReference("RevitNodes")
import Revit
clr.ImportExtensions(Revit.Elements)
clr.ImportExtensions(Revit.GeometryConversion)

# Import Revit UI
clr.AddReference('RevitAPIUI')
from Autodesk.Revit.UI import *
#from Autodesk.Revit.UI.Selection import *

import sys

#The inputs to this node will be stored as a list in the IN variables.
input = IN[0]

doc = DocumentManager.Instance.CurrentDBDocument

def function(id):
	try:
		element = doc.GetElement(id)
	except:
		elem_id = ElementId(int(id))
		element = doc.GetElement(elem_id)
	return element

element = None

if isinstance(input, list):
    element = [function(a) for a in UnwrapElement(input)]
elif input is None:
	element = None
else:
    element = function(UnwrapElement(input))



#Assign your output to the OUT variable.
OUT = element
# ----------------------------------------
Element = Output(element_from_id)
