# Dynamo custom node Collector.FamilyInstances.dyf "Collect family instances" (Dynamo 2.3.0.5885)
# category: Antler.Collector

python_script = Python()
# ---------- python_script.python (27 lines) ----------
import clr

# Import RevitAPI
clr.AddReference("RevitAPI")
import Autodesk
from Autodesk.Revit.DB import *

# Import DocumentManager and TransactionManager
clr.AddReference("RevitServices")
import RevitServices
from RevitServices.Persistence import DocumentManager
from RevitServices.Transactions import TransactionManager

# Import ToDSType(bool) extension method
clr.AddReference("RevitNodes")
import Revit
clr.ImportExtensions(Revit.Elements)
clr.ImportExtensions(Revit.GeometryConversion)

#The input to this node will be stored in the IN[0] variable.
doc =  DocumentManager.Instance.CurrentDBDocument

collector = FilteredElementCollector(doc)
output = collector.OfClass(FamilyInstance).ToElements()

#Assign your output to the OUT variable
OUT = output
# ----------------------------------------
OUT = Output(python_script)
