# Dynamo custom node Collector.Levels.dyf "Collector.ElementsOnLevel" (Dynamo 2.0.3.8104)
# category: Antler.Collectors
# Collects elements on given Level

level = Input(level: var[]..[])
levels = Python(IN[0]=level)  # "Collector.Levels"
# ---------- levels.python (26 lines) ----------
import clr
clr.AddReference('ProtoGeometry')
from Autodesk.DesignScript.Geometry import *

# Import RevitAPI
clr.AddReference("RevitAPI")
import Autodesk
from Autodesk.Revit.DB import *

# Import DocumentManager and TransactionManager
clr.AddReference("RevitServices")
import RevitServices
from RevitServices.Persistence import DocumentManager

#The inputs to this node will be stored as a list in the IN variable.
level = UnwrapElement(IN[0])

doc = DocumentManager.Instance.CurrentDBDocument

level_filter = ElementLevelFilter(level.Id)

collector = FilteredElementCollector(doc)
elements = collector.WherePasses(level_filter).ToElements()

#Assign your output to the OUT variable
OUT = elements
# ----------------------------------------
OUT = Output(levels)
