# Dynamo custom node Collector.PhaseFilter.dyf (Dynamo 2.3.0.5885)
# category: Antler.Collectors
# Gets all phase filters in document

python_script = Python()  # graph input
# ---------- python_script.python (22 lines) ----------
import clr
clr.AddReference('RevitAPI')
from Autodesk.Revit.DB import *
import Autodesk

clr.AddReference("RevitNodes")
import Revit
clr.ImportExtensions(Revit.Elements)

clr.AddReference("RevitServices")
import RevitServices
from RevitServices.Persistence import DocumentManager

doc = DocumentManager.Instance.CurrentDBDocument

collector = FilteredElementCollector(doc)
collector = collector.OfClass(PhaseFilter)

element_list = collector.ToElements()
name_list = [a.Name for a in element_list]

OUT = (element_list, name_list)
# ----------------------------------------
code_block = CodeBlock(a=python_script) { a[0]; a[1]; }
phase_filters = Output(code_block.out0)
names = Output(code_block.out1)
