# Dynamo custom node Collector.Worksets.dyf (Dynamo 2.0.2.6826)
# category: Antler.Collectors
# Gets all worksets in current project

worksets = Python()  # "Collector.Worksets"; unwired: IN[0]
# ---------- worksets.python (33 lines) ----------
import clr

# Import RevitAPI
clr.AddReference("RevitAPI")
import Autodesk
from Autodesk.Revit.DB import *

# Import DocumentManager and TransactionManager
clr.AddReference("RevitServices")
import RevitServices
from RevitServices.Persistence import DocumentManager
from RevitServices.Transactions import TransactionManager

# Import ToDSType(bool) extension method
clr.AddReference("RevitNodes")
import Revit
clr.ImportExtensions(Revit.Elements)
clr.ImportExtensions(Revit.GeometryConversion)

#The input to this node will be stored in the IN[0] variable.
doc =  DocumentManager.Instance.CurrentDBDocument

#collector = FilteredElementCollector(doc)
#output = collector.OfClass(Workset)

fwc = FilteredWorksetCollector(doc)
fwc.OfKind(WorksetKind.UserWorkset).ToWorksets()


#workset = worksetTable.GetWorkset(activeId)

#Assign your output to the OUT variable
OUT = fwc
# ----------------------------------------
workset = Output(worksets)
