# Dynamo custom node Color.HSL from Color.dyf "HSL from Color" (Dynamo 2.3.0.5885)
# category: Antler.Color.Query
# Deconstructs color to hue, saturation and lightness

color = Input(color: var[]..[])
python_script = Python(IN[0]=color)
# ---------- python_script.python (37 lines) ----------
#Code shamelessly stolen from colorsys.py, https://docs.python.org/2/library/colorsys.html

import clr
clr.AddReference('ProtoGeometry')
from Autodesk.DesignScript.Geometry import *

#The inputs to this node will be stored as a list in the IN variable.
inRGB = UnwrapElement(IN[0])

def rgb_to_hls(r, g, b):
    maxc = max(r, g, b)
    minc = min(r, g, b)
    # XXX Can optimize (maxc+minc) and (maxc-minc)
    l = (minc+maxc)/2.0
    if minc == maxc:
        return 0.0, l, 0.0
    if l <= 0.5:
        s = (maxc-minc) / (maxc+minc)
    else:
        s = (maxc-minc) / (2.0-maxc-minc)
    rc = (maxc-r) / (maxc-minc)
    gc = (maxc-g) / (maxc-minc)
    bc = (maxc-b) / (maxc-minc)
    if r == maxc:
        h = bc-gc
    elif g == maxc:
        h = 2.0+rc-bc
    else:
        h = 4.0+gc-rc
    h = (h/6.0) % 1.0
    return h, l, s

H, L, S = rgb_to_hls(inRGB.Red/255.0, inRGB.Green/255.0, inRGB.Blue/255.0)


#Assign your output to the OUT variable
OUT = (H, S, L)
# ----------------------------------------
code_block = CodeBlock { 0; }
getItemAtIndex = List.GetItemAtIndex(list=python_script, index=code_block)
H = Output(getItemAtIndex)
code_block_2 = CodeBlock { 1; }
getItemAtIndex_2 = List.GetItemAtIndex(list=python_script, index=code_block_2)
S = Output(getItemAtIndex_2)
code_block_3 = CodeBlock { 2; }
getItemAtIndex_3 = List.GetItemAtIndex(list=python_script, index=code_block_3)
L = Output(getItemAtIndex_3)
