# Dynamo custom node ColorByHSL.dyf (Dynamo 2.3.0.5885)
# category: tholth.Color.Create
# Create color from hue, saturation and lightness

H = Input(H: var[]..[])
S = Input(S: var[]..[])
L = Input(L: var[]..[])
python_script = Python(IN[0]=H, IN[1]=S, IN[2]=L)
# ---------- python_script.python (56 lines) ----------
#Code shamelessly stolen from colorsys.py, https://docs.python.org/2/library/colorsys.html

import clr
clr.AddReference('ProtoGeometry')
from Autodesk.DesignScript.Geometry import *

clr.AddReference('RevitAPI')
from Autodesk.Revit.DB import *

# Import ToDSType(bool) extension method
clr.AddReference("RevitNodes")
import Revit
clr.ImportExtensions(Revit.Elements)

# Import RevitAPI
clr.AddReference("RevitAPI")
import Autodesk

# Import ToProtoType, ToRevitType geometry conversion extension methods
clr.ImportExtensions(Revit.GeometryConversion)


#The inputs to this node will be stored as a list in the IN variable.
Hue = IN[0]
Saturation = IN[1]
Lightness = IN[2]

ONE_THIRD = 1.0/3.0
ONE_SIXTH = 1.0/6.0
TWO_THIRD = 2.0/3.0

def hls_to_rgb(h, l, s):
    if s == 0.0:
        return l, l, l
    if l <= 0.5:
        m2 = l * (1.0+s)
    else:
        m2 = l+s-(l*s)
    m1 = 2.0*l - m2
    return (_v(m1, m2, h+ONE_THIRD), _v(m1, m2, h), _v(m1, m2, h-ONE_THIRD))
    
def _v(m1, m2, hue):
    hue = hue % 1.0
    if hue < ONE_SIXTH:
        return m1 + (m2-m1)*hue*6.0
    if hue < 0.5:
        return m2
    if hue < TWO_THIRD:
        return m1 + (m2-m1)*(TWO_THIRD-hue)*6.0
    return m1
    

R, G, B = hls_to_rgb(Hue, Lightness, Saturation)

#Assign your output to the OUT variable
OUT = Color(int(R*255), int(G*255), int(B*255))#.ToDSType(False)#.ToProtoType()
# ----------------------------------------
OUT = Output(python_script)
