# Dynamo custom node CurtainGrid.AddGridLine.dyf (Dynamo 2.3.0.5885)
# category: Bonetools.CurtainGrid
# Adds gridline to curtain grid

curtaingrid = Input(curtaingrid: var[]..[])
point = Input(point: var[]..[])
dir = Input(dir: var[]..[])
addGridLine = Python(IN[0]=curtaingrid, IN[1]=point, IN[2]=dir)  # "CurtainGrid.AddGridLine"
# ---------- addGridLine.python (58 lines) ----------
# Enable Python support and load DesignScript library
import clr

clr.AddReference('ProtoGeometry')
from Autodesk.DesignScript.Geometry import *

# Import RevitAPI
clr.AddReference("RevitAPI")
import Autodesk
from Autodesk.Revit.DB import *

# Import DocumentManager and TransactionManager
clr.AddReference("RevitServices")
import RevitServices
from RevitServices.Persistence import DocumentManager
from RevitServices.Transactions import TransactionManager

# Import ToDSType(bool) extension method
clr.AddReference("RevitNodes")
import Revit
clr.ImportExtensions(Revit.Elements)
clr.ImportExtensions(Revit.GeometryConversion)

# Import Revit UI
clr.AddReference('RevitAPIUI')
from Autodesk.Revit.UI import *
#from Autodesk.Revit.UI.Selection import *

from Autodesk.DesignScript.Geometry import *

#The inputs to this node will be stored as a list in the IN variables.
curtain_grid = UnwrapElement(IN[0])
xyzs = IN[1]
dir = IN[2]


doc = DocumentManager.Instance.CurrentDBDocument
uiapp = DocumentManager.Instance.CurrentUIApplication
app = uiapp.Application

output = None

# Start Transaction
TransactionManager.Instance.EnsureInTransaction(doc)

# Transaction


# To handle single items or lists..
for xyz in xyzs:
	result = curtain_grid.AddGridLine(dir, xyz.ToXyz(), False)
	
	
# End Transaction
TransactionManager.Instance.TransactionTaskDone()

#Assign your output to the OUT variable.
OUT = result
# ----------------------------------------
OUT = Output(addGridLine)
