# Dynamo custom node CurtainGrid.Properties.dyf (Dynamo 2.0.3.8810)
# category: antler.CurtainWall
# All properties of Curtain Grid.

curtain_grid = Input(curtain_grid: var[]..[])
python_script = Python(IN[0]=curtain_grid)
# ---------- python_script.python (32 lines) ----------
# Enable Python support and load DesignScript library
import clr

# Import RevitAPI
clr.AddReference("RevitAPI")
from Autodesk.Revit import DB

#The inputs to this node will be stored as a list in the IN variable.
elements = IN[0]

def function(curtain_grid):
	if isinstance(curtain_grid, (list, tuple)):
		return [function(e) for e in curtain_grid]
	else:
		# Code follows here:
		curtain_grid = UnwrapElement(curtain_grid)
		
		prop_dict = {
			"Grid1Angle"         :  curtain_grid.Grid1Angle,
			"Grid1Justification" :          curtain_grid.Grid1Justification,
			"Grid1Offset"        :   curtain_grid.Grid1Offset,
			"Grid2Angle"         :  curtain_grid.Grid2Angle,
			"Grid2Justification" :          curtain_grid.Grid2Justification,
			"Grid2Offset"        :   curtain_grid.Grid2Offset,
			"NumPanels"          : curtain_grid.NumPanels,
			"NumULines"          : curtain_grid.NumULines,
			"NumVLines"          : curtain_grid.NumVLines
			}
		
		return prop_dict.keys(), prop_dict.values()

OUT = function(elements)
# ----------------------------------------
code_block = CodeBlock { 0; 1; }
getItemAtIndex = List.GetItemAtIndex(list=python_script@L3, index=code_block.out0)
getItemAtIndex_2 = List.GetItemAtIndex(list=python_script@L3, index=code_block.out1)
byKeysValues = DesignScript.Builtin.Dictionary.ByKeysValues(keys=getItemAtIndex@L2, values=getItemAtIndex_2@L2)
properties = Output(byKeysValues)
watch = Watch(byKeysValues)
watch_2 = Watch(curtain_grid)
