# Dynamo custom node CurtainGridLine.AllSegmentCurves.dyf (Dynamo 2.0.3.8810)
# category: antler.CurtainWall
# Retrieve the curves of all segments.

curtain_grid_line = Input(curtain_grid_line: var[]..[])
python_script = Python(IN[0]=curtain_grid_line)
# ---------- python_script.python (26 lines) ----------
# Enable Python support and load DesignScript library
import clr

# Import RevitAPI
clr.AddReference("RevitAPI")
from Autodesk.Revit import DB

# Import ToDSType(bool) extension method
clr.AddReference("RevitNodes")
import Revit
clr.ImportExtensions(Revit.Elements)
clr.ImportExtensions(Revit.GeometryConversion)

#The inputs to this node will be stored as a list in the IN variable.
elements = IN[0]

def function(element):
	if isinstance(element, (list, tuple)):
		return [function(e) for e in element]
	else:
		# Code follows here:
		element = UnwrapElement(element)
		
		return element.AllSegmentCurves.ToProtoType()

OUT = function(elements)
# ----------------------------------------
segment_polycurve = Output(python_script)
