# Dynamo custom node CurtainGridLine.RemoveSegment .dyf "CurtainGridLine.RemoveSegment" (Dynamo 2.3.0.5885)
# category: Bonetools.CurtainGrid.CurtainGridLine

curtaingridline = Input(curtaingridline: var[]..[])
curve = Input(curve: var[]..[])
removeSegment = Python(IN[0]=curtaingridline, IN[1]=curve)  # "CurtainGridLine.RemoveSegment"
# ---------- removeSegment.python (71 lines) ----------
# Enable Python support and load DesignScript library
import clr

clr.AddReference('ProtoGeometry')
from Autodesk.DesignScript.Geometry import *

# Import RevitAPI
clr.AddReference("RevitAPI")
import Autodesk
from Autodesk.Revit.DB import *

# Import DocumentManager and TransactionManager
clr.AddReference("RevitServices")
import RevitServices
from RevitServices.Persistence import DocumentManager
from RevitServices.Transactions import TransactionManager

# Import ToDSType(bool) extension method
clr.AddReference("RevitNodes")
import Revit
clr.ImportExtensions(Revit.Elements)
clr.ImportExtensions(Revit.GeometryConversion)

# Import Revit UI
clr.AddReference('RevitAPIUI')
from Autodesk.Revit.UI import *
#from Autodesk.Revit.UI.Selection import *

from Autodesk.DesignScript.Geometry import *

#The inputs to this node will be stored as a list in the IN variables.
gridline_id = IN[0]
curves = IN[1]

doc = DocumentManager.Instance.CurrentDBDocument
uiapp = DocumentManager.Instance.CurrentUIApplication
app = uiapp.Application

output = None



# Transaction


# To handle single items or lists..
def function(gridline_id, crvs):
	# Do something with item and get a result
	grid_line = doc.GetElement(gridline_id)
	
	# Start Transaction
	TransactionManager.Instance.EnsureInTransaction(doc)
	
	for crv in crvs:
		result = grid_line.RemoveSegment(crv)
		
	# End Transaction
	TransactionManager.Instance.TransactionTaskDone()
	

	return result

output = None


output = function(UnwrapElement(gridline_id), curves)



#Assign your output to the OUT variable.
OUT = output
# ----------------------------------------
OUT = Output(removeSegment)
