# Dynamo custom node CurtainGrids.dyf (Dynamo 2.0.3.8810)
# category: Antler.CurtainGrid
# Get all the CurtainGrid object of this CurtainSystem. Each CurtainGrid corresponds to one face.

IN_0_var = Input(IN[0]: var[]..[]: var[]..[])
python_script = Python(IN[0]=IN_0_var)
# ---------- python_script.python (30 lines) ----------
# Enable Python support and load DesignScript library
import clr

# Import RevitAPI
clr.AddReference("RevitAPI")
from Autodesk.Revit import DB

# Import ToDSType(bool) extension method
clr.AddReference("RevitNodes")
import Revit
clr.ImportExtensions(Revit.Elements)
clr.ImportExtensions(Revit.GeometryConversion)

#The inputs to this node will be stored as a list in the IN variable.
elements = IN[0]

def function(element):
	if isinstance(element, (list, tuple)):
		return [function(e) for e in element]
	else:
		# Code follows here:
		element = UnwrapElement(element)
		
		grids = [a for a in element.CurtainGrids]
		
		
		return grids
		

OUT = function(elements)
# ----------------------------------------
OUT = Output(python_script)
