# Dynamo custom node CurveArray.dyf (Dynamo 2.3.0.5885)
# category: Antler.Geometry.Curves

curves = Input(curves: var[]..[])
python_script = Python(IN[0]=curves)
# ---------- python_script.python (35 lines) ----------
import clr
clr.AddReference('ProtoGeometry')
from Autodesk.DesignScript.Geometry import *

# Import DocumentManager and TransactionManager
clr.AddReference ("RevitServices")
import RevitServices
from RevitServices.Persistence import DocumentManager
from RevitServices.Transactions import TransactionManager


# Import RevitAPI
clr.AddReference("RevitAPI")
import Autodesk
from Autodesk.Revit.DB import *

# Import ToDSType(bool) extension method
clr.AddReference("RevitNodes")
import Revit
clr.ImportExtensions(Revit.Elements)
clr.ImportExtensions(Revit.GeometryConversion)


#The inputs to this node will be stored as a list in the IN variables.
doc = DocumentManager.Instance.CurrentDBDocument
app = DocumentManager.Instance.CurrentUIApplication.Application

curvelist = IN[0]

carray = CurveArray()

for curve in curvelist:
	carray.Append(curve.ToRevitType())
	
OUT = carray
# ----------------------------------------
curve_array = Output(python_script)
