# Dynamo graph CurveLoops.dyf (Dynamo 2.0.3.8810)

select_model_element = DSModelElementSelection()  # 1 picked in the model
curtainGridLines = Custom[Element.CurtainGridLines](hostElement=select_model_element)  # Retrieves the grid lines of curtain walls, curtain systems or glazed roofs.
getReference = archilab.Revit.Elements.CurtainGridLines.GetReference(curtainGridLine=curtainGridLines.uGridLines)
select_model_element_2 = DSModelElementSelection()  # 1 picked in the model
# note: family
curtainGridLines_2 = Custom[Element.CurtainGridLines](hostElement=select_model_element_2)
fullCurve = Custom[CurtainGridLine.FullCurve](curtain_grid_line=curtainGridLines_2.vGridLines)  # Retrieve the geometry curve of the curtain grid line.
relay = Relay(select_model_element_2)
curtainGrids = Custom[CurtainGrids](IN[0]=relay)  # Get all the CurtainGrid object of this CurtainSystem. Each CurtainGrid corresponds to one face.
getCurtainCells = Custom[GetCurtainCells](IN[0]=curtainGrids)  # Gets the CurtainCells owned by this curtain grid.
firstItem = List.FirstItem(list=getCurtainCells@L2)
python_dir = Custom[Python dir()](object=firstItem)  # The dir() method tries to return a list of valid attributes of the object.
geometry = Element.Geometry(element=select_model_element_2)
elementFaceReferences = Element.ElementFaceReferences(element=select_model_element_2)
python_script = Python(IN[0]=select_model_element_2)
# ---------- python_script.python (24 lines) ----------
# Enable Python support and load DesignScript library
import clr

# Import RevitAPI
clr.AddReference("RevitAPI")
from Autodesk.Revit import DB

#The inputs to this node will be stored as a list in the IN variable.
elements = IN[0]

def function(element):
	if isinstance(element, (list, tuple)):
		return [function(e) for e in element]
	else:
		# Code follows here:
		element = UnwrapElement(element)
		
		face = element.GetGeometryObjectFromReference(element)
		
		face = face.ToProtoType()
		
		return face

OUT = function(elements)
# ----------------------------------------
python_script_2 = Python(IN[0]=select_model_element_2)
# ---------- python_script_2.python (22 lines) ----------
# Enable Python support and load DesignScript library
import clr

# Import RevitAPI
clr.AddReference("RevitAPI")
from Autodesk.Revit import DB

#The inputs to this node will be stored as a list in the IN variable.
elements = IN[0]

def function(element):
	if isinstance(element, (list, tuple)):
		return [function(e) for e in element]
	else:
		# Code follows here:
		element = UnwrapElement(element)
		
		inserts = element.FindInserts(True, True, True, True)
		
		return inserts

OUT = function(elements)
# ----------------------------------------
elementCurveReferences = Element.ElementCurveReferences(element=select_model_element_2)
python_script_3 = Python(IN[0]=select_model_element_2)
# ---------- python_script_3.python (26 lines) ----------
# Enable Python support and load DesignScript library
import clr

# Import RevitAPI
clr.AddReference("RevitAPI")
from Autodesk.Revit import DB

#The inputs to this node will be stored as a list in the IN variable.
elements = IN[0]

def function(element):
	if isinstance(element, (list, tuple)):
		return [function(e) for e in element]
	else:
		# Code follows here:
		element = UnwrapElement(element)
		
		ref = DB.Reference(element)
		
		DB.HostObjectUtils.
		
		
		
		return ref

OUT = function(elements)
# ----------------------------------------
getLocation = Element.GetLocation(element=select_model_element_2)
solids = Element.Solids(element=select_model_element_2)
faces = Element.Faces(element=select_model_element_2)
python_script_4 = Python(IN[0]=select_model_element_2)
# ---------- python_script_4.python (24 lines) ----------
# Enable Python support and load DesignScript library
import clr

# Import RevitAPI
clr.AddReference("RevitAPI")
from Autodesk.Revit import DB

#The inputs to this node will be stored as a list in the IN variable.
elements = IN[0]

def function(element):
	if isinstance(element, (list, tuple)):
		return [function(e) for e in element]
	else:
		# Code follows here:
		element = UnwrapElement(element)
		
		location = element.Location
		
		#face = clr.Convert(location, DB.Surface)
		
		return element.Location

OUT = function(elements)
# ----------------------------------------
allSegmentCurves = Custom[CurtainGridLine.AllSegmentCurves](curtain_grid_line=curtainGridLines_2.vGridLines)  # Retrieve the curves of all segments.
code_block = CodeBlock(t=allSegmentCurves)
# ---------- code_block.designscript (7 lines) ----------
first = List.GetItemAtIndex(t@L2<1>, 0);
second = List.GetItemAtIndex(t@L2<1>, 1);

v = Geometry.DistanceTo(first, second);

Vector.ByCoordinates(0, v, 0);
Vector.ByCoordinates(0, -v, 0);
# ----------------------------------------
allSegmentCurves_2 = Custom[CurtainGridLine.AllSegmentCurves](curtain_grid_line=curtainGridLines_2.uGridLines)
select_face = DSFaceSelection()  # 1 picked in the model
coordinateSystemAtParameter = Surface.CoordinateSystemAtParameter(surface=select_face)
code_block_2 = CodeBlock(coordinate_system=coordinateSystemAtParameter) { coordinate_system; }
identity = CoordinateSystem.Identity()
transform = Geometry.Transform(geometry=allSegmentCurves_2, fromCoordinateSystem=code_block_2, contextCoordinateSystem=identity)
curves = PolyCurve.Curves(polyCurve=transform)

# group: Lines - U-direction (Horizontal)
startPoint = Curve.StartPoint(curve=curves)

code_block_3 = CodeBlock(x=code_block.v, pt=startPoint) { x2 = Math.Round(x * 1000) / 1000; mod = pt.Y % x2; List.Clean(mod < 1.0? pt: null, false); }

# group (continued): Lines - U-direction (Horizontal)
lastItem = List.LastItem(list=code_block_3.out2@L2)
firstItem_2 = List.FirstItem(list=code_block_3.out2@L2)

translate = Geometry.Translate(geometry=lastItem, direction=code_block.out3, lacing=Longest)
translate_2 = Geometry.Translate(geometry=firstItem_2, direction=code_block.out4, lacing=Longest)
addItemToFront = List.AddItemToFront(item=translate_2@L1, list=code_block_3.out2@L2)
addItemToEnd = List.AddItemToEnd(item=translate@L1, list=addItemToFront@L2)
byPoints = PolyCurve.ByPoints(points=addItemToEnd)
curves_2 = PolyCurve.Curves(polyCurve=byPoints)
code_block_4 = CodeBlock(t=allSegmentCurves_2)
# ---------- code_block_4.designscript (8 lines) ----------
first = List.GetItemAtIndex(t@L2<1>, 0);
second = List.GetItemAtIndex(t@L2<1>, 1);

u = Geometry.DistanceTo(first, second);


Vector.ByCoordinates(u, 0, 0);
Vector.ByCoordinates(-u, 0, 0);
# ----------------------------------------
transform_2 = Geometry.Transform(geometry=allSegmentCurves, fromCoordinateSystem=code_block_2, contextCoordinateSystem=identity)
curves_3 = PolyCurve.Curves(polyCurve=transform_2)

# group: Lines - V-direction (Vertical)
startPoint_2 = Curve.StartPoint(curve=curves_3)
code_block_5 = CodeBlock { 0; }
removeItemAtIndex = List.RemoveItemAtIndex(list=startPoint_2@L2, indices=code_block_5)

code_block_6 = CodeBlock(x=code_block_4.u, pt=startPoint_2) { x2 = Math.Round(x * 1000) / 1000; mod = pt.X % x2; List.Clean(mod < 1.0? pt : null, false); }

# group (continued): Lines - V-direction (Vertical)
lastItem_2 = List.LastItem(list=code_block_6.out2@L2)
firstItem_3 = List.FirstItem(list=code_block_6.out2@L2)

translate_3 = Geometry.Translate(geometry=lastItem_2, direction=code_block_4.out4, lacing=Longest)
translate_4 = Geometry.Translate(geometry=firstItem_3, direction=code_block_4.out3, lacing=Longest)
addItemToFront_2 = List.AddItemToFront(item=translate_4@L1, list=code_block_6.out2@L2)
addItemToEnd_2 = List.AddItemToEnd(item=translate_3@L1, list=addItemToFront_2@L2)
byPoints_2 = PolyCurve.ByPoints(points=addItemToEnd_2)
curves_4 = PolyCurve.Curves(polyCurve=byPoints_2)
pointGridFromCrvGrid = Custom[PointGridFromCrvGrid](crv_grid_u=curves_2@L2, crv_grid_v=curves_4@L2)
relay_2 = Relay(code_block_2)
transform_3 = Geometry.Transform(geometry=pointGridFromCrvGrid, fromCoordinateSystem=identity, contextCoordinateSystem=relay_2, lacing=Longest)
boolean = BoolSelector(true)
byPoints_3 = PolyCurve.ByPoints(points=transform_3, connectLastToFirst=boolean)
python_script_5 = Python()  # frozen; unwired: IN[0], IN[1]
# ---------- python_script_5.python (50 lines) ----------
# Enable Python support and load DesignScript library
import clr

# Import RevitAPI
clr.AddReference("RevitAPI")
from Autodesk.Revit import DB

# For working with DesignScript abstract geometry
clr.AddReference('ProtoGeometry')
from Autodesk.DesignScript.Geometry import *

# Import ToDSType(bool) extension method
clr.AddReference("RevitNodes")
import Revit
clr.ImportExtensions(Revit.Elements)
clr.ImportExtensions(Revit.GeometryConversion)



#The inputs to this node will be stored as a list in the IN variable.
grid_u = IN[0]
grid_v = IN[1]

def quad_from_two_crvs():
	pass

quads = []

for crvs_u in grid_u:
	for u in crvs_u:
	
	for crvs_v in grid_v:
		# Longest list
		
		length = max(len(crvs_u), len(crvs_v))
		
		for i in range(max(len(crvs_u), len(crvs_v))):
			u = crvs_u[i % len(crvs_u)]
			v = crvs_v[i % len(crvs_v)]
			
			pt0 = Point.ByCoordinates(v.StartPoint.X, u.StartPoint.Y, 0)
			pt1 = Point.ByCoordinates(v.StartPoint.X, u.EndPoint.Y,   0)		
			pt2 = Point.ByCoordinates(v.EndPoint.X,   u.EndPoint.Y,   0)
			pt3 = Point.ByCoordinates(v.EndPoint.X,   u.StartPoint.Y, 0)

			quads.append((pt0, pt1, pt2, pt3))
		

#Assign your output to the OUT variable.
OUT = quads
# ----------------------------------------
properties = Custom[CurtainGrid.Properties](curtain_grid=curtainGrids)  # All properties of Curtain Grid.
identity_2 = Object.Identity(obj=pointGridFromCrvGrid)
family_types = FamilyTypes(index=47)
byPoints_4 = AdaptiveComponent.ByPoints(points=transform_3, familyType=family_types)
curveLoops = Custom[CurveLoops](IN[0]=getCurtainCells)  # The cell boundaries on the reference face. The boundaries can have more than one CurveLoop. Each item in the returned array represents a CurveLoop containing 3 or more than 3 edges.
transform_4 = Geometry.Transform(geometry=curveLoops, fromCoordinateSystem=code_block_2, contextCoordinateSystem=identity)
watch = Watch(code_block.v)
watch_2 = Watch()  # unwired: arg0
watch_3 = Watch(code_block_3.out2)
