# Dynamo custom node Definition.Properties.dyf (Dynamo 2.0.3.8810)
# category: Antler.Parameters
# Parameter Definition properties.

definition = Input(definition: var[]..[])
python_script = Python(IN[0]=definition)
# ---------- python_script.python (27 lines) ----------
# Enable Python support and load DesignScript library
import clr

# Import RevitAPI
clr.AddReference("RevitAPI")
from Autodesk.Revit import DB

#The inputs to this node will be stored as a list in the IN variable.
elements = IN[0]

def function(element):
	if isinstance(element, (list, tuple)):
		return [function(e) for e in element]
	else:
		# Code follows here:
		element = UnwrapElement(element)
		
		properties = {
			"Name" 			:element.Name 				,	# The user visible name for the parameter.
			"ParameterGroup": 	element.ParameterGroup 	,	#Returns the group ID of the parameter definition.
			"ParameterType" :	element.ParameterType 	,	#Returns the user visible interpretation of the parameter data.
			"UnitType" 		:element.UnitType 			,	#Returns the UnitType of the parameter definition.
			}
					
		return properties.keys(), properties.values()

OUT = function(elements)
# ----------------------------------------
code_block = CodeBlock { 0; }
getItemAtIndex = List.GetItemAtIndex(list=python_script@L3, index=code_block)
code_block_2 = CodeBlock { 1; }
getItemAtIndex_2 = List.GetItemAtIndex(list=python_script@L3, index=code_block_2)
byKeysValues = DesignScript.Builtin.Dictionary.ByKeysValues(keys=getItemAtIndex, values=getItemAtIndex_2, lacing=Shortest)
properties = Output(byKeysValues)
watch = Watch(byKeysValues)
watch_2 = Watch(getItemAtIndex)
