# Dynamo custom node Delete Element.dyf (Dynamo 2.3.0.5885)
# category: Antler.Element.Action
# Delete elements if commit? = True

element = Input(element: var[]..[])
commit = Input(commit: bool = false)
python_script = Python(IN[0]=element, IN[1]=commit)
# ---------- python_script.python (43 lines) ----------
import clr
clr.AddReference('ProtoGeometry')
from Autodesk.DesignScript.Geometry import *

# Import DocumentManager and TransactionManager
clr.AddReference ("RevitServices")
import RevitServices
from RevitServices.Persistence import DocumentManager
from RevitServices.Transactions import TransactionManager

clr.AddReference("RevitNodes")
import Revit

# Import Element wrapper extension methods
clr.ImportExtensions(Revit.Elements)

#The inputs to this node will be stored as a list in the IN variable.
element = UnwrapElement(IN[0])
bool = IN[1]

doc = DocumentManager.Instance.CurrentDBDocument

result = "not deleted"

if bool:

	# Start Transaction
	TransactionManager.Instance.EnsureInTransaction(doc)

	# Example Transaction
	try:
		doc.Delete(element.Id)
		result = "deleted"
	except:
		result = "exception - not deleted"
		pass
		

	# End Transaction
	TransactionManager.Instance.TransactionTaskDone()

#Assign your output to the OUT variable
OUT = result
# ----------------------------------------
OUT = Output(python_script)
