# Dynamo custom node DividedSurface.FamilyInstances.dyf (Dynamo 2.0.3.8810)
# category: Antler.DividedSurface

divided_surface = Input(divided_surface: var[]..[])
python_script = Python(IN[0]=divided_surface)
# ---------- python_script.python (92 lines) ----------
# Enable Python support and load DesignScript library
import clr

# For working with DesignScript abstract geometry
clr.AddReference('ProtoGeometry')
from Autodesk.DesignScript.Geometry import *

# Import ToDSType(bool) extension method
clr.AddReference("RevitNodes")
import Revit
clr.ImportExtensions(Revit.Elements)
clr.ImportExtensions(Revit.GeometryConversion)

# Import RevitAPI
clr.AddReference("RevitAPI")
from Autodesk.Revit import DB

# Import DocumentManager and TransactionManager
clr.AddReference ("RevitServices")
import RevitServices
from RevitServices.Persistence import DocumentManager
from RevitServices.Transactions import TransactionManager

doc = DocumentManager.Instance.CurrentDBDocument
uiapp = DocumentManager.Instance.CurrentUIApplication
app = uiapp.Application

#The inputs to this node will be stored as a list in the IN variable.
divided_srf = IN[0]


def query_divided_srf(divided_srf):
	"""
	Query panel family instances from Divided Surface.
	"""
	family_instances = []
	uv_pts = []
	uv_indices = []
	
	face = divided_srf.Host.GetGeometryObjectFromReference(divided_srf.HostReference)
	face = face.ToProtoType()
	
	for v in range(divided_srf.NumberOfVGridlines):
		fam_inst_u = []
		uv_pts_u = []
		uv_indices_u = []
	
		for u in range(divided_srf.NumberOfUGridlines):
		
			grid_node = DB.GridNode(u, v)
						
			try:
				fam_inst_u.append([
					divided_srf.GetTileFamilyInstance(grid_node, 0),
					divided_srf.GetTileFamilyInstance(grid_node, 1)
					])
			except:
				fam_inst_u.append(
					divided_srf.GetTileFamilyInstance(grid_node, 0)
					)
					
			uv_pts_u.append(divided_srf.GetGridNodeUV(grid_node).ToProtoType())
			uv_indices_u.append((u, v))
		
		family_instances.append(fam_inst_u)
		uv_pts.append(uv_pts_u)
		uv_indices.append(uv_indices_u)
		
	
	return uv_indices, uv_pts, family_instances, face

output = None

# Start Transaction
TransactionManager.Instance.EnsureInTransaction(doc)

# Transaction
# To handle single items or lists..
if isinstance(divided_srf, list):
	output = [query_divided_srf(a) for a in UnwrapElement(divided_srf)]
else:
	output = [query_divided_srf(UnwrapElement(divided_srf))]
	


# End Transaction
TransactionManager.Instance.TransactionTaskDone()

#Assign your output to the OUT variable.
OUT = output

 
# ----------------------------------------
transpose = List.Transpose(lists=python_script)
code_block = CodeBlock(t=transpose) { t[0]; t[1]; t[2]; t[3]; }
uv_indices = Output(code_block.out0)
uv_pts = Output(code_block.out1)
family_instances = Output(code_block.out2)
surface = Output(code_block.out3)
