# Dynamo custom node Document.Central Model Path.dyf "Central Model Path" (Dynamo 2.3.0.5885)
# category: Antler.Document.Query

python_script = Python()  # unwired: IN[0]
# ---------- python_script.python (26 lines) ----------
import clr
clr.AddReference('RevitAPI')
from Autodesk.Revit.DB import *

# Import DocumentManager and TransactionManager
clr.AddReference("RevitServices")
import RevitServices
from RevitServices.Persistence import DocumentManager
from RevitServices.Transactions import TransactionManager

doc = DocumentManager.Instance.CurrentDBDocument

modelpath = None
filepath = None

modelpath = doc.GetWorksharingCentralModelPath()

if modelpath:
	filepath = ModelPathUtils.ConvertModelPathToUserVisiblePath(modelpath)
else:
	filepath = doc.PathName




OUT = filepath
# ----------------------------------------
path = Output(python_script)
