# Dynamo custom node Document.Current View.dyf "Current View" (Dynamo 2.3.0.5885)
# category: Antler.Document
# Returns current view

python_script = Python()
# ---------- python_script.python (31 lines) ----------
import clr
clr.AddReference('ProtoGeometry')
from Autodesk.DesignScript.Geometry import *

# Import RevitAPI
clr.AddReference("RevitAPI")
import Autodesk
from Autodesk.Revit.DB import *

# Import DocumentManager and TransactionManager
clr.AddReference("RevitServices")
import RevitServices
from RevitServices.Persistence import DocumentManager
from RevitServices.Transactions import TransactionManager



#The inputs to this node will be stored as a list in the IN variable.
dataEnteringNode = IN

doc = DocumentManager.Instance.CurrentDBDocument

curview = doc.ActiveView
activeViewId = curview.Id
nextElement = doc.GetElement(ElementId(activeViewId.IntegerValue+1))
rDir = curview.RightDirection
rDir = XYZ(rDir.X, rDir.Y, rDir.Z)
uDir = curview.UpDirection

#Assign your output to the OUT variable
OUT = curview, activeViewId, rDir, uDir
# ----------------------------------------
code_block = CodeBlock(a=python_script) { a[0]; a[1]; a[2]; a[3]; }
Element = Output(code_block.out0)
Id = Output(code_block.out1)
RightDirection = Output(code_block.out2)
UpDirection = Output(code_block.out3)
