# Dynamo custom node Document.ProjectInformation.dyf (Dynamo 2.0.2.6826)
# category: Antler.Document

IN_0 = Input(IN[0]: var[]..[])
python_script = Python(IN[0]=IN_0)
# ---------- python_script.python (35 lines) ----------
# Enable Python support and load DesignScript library
import clr

clr.AddReference('ProtoGeometry')
from Autodesk.DesignScript.Geometry import *

# Import RevitAPI
clr.AddReference("RevitAPI")
from Autodesk.Revit.DB import *

# Import DocumentManager and TransactionManager
clr.AddReference("RevitServices")
import RevitServices
from RevitServices.Persistence import DocumentManager
from RevitServices.Transactions import TransactionManager

# Import ToDSType(bool) extension method
clr.AddReference("RevitNodes")
import Revit
clr.ImportExtensions(Revit.Elements)
clr.ImportExtensions(Revit.GeometryConversion)

#The inputs to this node will be stored as a list in the IN variables.
item = IN[0]

def function(doc):
	# Do something with item and get a result
	info = doc.ProjectInformation 

	return info

output = function(UnwrapElement(item))

#Assign your output to the OUT variable.
OUT = output
# ----------------------------------------
OUT = Output(python_script)
