# Dynamo custom node Element.Area.dyf (Dynamo 2.3.0.5885)
# category: tholth.Element.Query
# Location point of element

element = Input(element: var[]..[])
python_script = Python(IN[0]=element)
# ---------- python_script.python (36 lines) ----------
import clr
clr.AddReference('ProtoGeometry')
from Autodesk.DesignScript.Geometry import *

clr.AddReference('RevitAPI')
from Autodesk.Revit.DB import *

clr.AddReference( "RevitNodes")
import Revit

# Import geometry conversion extension methods
clr.ImportExtensions(Revit.GeometryConversion)

# Import Element wrapper extension methods
clr.ImportExtensions(Revit.Elements)

#The inputs to this node will be stored as a list in the IN variables.
input = IN[0]

def function(item):
	try:
		area = item.Area
	except:
		area = None
	
	return area
	
output = None

if isinstance(input, list):
    output = [function(a) for a in UnwrapElement(input)]
else:
    output = function(UnwrapElement(input))

#Assign your output to the OUT variable.
OUT = output
# ----------------------------------------
area = Output(python_script)
