# Dynamo custom node Element.CanBeHidden.dyf (Dynamo 2.3.0.5885)
# category: Antler.Element.Query

element = Input(element: var[]..[])
view = Input(view: var[]..[])
python_script = Python(IN[0]=element, IN[1]=view)
# ---------- python_script.python (28 lines) ----------
import clr
clr.AddReference('ProtoGeometry')
from Autodesk.DesignScript.Geometry import *

# Import RevitAPI
clr.AddReference("RevitAPI")
import Autodesk
from Autodesk.Revit.DB import *

# Import DocumentManager and TransactionManager
clr.AddReference("RevitServices")
import RevitServices
from RevitServices.Persistence import DocumentManager
from RevitServices.Transactions import TransactionManager

#The inputs to this node will be stored as a list in the IN variables.
element = UnwrapElement(IN[0])
view = UnwrapElement(IN[1])

"""
if not isinstance(indata, list):
	indata = [indata]
"""

canbehidden = element.CanBeHidden(view)

#Assign your output to the OUT variable.
OUT = canbehidden
# ----------------------------------------
OUT = Output(python_script)
