# Dynamo custom node Element.Delete Element by ID.dyf "Delete Element by ID" (Dynamo 2.3.0.5885)
# category: Antler.Element.Action
# Delete elements if commit? = True

id = Input(id: var[]..[])
commit = Input(commit: bool = false)
python_script = Python(IN[0]=id, IN[1]=commit)
# ---------- python_script.python (38 lines) ----------
import clr
clr.AddReference('ProtoGeometry')
from Autodesk.DesignScript.Geometry import *

# Import DocumentManager and TransactionManager
clr.AddReference ("RevitServices")
import RevitServices
from RevitServices.Persistence import DocumentManager
from RevitServices.Transactions import TransactionManager


clr.AddReference("RevitNodes")
import Revit



# Import Element wrapper extension methods
clr.ImportExtensions(Revit.Elements)

#The inputs to this node will be stored as a list in the IN variable.
Id = IN[0]
bool = IN[1]

doc = DocumentManager.Instance.CurrentDBDocument

if bool:

	# Start Transaction
	TransactionManager.Instance.EnsureInTransaction(doc)

	# Example Transaction
	doc.Delete(Id)

	# End Transaction
	TransactionManager.Instance.TransactionTaskDone()

#Assign your output to the OUT variable
OUT = None
# ----------------------------------------
OUT = Output(python_script)
