# Dynamo custom node Element.Delete Elements.dyf "Delete Element" (Dynamo 2.0.2.6826)
# category: Antler.Element.Action
# Delete elements if commit? = True

elements = Input(elements: var[]..[])
python_script = Python(IN[0]=elements)
# ---------- python_script.python (77 lines) ----------
import clr
clr.AddReference('ProtoGeometry')
from Autodesk.DesignScript.Geometry import *

# Import DocumentManager and TransactionManager
clr.AddReference ("RevitServices")
import RevitServices
from RevitServices.Persistence import DocumentManager
from RevitServices.Transactions import TransactionManager

clr.AddReference("RevitNodes")
import Revit

clr.AddReference("System.Drawing")
clr.AddReference("System.Windows.Forms")

from System.Drawing import Point
from System.Windows.Forms import Application, Button, Form, Label, CheckBox

# Import Element wrapper extension methods
clr.ImportExtensions(Revit.Elements)

#The inputs to this node will be stored as a list in the IN variable.
elements = UnwrapElement(IN[0])

doc = DocumentManager.Instance.CurrentDBDocument

class DeletionForm(Form):
    def __init__(self):
        self.Text = 'Message'

        self.label = Label()
        self.label.Text = "{0} elements will be deleted!".format(len(elements))
        self.label.Location = Point(50, 50)
        self.label.Height = 30
        self.label.Width = 200

        button = Button()
        button.Text = "OK"
        button.Location = Point(50, 150)

        button.Click += self.buttonPressed
        
        self.check1 = CheckBox()
        self.check1.Text = "Check to delete"
        self.check1.Location = Point(50, 100)
        self.check1.Width = 90

        self.Controls.Add(self.label)
        self.Controls.Add(button)
        self.Controls.Add(self.check1)

    def buttonPressed(self, sender, args):
        #print 'The label *used to say* : %s' % self.label.Text
        self.Close()
        
form = DeletionForm()

Application.Run(form)

if form.check1.Checked:

	# Start Transaction
	TransactionManager.Instance.EnsureInTransaction(doc)

	# Example Transaction
	for element in elements:
		try:
			doc.Delete(element.Id)
		except:
			pass

	# End Transaction
	TransactionManager.Instance.TransactionTaskDone()

#Assign your output to the OUT variable
OUT = None
# ----------------------------------------
OUT = Output(python_script)
