# Dynamo custom node Element.DesignOption.dyf (Dynamo 2.3.0.5885)
# category: tholth.Element.Query
# Get Design Option of element

element = Input(element: var[]..[])
designOption = Python(IN[0]=element)  # "Element.DesignOption"
# ---------- designOption.python (28 lines) ----------
import clr

# Import RevitAPI
clr.AddReference("RevitAPI")
import Autodesk
from Autodesk.Revit.DB import *
#The inputs to this node will be stored as a list in the IN variable.
input = IN[0]

output = []

function = lambda x: x.DesignOption #.Name

if isinstance(input, list):
	for i in UnwrapElement(input):
		try:
			output.append(function(i))
		

		except Exception,e:
			print str(e)
			output.append(None)
	#output = [function(a) for a in input]
else:
	output = function(UnwrapElement(input))

#Assign your output to the OUT variable
OUT = output
# ----------------------------------------
design_option = Output(designOption)
