# Dynamo custom node Element.Hosted.dyf (Dynamo 2.3.0.5885)
# category: Antler
# Gets all Elements hosted by selected Elements

host_element = Input(host_element: var[]..[])
python_script = Python(IN[0]=host_element)
# ---------- python_script.python (46 lines) ----------
# Enable Python support and load DesignScript library
import clr

# Import RevitAPI
clr.AddReference("RevitAPI")
from Autodesk.Revit import DB

# Import DocumentManager and TransactionManager
clr.AddReference ("RevitServices")
import RevitServices
from RevitServices.Persistence import DocumentManager
from RevitServices.Transactions import TransactionManager

doc = DocumentManager.Instance.CurrentDBDocument
uiapp = DocumentManager.Instance.CurrentUIApplication
app = uiapp.Application


#The inputs to this node will be stored as a list in the IN variable.
items = IN[0]

def get_hosted_elements(host):
    """
    """
    provider = DB.ParameterValueProvider(DB.ElementId(DB.BuiltInParameter.HOST_ID_PARAM))
    rule = DB.FilterElementIdRule(provider, DB.FilterNumericEquals(), host.Id)
    parameter_filter = DB.ElementParameterFilter(rule)

    collector = DB.FilteredElementCollector(doc)
    collector.OfClass(DB.FamilyInstance)
    collector.WherePasses(parameter_filter)

    elements = collector.ToElements()

    return elements

output = None

# To handle single items or lists..
if isinstance(items, list):
	output = [get_hosted_elements(a) for a in UnwrapElement(items)]
else:
	output = get_hosted_elements(UnwrapElement(items))

#Assign your output to the OUT variable.
OUT = output
# ----------------------------------------
hosted_elements = Output(python_script)
