# Dynamo custom node Element.LocationPoint.dyf (Dynamo 2.3.0.5885)
# category: Antler.Element.Query
# Location point of element

element = Input(element: var[]..[])
python_script = Python(IN[0]=element)
# ---------- python_script.python (33 lines) ----------
import clr
clr.AddReference('ProtoGeometry')
from Autodesk.DesignScript.Geometry import *

clr.AddReference('RevitAPI')
from Autodesk.Revit.DB import *

clr.AddReference( "RevitNodes")
import Revit

# Import geometry conversion extension methods
clr.ImportExtensions(Revit.GeometryConversion)

# Import Element wrapper extension methods
clr.ImportExtensions(Revit.Elements)

#The inputs to this node will be stored as a list in the IN variables.
input = IN[0]

def function(item):
	location_pt = item.Location
	point = location_pt.Point
	return point.ToPoint()

output = None

if isinstance(input, list):
    output = [function(a) for a in UnwrapElement(input)]
else:
    output = function(UnwrapElement(input))

#Assign your output to the OUT variable.
OUT = output
# ----------------------------------------
point = Output(python_script)
