# Dynamo custom node Element.Move.dyf (Dynamo 2.0.2.6826)
# category: tholth.Element.Action
# Moves element in Revit

elements = Input(elements: var[]..[])
vectors = Input(vectors: var[]..[])
python_script = Python(IN[0]=elements, IN[1]=vectors)
# ---------- python_script.python (52 lines) ----------
import clr

clr.AddReference('ProtoGeometry')
from Autodesk.DesignScript.Geometry import *

# Import RevitAPI
clr.AddReference("RevitAPI")
import Autodesk
from Autodesk.Revit.DB import ReferencePointArray

# Import DocumentManager and TransactionManager
clr.AddReference("RevitServices")
import RevitServices
from RevitServices.Persistence import DocumentManager
from RevitServices.Transactions import TransactionManager

# Import ToDSType(bool) extension method
clr.AddReference("RevitNodes")
import Revit
clr.ImportExtensions(Revit.Elements)

clr.AddReference('RevitAPI')
from Autodesk.Revit.DB import *

clr.AddReference("RevitNodes")
import Revit
clr.ImportExtensions(Revit.Elements)
clr.ImportExtensions(Revit.GeometryConversion)

#The inputs to this node will be stored as a list in the IN variable.
elements = UnwrapElement(IN[0])
translations =  [a.ToRevitType() for a in IN[1]]

movedElement = []

curDoc = DocumentManager.Instance.CurrentDBDocument

# Start Transaction
TransactionManager.Instance.EnsureInTransaction(curDoc)

for i in range(len(elements)):

	try:
		movedElement = ElementTransformUtils.MoveElement(curDoc, element[i].Id, translations[i])
	except:
		pass

# End Transaction
TransactionManager.Instance.TransactionTaskDone()

#Assign your output to the OUT variable
OUT = movedElement
# ----------------------------------------
out = Output(python_script)
