# Dynamo custom node Element.Ownership.dyf (Dynamo 2.3.0.5885)
# category: tholth.Element.Query

element = Input(element: var[]..[])
python_script = Python(IN[0]=element)
# ---------- python_script.python (36 lines) ----------
import clr

clr.AddReference('ProtoGeometry')
from Autodesk.DesignScript.Geometry import *

# Import RevitAPI
clr.AddReference("RevitAPI")
import Autodesk
from Autodesk.Revit.DB import *

# Import DocumentManager and TransactionManager
clr.AddReference("RevitServices")
import RevitServices
from RevitServices.Persistence import DocumentManager
from RevitServices.Transactions import TransactionManager

# Import ToDSType(bool) extension method
clr.AddReference("RevitNodes")
import Revit
clr.ImportExtensions(Revit.Elements)
clr.ImportExtensions(Revit.GeometryConversion)

# Import Revit UI
clr.AddReference('RevitAPIUI')
from Autodesk.Revit.UI import *
#from Autodesk.Revit.UI.Selection import *

#The inputs to this node will be stored as a list in the IN variables.
elements = UnwrapElement(IN[0])

doc = DocumentManager.Instance.CurrentDBDocument

ownership = [WorksharingUtils.GetCheckoutStatus(doc, element.Id) for element in elements]

#Assign your output to the OUT variable.
OUT = ownership
# ----------------------------------------
owner = Output(python_script)
