# Dynamo custom node Element.Rotate.dyf (Dynamo 2.0.3.8810)
# category: Antler.Element.Action
# Rotate Revit element

element = Input(element: var[]..[])
axis = Input(axis: var[]..[])
angle = Input(angle: var[]..[])
python_script = Python(IN[0]=element, IN[1]=axis, IN[2]=angle)
# ---------- python_script.python (52 lines) ----------
import clr

clr.AddReference('ProtoGeometry')
from Autodesk.DesignScript.Geometry import *

# Import RevitAPI
clr.AddReference("RevitAPI")
import Autodesk
from Autodesk.Revit.DB import ReferencePointArray

# Import DocumentManager and TransactionManager
clr.AddReference("RevitServices")
import RevitServices
from RevitServices.Persistence import DocumentManager
from RevitServices.Transactions import TransactionManager

# Import ToDSType(bool) extension method
clr.AddReference("RevitNodes")
import Revit
clr.ImportExtensions(Revit.Elements)

clr.AddReference('RevitAPI')
from Autodesk.Revit.DB import *

clr.AddReference("RevitNodes")
import Revit
clr.ImportExtensions(Revit.Elements)
clr.ImportExtensions(Revit.GeometryConversion)

#The inputs to this node will be stored as a list in the IN variable.
element = UnwrapElement(IN[0])
axis =  IN[1].ToRevitType()
angle = IN[2]
#commitTransaction = IN[3]


curDoc = DocumentManager.Instance.CurrentDBDocument

# Start Transaction
TransactionManager.Instance.EnsureInTransaction(curDoc)

try:
	if angle != 0:
		rotatedElement = ElementTransformUtils.RotateElement(curDoc, element.Id, axis, angle)
except Exception as e:
	rotatedElement = e

# End Transaction
TransactionManager.Instance.TransactionTaskDone()

#Assign your output to the OUT variable
OUT = rotatedElement
# ----------------------------------------
element_2 = Output(python_script)  # "element"
