# Dynamo custom node Element.SetWorkset.dyf "Element.Workset" (Dynamo 2.3.0.5885)
# category: Antler.Element

element = Input(element: var[]..[])
workset = Input(workset: var[]..[])
python_script = Python(IN[0]=element, IN[1]=workset)
# ---------- python_script.python (47 lines) ----------
import clr

# Import RevitAPI
clr.AddReference("RevitAPI")
import Autodesk
from Autodesk.Revit.DB import *

# Import List
from System.Collections.Generic import List

#The inputs to this node will be stored as a list in the IN variable.
element = UnwrapElement(IN[0])
workset = UnwrapElement(IN[1])


def set_workset(element, workset):
    # Do something with item and get a result
    parameter = element.get_Parameter(BuiltInParameter.ELEM_PARTITION_PARAM)
    
    parameter = workset.Id

    return element

# Cases

case0 = set_workset

def case1(elements, workset):
    result = [set_workset(element, workset) for element in elements]
    
    return result

def case2(elements, worksets):
    result = [set_workset(element, workset) for element, workset in zip(elements, worksets)]
    
    return result

switch = {
    (Element, Workset): case0,
    (List[object], Workset): case1,
    (List[object], List[object]): case2
    }

output = switch[(type(element), type(workset))](element, workset)

#Assign your output to the OUT variable.
OUT = output
# ----------------------------------------
element_2 = Output(python_script)  # "element"
