# Dynamo custom node ElementCurve.dyf (Dynamo 2.3.0.5885)
# category: Antler.Element.Query

element = Input(element: var[]..[])
python_script = Python(IN[0]=element)
# ---------- python_script.python (22 lines) ----------
import clr
clr.AddReference('ProtoGeometry')
from Autodesk.DesignScript.Geometry import *

clr.AddReference('RevitAPI')
from Autodesk.Revit.DB import *

clr.AddReference("RevitNodes")
import Revit
clr.ImportExtensions(Revit.Elements)
clr.ImportExtensions(Revit.GeometryConversion)

#The inputs to this node will be stored as a list in the IN variable.
item = UnwrapElement(IN[0])

a = item.Curve

#pt1 = a.Direction
dsCurve = Revit.GeometryConversion.RevitToProtoCurve.ToProtoType(a, False)

#Assign your output to the OUT variable
OUT = dsCurve
# ----------------------------------------
curve = Output(python_script)
