# Dynamo custom node ElementDirection.dyf (Dynamo 2.3.0.5885)
# category: tholth.Element.Query

element = Input(element: var[]..[])
python_script = Python(IN[0]=element)
# ---------- python_script.python (21 lines) ----------
import clr
clr.AddReference('ProtoGeometry')
from Autodesk.DesignScript.Geometry import *

clr.AddReference('RevitAPI')
from Autodesk.Revit.DB import *

clr.AddReference("RevitNodes")
import Revit
clr.ImportExtensions(Revit.Elements)
clr.ImportExtensions(Revit.GeometryConversion)

#The inputs to this node will be stored as a list in the IN variable.
item = UnwrapElement(IN[0])

a = item.Curve

pt1 = a.Direction

#Assign your output to the OUT variable
OUT = pt1
# ----------------------------------------
vector = Output(python_script)
