# Dynamo custom node ElementWorksetFilter.dyf (Dynamo 2.0.3.8810)
# category: tholth.Collector
# Element Workset Filter to use with Filtered Element Collector. Can be combined with other Filters.

workset = Input(workset: var[]..[])
inverted = Input(inverted: bool = false)
python_script = Python(IN[0]=workset, IN[1]=inverted)  # "Python Script - ElementWorksetFilter"
# ---------- python_script.python (33 lines) ----------
# Enable Python support and load DesignScript library
import clr

clr.AddReference('ProtoGeometry')
from Autodesk.DesignScript.Geometry import *

# Import RevitAPI
clr.AddReference("RevitAPI")
from Autodesk.Revit.DB import *

# Import ToDSType(bool) extension method
clr.AddReference("RevitNodes")
import Revit
clr.ImportExtensions(Revit.Elements)
clr.ImportExtensions(Revit.GeometryConversion)

#The inputs to this node will be stored as a list in the IN variables.
workset = IN[0]
inverted = IN[1]

def function(workset, inverted):
	# Depends if incoming workset is a "wrapped" type or Revit type
	try:
		filter = ElementWorksetFilter(WorksetId(workset.Id), inverted)	
	except:
		filter = ElementWorksetFilter(workset.Id, inverted)	
		
	return filter

output = function(UnwrapElement(workset), inverted)

#Assign your output to the OUT variable.
OUT = output
# ----------------------------------------
filter = Output(python_script)
