# Dynamo custom node Elements on Workset.dyf (Dynamo 2.3.0.5885)
# category: Antler.Collector
# Fetches all elements on given workset

workset = Input(workset: var[]..[])
python_script = Python(IN[0]=workset)
# ---------- python_script.python (43 lines) ----------
import clr

# Import RevitAPI
clr.AddReference("RevitAPI")
import Autodesk
from Autodesk.Revit.DB import *

# Import DocumentManager and TransactionManager
clr.AddReference("RevitServices")
import RevitServices
from RevitServices.Persistence import DocumentManager
from RevitServices.Transactions import TransactionManager


workset = UnwrapElement(IN[0])

doc = DocumentManager.Instance.CurrentDBDocument

# filter all elements that belong to the given workset
elementCollector = FilteredElementCollector(doc)
elementWorksetFilter = ElementWorksetFilter(workset.Id, False)
worksetElemsfounds = elementCollector.WherePasses(elementWorksetFilter).ToElements()

# how many elements were found?
elementsCount = worksetElemsfounds.Count
#message = "Element count : " + elementsCount

# Get name and/or Id of the elements that pass the given filter and show a few of them
count = 5  # show info for 5 elements only

"""
for ele in worksetElemsfounds:
    if ele != None:
        message += "\nElementId : " + ele.Id
		message += ", Element Name : " + ele.Name
    if (count == 0):
    break
"""

OUT = worksetElemsfounds


#Autodesk.Revit.UI.TaskDialog.Show("ElementsOfWorkset", message)
# ----------------------------------------
elements = Output(python_script)
