# Dynamo custom node ExpandPointGrid.dyf (Dynamo 2.0.3.8810)
# category: antler.Points
# Expands 2d grid of points by add points to start and end, in both X and Y direction.

point_grid = Input(point_grid: var[]..[])
n = Input(n: var[]..[])
delta_x = Input(delta_x: var[]..[])
delta_y = Input(delta_y: var[]..[])
python_script = Python(IN[0]=point_grid, IN[1]=n, IN[2]=delta_x, IN[3]=delta_y)
# ---------- python_script.python (44 lines) ----------
# Enable Python support and load DesignScript library
import clr
clr.AddReference('ProtoGeometry')
from Autodesk.DesignScript.Geometry import *

# The inputs to this node will be stored as a list in the IN variables.
grid = IN[0]
n = IN[1] # Number of times to expand grid
dx = IN[2] # Delta X, distance to expand grid in X direction.
dy = IN[3] # Delta Y, distance to expand grid in Y direction.

# Place your code below this line
def expand_2dgrid(grid, dx, dy):
	assert dx > 0 and dy > 0
	
	grid.insert(0, 
		[Point.ByCoordinates(pt.X-dx, pt.Y, pt.Z) for pt in grid[0]]
		)
	
	grid.insert(len(grid),
		[Point.ByCoordinates(pt.X+dx, pt.Y, pt.Z) for pt in grid[-1]]
		)
	
	# zip(*grid) transposes the grid
	grid = zip(*grid)

	grid.insert(0, 
		[Point.ByCoordinates(pt.X, pt.Y-dy, pt.Z) for pt in grid[0]]
		)
	
	grid.insert(len(grid),
		[Point.ByCoordinates(pt.X, pt.Y+dy, pt.Z) for pt in grid[-1]]
		)
	
	# Transpose back...
	grid = zip(*grid)
	
	return grid

for _ in range(n):
	grid = expand_2dgrid(grid, dx, dy)

# Assign your output to the OUT variable.
OUT = grid
# ----------------------------------------
point_grid_2 = Output(python_script)  # "point_grid"
