# Dynamo custom node FacingFlipped.dyf (Dynamo 2.3.0.5885)
# category: antler.FamilyInstance
# True if FamilyInstance is facing flipped.

family_instance = Input(family_instance: var[]..[])
facingFlipped = Python(IN[0]=family_instance)  # "FamilyInstance.FacingFlipped"
# ---------- facingFlipped.python (12 lines) ----------
#The inputs to this node will be stored as a list in the IN variables.
doors = IN[0]

if isinstance(doors, list):
	doors = UnwrapElement(doors)
else:
	doors = UnwrapElement([doors])

flip_facing= [a.FacingFlipped for a in doors]  

#Assign your output to the OUT variable.
OUT = flip_facing
# ----------------------------------------
bool = Output(facingFlipped)
