# Dynamo custom node FamilyInstance.Change Type.dyf "Change Type" (Dynamo 2.0.3.8810)
# category: Antler.FamilyInstance.Action

family_instances = Input(family_instances: var[]..[])
family_type = Input(family_type: var[]..[])
python_script = Python(IN[0]=family_instances, IN[1]=family_type)
# ---------- python_script.python (57 lines) ----------
# Enable Python support and load DesignScript library
import clr

# Import RevitAPI
clr.AddReference("RevitAPI")
from Autodesk.Revit import DB

# Import DocumentManager and TransactionManager
clr.AddReference ("RevitServices")
import RevitServices
from RevitServices.Persistence import DocumentManager
from RevitServices.Transactions import TransactionManager

# Import List
from System.Collections.Generic import List

doc = DocumentManager.Instance.CurrentDBDocument
uiapp = DocumentManager.Instance.CurrentUIApplication
app = uiapp.Application

#The inputs to this node will be stored as a list in the IN variable.
input_a = UnwrapElement(IN[0])
input_b = UnwrapElement(IN[1])

def function(fam_inst, fam_symbol):
	fam_inst.ChangeTypeId(fam_symbol.Id)
	return fam_inst

output = None

# Cases
case0 = function

def case1(fam_instance, fam_symbols):
	return [function(fam_instance, fam_symbol) for fam_symbol in fam_symbols]
	
def case2(fam_instances, fam_symbols):
	return [function(fam_instance, fam_symbol) for fam_instance, fam_symbol in zip(fam_instances, fam_symbols)]
	
switch = {
	(DB.FamilyInstance, DB.FamilySymbol): 		  case0,
	(List[object], DB.FamilySymbol): 	case1,
	(List[object], List[object]): 		case2,
	}


# Start Transaction
TransactionManager.Instance.EnsureInTransaction(doc)

# Transaction
output = switch[(type(input_a), type(input_b))](input_a , input_b)
	
# End Transaction
TransactionManager.Instance.TransactionTaskDone()

#Assign your output to the OUT variable.
OUT = output
# ----------------------------------------
family_instances_2 = Output(python_script)  # "family_instances"
