# Dynamo custom node FamilyInstance.Flipped.dyf (Dynamo 2.3.0.5885)
# category: Antler.FamilyInstance
# Returns True if familyinstance is flipped from direction in family editor

family_instance = Input(family_instance: var[]..[])

# group: Bestemme slagretning
handFlipped = Python(IN[0]=family_instance)  # "FamilyInstance.HandFlipped"
# ---------- handFlipped.python (12 lines) ----------
#The inputs to this node will be stored as a list in the IN variables.
doors = IN[0]

if isinstance(doors, list):
	doors = UnwrapElement(doors)
else:
	doors = UnwrapElement([doors])

flip_hand= [a.HandFlipped for a in doors]  

#Assign your output to the OUT variable.
OUT = flip_hand
# ----------------------------------------
facingFlipped = Python(IN[0]=family_instance)  # "FamilyInstance.FacingFlipped"
# ---------- facingFlipped.python (12 lines) ----------
#The inputs to this node will be stored as a list in the IN variables.
doors = IN[0]

if isinstance(doors, list):
	doors = UnwrapElement(doors)
else:
	doors = UnwrapElement([doors])

flip_facing= [a.FacingFlipped for a in doors]  

#Assign your output to the OUT variable.
OUT = flip_facing
# ----------------------------------------

hand_flipped = Output(handFlipped)
facing_flipped = Output(facingFlipped)
