# Dynamo custom node FamilyInstance.FromRoom.dyf "FromRoom" (Dynamo 2.3.0.5885)
# category: Antler.FamilyInstance

family_instance = Input(family_instance: var[]..[])
phase = Input(phase: var[]..[])
fromRoom = Python(IN[0]=family_instance, IN[1]=phase)  # "FamilyInstance.FromRoom"
# ---------- fromRoom.python (35 lines) ----------
import clr
clr.AddReference('ProtoGeometry')
from Autodesk.DesignScript.Geometry import *

# Import DocumentManager and TransactionManager
clr.AddReference( "RevitServices")
import RevitServices
from RevitServices.Persistence import DocumentManager
from RevitServices.Transactions import TransactionManager

# Import ToDSType(bool) extension method
clr.AddReference( "RevitNodes")
import Revit
clr.ImportExtensions(Revit.Elements)

#The inputs to this node will be stored as a list in the IN variables.
doors = IN[0]
phase = UnwrapElement(IN[1])


if isinstance(doors, list):
	doors = UnwrapElement(doors)
else:
	doors = UnwrapElement([doors])

output = []

for door in doors:
	try:
		output.append(door.FromRoom[phase])
	except:
		output.append(None)

#Assign your output to the OUT variable.
OUT = output
# ----------------------------------------
room = Output(fromRoom)
