# Dynamo custom node FamilyInstance.Host.dyf (Dynamo 2.0.3.8810)
# category: tholth
# Gets Host, Host Face and Host Parameter for a Family Instance

element = Input(element: var[]..[])
python_script = Python(IN[0]=element)
# ---------- python_script.python (41 lines) ----------
# Enable Python support and load DesignScript library
import clr

clr.AddReference('ProtoGeometry')
from Autodesk.DesignScript.Geometry import *

# Import RevitAPI
clr.AddReference("RevitAPI")
from Autodesk.Revit.DB import *

# Import DocumentManager and TransactionManager
clr.AddReference("RevitServices")
import RevitServices
from RevitServices.Persistence import DocumentManager
from RevitServices.Transactions import TransactionManager

# Import ToDSType(bool) extension method
clr.AddReference("RevitNodes")
import Revit
clr.ImportExtensions(Revit.Elements)
clr.ImportExtensions(Revit.GeometryConversion)

#The inputs to this node will be stored as a list in the IN variables.
element = IN[0]

doc = DocumentManager.Instance.CurrentDBDocument
uiapp = DocumentManager.Instance.CurrentUIApplication
app = uiapp.Application

def function(element):
	# Do something with item and get a result
	host = element.Host
	host_face = element.HostFace
	host_parameter = element.HostParameter

	return host, host_face, host_parameter

output = function(UnwrapElement(element))

#Assign your output to the OUT variable.
OUT = output
# ----------------------------------------
code_block = CodeBlock(t=python_script) { t[0]; t[1]; t[2]; }
host = Output(code_block.out0)
face = Output(code_block.out1)
parameter = Output(code_block.out2)
