# Dynamo custom node FamilyInstance.SymbolGeometry.dyf (Dynamo 2.0.3.8810)
# category: Antler.FamilyInstance
# Gets symbol geometry as solid and faces with materials

family_instance = Input(family_instance: var[]..[])
symbol_geomtry = Python(IN[0]=family_instance)
# ---------- symbol_geomtry.python (119 lines) ----------
import clr

clr.AddReference('ProtoGeometry')
from Autodesk.DesignScript.Geometry import *

# Import RevitAPI
clr.AddReference("RevitAPI")
import Autodesk
from Autodesk.Revit.DB import *

# Import DocumentManager and TransactionManager
clr.AddReference("RevitServices")
import RevitServices
from RevitServices.Persistence import DocumentManager
from RevitServices.Transactions import TransactionManager

# Import ToDSType(bool) extension method
clr.AddReference("RevitNodes")
import Revit
clr.ImportExtensions(Revit.Elements)
clr.ImportExtensions(Revit.GeometryConversion)

# Import Revit UI
clr.AddReference('RevitAPIUI')
from Autodesk.Revit.UI import *
#from Autodesk.Revit.UI.Selection import *

from Autodesk.DesignScript.Geometry import *

#The inputs to this node will be stored as a list in the IN variables.
input = IN[0]

doc = DocumentManager.Instance.CurrentDBDocument
uiapp = DocumentManager.Instance.CurrentUIApplication
app = uiapp.Application

options = Options()

def function(x):
	if x is None:
		return [], [], None
	materials = []
	geometries = []
	transforms = []
	#type_name = type(x)
	geometry = x.get_Geometry(options)
	transform = x.GetTransform()
	#geometry = x.Geometry
	#i_geo = geometry.GetInstanceGeometry() 
	for element in geometry:
		#materials.append(dir(element))
		#t = type(element)
		#empty_transform = Transform
		symbol_geometry = element.GetSymbolGeometry()
		#transform = element.Get
		#symb_geo = element.GetSymbolGeometry()
		converted_geometry = [a.Convert() for a in symbol_geometry]
		
		for geo, converted in zip(symbol_geometry, converted_geometry):
			geometry_transform = []
			
			if isinstance(geo, Autodesk.Revit.DB.Solid) and converted:
				face_materials = []
				
				for face in geo.Faces:
					material_id = face.MaterialElementId

					face_materials.append(doc.GetElement(material_id))
					
				face_materials = list(set(face_materials))
				
				#if len(face_materials) == 1:
				#	face_materials = face_materials[0]
				materials.append(face_materials[0])
			#t = geo.Transform
				#geometry_transform.append(converted.Transform)
				
			#materials.append(i.MaterialElement)
		
		#transforms.append(converted_geometry.Transform)
		
		converted_geometry = [a for a in converted_geometry if a is not None]
		
		#transform = element.Transform
		
		coordinate_system = transform2coordinatesystem(transform)

		
	return converted_geometry, materials, coordinate_system

def transform2coordinatesystem(transform):
	origin = transform.Origin
	origin_pt = Autodesk.DesignScript.Geometry.Point.ByCoordinates(origin.X, origin.Y, origin.Z)
	
	basisX = transform.BasisX
	vectorX = Vector.ByCoordinates(basisX.X,basisX.Y,basisX.Z)
	
	basisY = transform.BasisY
	vectorY = Vector.ByCoordinates(basisY.X,basisY.Y,basisY.Z)	
	
	basisZ = transform.BasisZ
	vectorZ = Vector.ByCoordinates(basisZ.X,basisZ.Y,basisZ.Z)		
	
	coordinate_system = CoordinateSystem.ByOriginVectors(origin_pt, vectorX, vectorY, vectorZ)
	
	return coordinate_system

output = None

if isinstance(input, list):
    output = [function(a) for a in UnwrapElement(input)]
elif input is None:
	output = None
else:
    output = function(UnwrapElement(input))


#Assign your output to the OUT variable.
OUT = output
# ----------------------------------------
transpose = List.Transpose(lists=symbol_geomtry)
code_block = CodeBlock(a=transpose) { a[0]; a[1]; a[2]; }
solids = Output(code_block.out0)
materials = Output(code_block.out1)
coordinate_systems = Output(code_block.out2)
