# Dynamo custom node Filter.Element Phase Filter.dyf "Phase Filter" (Dynamo 2.0.2.6826)
# category: Antler.Filter
# Filters in all elements new or existing in given phase.

elements = Input(elements: var[]..[])
code_block = CodeBlock(a=elements) { a; }
phase = Input(phase: var[]..[])
getPhaseStatus = Python(IN[0]=code_block, IN[1]=phase)
# ---------- getPhaseStatus.python (38 lines) ----------
import clr
clr.AddReference('ProtoGeometry')
from Autodesk.DesignScript.Geometry import *

# Import DocumentManager and TransactionManager
clr.AddReference( "RevitServices")
import RevitServices
from RevitServices.Persistence import DocumentManager
from RevitServices.Transactions import TransactionManager

# Import ToDSType(bool) extension method
clr.AddReference( "RevitNodes")
import Revit
clr.ImportExtensions(Revit.Elements)

#The inputs to this node will be stored as a list in the IN variables.
elements = IN[0]
phase = UnwrapElement(IN[1])


if isinstance(elements, list):
	elements = UnwrapElement(elements)
else:
	elements = UnwrapElement([elements])
	
def exists_in_phase(element):
	pass

output = []

for element in elements:
	try:
		output.append(element.GetPhaseStatus(phase.Id))
	except:
		output.append(None)

#Assign your output to the OUT variable.
OUT = output
# ----------------------------------------
string_from_object = FromObject(obj=getPhaseStatus)
code_block_2 = CodeBlock { ["Existing", "New"]; }
eq = string_from_object@L1 == code_block_2  # lacing=CrossProduct
any = Python(IN[0]=eq)
# ---------- any.python (1 lines) ----------
OUT = [any(a) for a in IN[0]]
# ----------------------------------------
filterByBoolMask = List.FilterByBoolMask(list=code_block, mask=any)
in_ = Output(filterByBoolMask.in)  # "in"
out = Output(filterByBoolMask.out)
