# Dynamo custom node Filter.ElementLevelFilter.dyf "ElementLevelFilter" (Dynamo 2.0.3.8810)
# category: Antler.Collector
# Element Level Filter to use with Filtered Element Collector. Can be combined with other filters.

level = Input(level: var[]..[])
inverted = Input(inverted: bool = false)
python_script_elementlevelfilter = Python(IN[0]=level, IN[1]=inverted)
# ---------- python_script_elementlevelfilter.python (30 lines) ----------
# Enable Python support and load DesignScript library
import clr

clr.AddReference('ProtoGeometry')
from Autodesk.DesignScript.Geometry import *

# Import RevitAPI
clr.AddReference("RevitAPI")
from Autodesk.Revit.DB import *

# Import ToDSType(bool) extension method
clr.AddReference("RevitNodes")
import Revit
clr.ImportExtensions(Revit.Elements)
clr.ImportExtensions(Revit.GeometryConversion)

#The inputs to this node will be stored as a list in the IN variables.
level = IN[0]
inverted = IN[1]

def function(level, inverted):
	# Do something with item and get a result
	filter = ElementLevelFilter(level.Id, inverted)	

	return filter

output = function(UnwrapElement(level), inverted)

#Assign your output to the OUT variable.
OUT = output
# ----------------------------------------
filter = Output(python_script_elementlevelfilter)
