# Dynamo custom node Filter.FilterByType.dyf "FilterByType" (Dynamo 2.3.0.5885)
# category: Antler.Util
# Filters in and out types given a string with type name. Example: "Floors" for all floors, or "int" for all integers.

list = Input(list: var[]..[])
type = Custom[Object.Type](list)
type_string = Input(type_string: var[]..[])
isRegularExpression = Custom[IsRegularExpression](type, RegEx=type_string)  # Test string for regular expression match
filterByBoolMask = List.FilterByBoolMask(list=list, mask=isRegularExpression)
in_ = Output(filterByBoolMask.in)  # "in"
out = Output(filterByBoolMask.out)
