# Dynamo custom node Forms.DataGridView.dyf (Dynamo 2.0.2.6826)
# category: tholth
# Shows list of lists as a grid view in a window.

headers = Input(headers: var[]..[])
data = Input(data: var[]..[])
python_script = Python(IN[0]=headers, IN[1]=data)
# ---------- python_script.python (74 lines) ----------
import clr
clr.AddReference('System.Windows.Forms')
clr.AddReference('System.Drawing')
clr.AddReference('System.Data')

from System.Windows.Forms import (
    Form, Panel, Label,
    TextBox, DockStyle, Button,
    ScrollBars, Application, DataGridView,
    DataGridViewColumnHeadersHeightSizeMode,
    MessageBox, MessageBoxButtons,
    MessageBoxIcon, DataGridViewAutoSizeColumnsMode
)

from System.Drawing import (
    Point, Size,
    Font, FontStyle,
    GraphicsUnit
)

class DataGridViewForm(Form):
    """
    """
    def __init__(self):
        # Window settings
        self.Text = 'Grid view'
        self.ClientSize = Size(642, 255)
        self.MinimumSize = Size(500, 200)
        self.DefaultFont = Font('Lucida Console', 10)
        self.ShowIcon = False

        self.setupDataGridView()

    def setupDataGridView(self):
        self.dgv = DataGridView()
        self.dgv.Font = self.DefaultFont
        self.dgv.AllowUserToOrderColumns = True
        self.dgv.ColumnHeadersHeightSizeMode = DataGridViewColumnHeadersHeightSizeMode.AutoSize
        self.dgv.Dock = DockStyle.Fill
        # self.dgv.Location = Point(0, 0)
        self.dgv.Size = Size(640, 480)
        # self.dgv.TabIndex = 3

        self.Controls.Add(self.dgv)

    def populate_grid_view(self, data, headers=[]):
        self.dgv.ColumnCount = len(data[0])

        # Add headers
        if headers:
            for i, header in enumerate(headers):
                self.dgv.Columns[i].Name = str(header)

        # Add rows
        for row in data:
            if isinstance(row, basestring):
                self.dgv.Rows.Add(row)
            else:
                self.dgv.Rows.Add(*row)

        # Resize Columns
        #self.dgv.AutoResizeColumns(DataGridViewAutoSizeColumnsMode.AllCells)

def check_grid_data(grid_data):
    pass

headers = IN[0]
data = IN[1]

if data:
	form = DataGridViewForm()
	form.populate_grid_view(data, headers=headers)
	
	Application.Run(form)
# ----------------------------------------
data_2 = Output(python_script)  # "data"
