# Dynamo custom node GetCurtainCells.dyf (Dynamo 2.0.3.8810)
# category: Antler.CurtainGrid
# Gets the CurtainCells owned by this curtain grid.

IN_0 = Input(IN[0]: var[]..[])
python_script = Python(IN[0]=IN_0)
# ---------- python_script.python (21 lines) ----------
# Enable Python support and load DesignScript library
import clr

# Import RevitAPI
clr.AddReference("RevitAPI")
from Autodesk.Revit import DB

#The inputs to this node will be stored as a list in the IN variable.
elements = IN[0]

def function(element):
	if isinstance(element, (list, tuple)):
		return [function(e) for e in element]
	else:
		# Code follows here:
		element = UnwrapElement(element)
		
		
		return element.GetCurtainCells()

OUT = function(elements)
# ----------------------------------------
OUT = Output(python_script)
