# Dynamo custom node GetType.dyf (Dynamo 2.3.0.5885)
# category: tholth.Element.Query

object = Input(object: var[]..[])
python_script = Python(IN[0]=object)
# ---------- python_script.python (25 lines) ----------
import clr
clr.AddReference('ProtoGeometry')
from Autodesk.DesignScript.Geometry import *

# Import DocumentManager
clr.AddReference( "RevitServices")
import RevitServices
from RevitServices.Persistence import DocumentManager

# Import RevitAPI
clr.AddReference("RevitAPI")
import Autodesk
from Autodesk.Revit.DB import *

#The inputs to this node will be stored as a list in the IN variables.
input = IN[0]

doc = DocumentManager.Instance.CurrentDBDocument
uiapp = DocumentManager.Instance.CurrentUIApplication
app = uiapp.Application

output = [a.GetType() for a in input]

#Assign your output to the OUT variable.
OUT = output
# ----------------------------------------
type = Output(python_script)
