# Dynamo custom node Grid.GridAngleToY.dyf "GridAngleToY" (Dynamo 2.3.0.5885)
# category: Antler.Grid

grid = Input(grid: var[]..[])
curve = Grid.Curve(grid=grid)
direction = Line.Direction(line=curve)
YAxis = Vector.YAxis()
custom = Custom[](a=direction, b=YAxis)  # Angle between two vectors on the XY-plane
angle = Output(custom)
