# Dynamo custom node Group.GroupType.dyf (Dynamo 2.3.0.5885)
# category: tholth.Group

group = Input(group: var[]..[])
python_script = Python(IN[0]=group)
# ---------- python_script.python (25 lines) ----------
import clr

# Import RevitAPI
clr.AddReference("RevitAPI")
import Autodesk
from Autodesk.Revit.DB import *

# Import DocumentManager and TransactionManager
clr.AddReference("RevitServices")
import RevitServices
from RevitServices.Persistence import DocumentManager
from RevitServices.Transactions import TransactionManager

# Import ToDSType(bool) extension method
clr.AddReference("RevitNodes")
import Revit
clr.ImportExtensions(Revit.Elements)
clr.ImportExtensions(Revit.GeometryConversion)

#The input to this node will be stored in the IN[0] variable.
input = UnwrapElement(IN[0])

output = [a.GroupType for a in input]
#Assign your output to the OUT variable
OUT = output
# ----------------------------------------
group_type = Output(python_script)
