# Dynamo custom node HandFlipped.dyf (Dynamo 2.3.0.5885)
# category: Antler.FamilyInstance
# True if FamilyInstance is flipped in hand direction.

family_instance = Input(family_instance: var[]..[])
handFlipped = Python(IN[0]=family_instance)  # "FamilyInstance.HandFlipped"
# ---------- handFlipped.python (12 lines) ----------
#The inputs to this node will be stored as a list in the IN variables.
doors = IN[0]

if isinstance(doors, list):
	doors = UnwrapElement(doors)
else:
	doors = UnwrapElement([doors])

flip_hand= [a.HandFlipped for a in doors]  

#Assign your output to the OUT variable.
OUT = flip_hand
# ----------------------------------------
bool = Output(handFlipped)
