# Dynamo custom node IndicesOfSortedList.dyf (Dynamo 2.3.0.5885)
# category: tholth.List.Sort

list = Input(list: var[]..[])
python_script = Python(IN[0]=list)
# ---------- python_script.python (22 lines) ----------
import clr
clr.AddReference('ProtoGeometry')
from Autodesk.DesignScript.Geometry import *

# Import RevitAPI
clr.AddReference("RevitAPI")
import Autodesk
from Autodesk.Revit.DB import *

#The inputs to this node will be stored as a list in the IN variable.
input = IN[0]

#input = str(input)
converted = [a.IntegerValue if type(a) == ElementId else a for a in input]

if isinstance(converted[0],str):
	output = [input.index(a) for a in sorted(converted, key=str.lower)]
elif isinstance(converted[0],float) or isinstance(converted[0],int):
	output = [converted.index(a) for a in sorted(converted)]

#Assign your output to the OUT variable
OUT = output
# ----------------------------------------
indices = Output(python_script)
