# Dynamo custom node Is.dyf (Dynamo 2.0.2.6826)
# category: tholth.Boolean
# True if input is something

data = Input(data: var[]..[])
python_script = Python(IN[0]=data)
# ---------- python_script.python (1 lines) ----------
OUT = bool(IN[0])
# ----------------------------------------
bool = Output(python_script)
