# Dynamo custom node IsAlmostParallel.dyf (Dynamo 2.3.0.5885)
# category: tholth.Vector
# Returns true if angle between two vectors is within tolerance

a = Input(a: var[]..[])
a_2 = Input(a: var[]..[])
tolerance = Input(tolerance: var[]..[])
python_script = Python(IN[0]=a, IN[1]=a_2, IN[2]=tolerance)
# ---------- python_script.python (24 lines) ----------
import clr
clr.AddReference('ProtoGeometry')
from Autodesk.DesignScript.Geometry import *

clr.AddReference("RevitNodes")
import Revit

# Import ToProtoType, ToRevitType geometry conversion extension methods
clr.ImportExtensions(Revit.GeometryConversion)

#The inputs to this node will be stored as a list in the IN variable.
vec0 = IN[0].ToXyz()
vec1 = IN[1].ToXyz()
tolerance = IN[2]

result = False

if vec0.AngleTo(vec1) <= tolerance or vec0.AngleTo(vec1.Negate()) <= tolerance:
	result = True
else:
	result = False

#Assign your output to the OUT variable
OUT = result
# ----------------------------------------
boolean = Output(python_script)
