# Dynamo custom node IsEqual.dyf (Dynamo 2.3.0.5885)
# category: Antler.Boolean

a = Input(a: var[]..[])
b = Input(b: var[]..[])
python_script = Python(IN[0]=a, IN[1]=b)
# ---------- python_script.python (16 lines) ----------
import clr
clr.AddReference('ProtoGeometry')
from Autodesk.DesignScript.Geometry import *
#The inputs to this node will be stored as a list in the IN variable.
a = IN[0]
b = IN[1]

result = False

if a == b:
	result = True
else:
	result = False

#Assign your output to the OUT variable
OUT = result
# ----------------------------------------
bool = Output(python_script)
