# Dynamo custom node IsRegularExpression.dyf (Dynamo 2.3.0.5885)
# category: tholth.String
# Test string for regular expression match

t = Input(t: var[]..[])
regex = Input(regex: var[]..[])
python_script = Python(IN[0]=t, IN[1]=regex)
# ---------- python_script.python (22 lines) ----------
import clr
clr.AddReference('ProtoGeometry')
from Autodesk.DesignScript.Geometry import *

import re

#The inputs to this node will be stored as a list in the IN variable.
input = IN[0]
regexStr = IN[1]

regexFunc = re.compile(regexStr)

output = None

if type(input) == list:
	output = [bool(re.search(regexFunc, a)) for a in input]
else:
	output = bool(re.search(regexFunc, input))


#Assign your output to the OUT variable
OUT = output
# ----------------------------------------
Bool = Output(python_script)
