# Dynamo custom node Levels.dyf (Dynamo 2.0.2.6826)
# category: Antler.Collector
# Gets all Levels in project

levels = Python()  # "Collector.Levels"; graph input
# ---------- levels.python (24 lines) ----------
import clr
clr.AddReference('ProtoGeometry')
from Autodesk.DesignScript.Geometry import *

# Import RevitAPI
clr.AddReference("RevitAPI")
import Autodesk
from Autodesk.Revit.DB import *

# Import DocumentManager and TransactionManager
clr.AddReference("RevitServices")
import RevitServices
from RevitServices.Persistence import DocumentManager

#The inputs to this node will be stored as a list in the IN variable.
dataEnteringNode = IN

doc = DocumentManager.Instance.CurrentDBDocument

collector = FilteredElementCollector(doc)
designOptions = collector.OfClass(Level).ToElements()

#Assign your output to the OUT variable
OUT = designOptions
# ----------------------------------------
level = Output(levels)
