# Dynamo custom node List.CountOccurences.dyf "CountOccurences" (Dynamo 2.0.3.8810)
# category: Antler.List
# Count occurences of item in list

list = Input(list: var[]..[])
keys = Input(keys: var[]..[])
python_script = Python(IN[0]=list, IN[1]=keys)
# ---------- python_script.python (19 lines) ----------
# Enable Python support and load DesignScript library
import clr
clr.AddReference('ProtoGeometry')
from Autodesk.DesignScript.Geometry import *

# The inputs to this node will be stored as a list in the IN variables.
items = IN[0]
keys = IN[1]

# Place your code below this line
count_dict = {k: 0 for k in keys}

for item in items:
	if item in count_dict.keys():
		count_dict[item] += 1


# Assign your output to the OUT variable.
OUT = [count_dict[k] for k in keys]
# ----------------------------------------
count = Output(python_script)
