# Dynamo custom node LocationPointAndRotation.dyf (Dynamo 2.3.0.5885)
# category: antler.FamilyInstance
# Gets location point and rotation of a family instance or an element.

element = Input(element: var[]..[])
python_script = Python(IN[0]=element)
# ---------- python_script.python (20 lines) ----------
# Enable Python support and load DesignScript library
import clr

# Import RevitAPI
clr.AddReference("RevitAPI")
from Autodesk.Revit import DB

#The inputs to this node will be stored as a list in the IN variable.
elements = IN[0]

def function(element):
	if isinstance(element, (list, tuple)):
		return [function(e) for e in element]
	else:
		# Code follows here:
		element = UnwrapElement(element)
		
		return element.Location

OUT = function(elements)
# ----------------------------------------
python_script_2 = Python(IN[0]=python_script)
# ---------- python_script_2.python (31 lines) ----------
# Enable Python support and load DesignScript library
import clr

# Import RevitAPI
clr.AddReference("RevitAPI")
from Autodesk.Revit import DB

# For working with DesignScript abstract geometry
clr.AddReference('ProtoGeometry')
from Autodesk.DesignScript.Geometry import *

# Import ToDSType(bool) extension method
clr.AddReference("RevitNodes")
import Revit
clr.ImportExtensions(Revit.Elements)
clr.ImportExtensions(Revit.GeometryConversion)	

#The inputs to this node will be stored as a list in the IN variable.
elements = IN[0]

def function(element):
	if isinstance(element, (list, tuple)):
		return [function(e) for e in element]
	else:
		# Code follows here:
		element = UnwrapElement(element)
		
		return element.Point.ToPoint(), element.Rotation
		
		
OUT = function(elements)
# ----------------------------------------
code_block = CodeBlock { 0; }
getItemAtIndex = List.GetItemAtIndex(list=python_script_2@L2, index=code_block)
point = Output(getItemAtIndex)  # Location point in internal coordinates.
code_block_2 = CodeBlock { 1; }
getItemAtIndex_2 = List.GetItemAtIndex(list=python_script_2@L2, index=code_block_2)
rotation = Output(getItemAtIndex_2)  # Location rotation in degrees.
