# Dynamo custom node Main Model Filter.dyf (Dynamo 2.0.2.6826)
# category: tholth.Filter
# Filters in only elements in main model

elements = Input(elements: var[]..[])

# group: Main Model Design Option Filter
code_block = CodeBlock(elements=elements) { elements; }
designOption = Python(IN[0]=code_block)  # "Element.DesignOption"
# ---------- designOption.python (45 lines) ----------
# Enable Python support and load DesignScript library
import clr

clr.AddReference('ProtoGeometry')
from Autodesk.DesignScript.Geometry import *

# Import RevitAPI
clr.AddReference("RevitAPI")
from Autodesk.Revit.DB import *

# Import DocumentManager and TransactionManager
clr.AddReference("RevitServices")
import RevitServices
from RevitServices.Persistence import DocumentManager
from RevitServices.Transactions import TransactionManager

# Import ToDSType(bool) extension method
clr.AddReference("RevitNodes")
import Revit
clr.ImportExtensions(Revit.Elements)
clr.ImportExtensions(Revit.GeometryConversion)

#The inputs to this node will be stored as a list in the IN variables.
input = IN[0]

doc = DocumentManager.Instance.CurrentDBDocument
uiapp = DocumentManager.Instance.CurrentUIApplication
app = uiapp.Application

def function(item):
	# Do something with item and get a result
	result = item.DesignOption	

	return result

output = None

# To handle single items or lists..
if isinstance(input, list):
	output = [function(a) for a in UnwrapElement(input)]
else:
	output = function(UnwrapElement(input))

#Assign your output to the OUT variable.
OUT = output
# ----------------------------------------
isNull = Object.IsNull(obj=designOption)

python_script = Python(IN[0]=designOption)
# ---------- python_script.python (31 lines) ----------
# Enable Python support and load DesignScript library
import clr

# Import RevitAPI
clr.AddReference("RevitAPI")
from Autodesk.Revit.DB import *

#The inputs to this node will be stored as a list in the IN variables.
items = IN[0]

def to_list(item):
	if isinstance(item, list):
		return item
	else:
		return [item]

def function(item):
	# Do something with item and get a result
	if item:
		return item.IsPrimary
	else:
		return None

output = None

items = to_list(items)

output = [function(item) for item in UnwrapElement(items)]

#Assign your output to the OUT variable.
OUT = output
# ----------------------------------------
code_block_2 = CodeBlock(a=python_script) { a == null ? false : a; }
code_block_3 = CodeBlock(a=isNull, b=code_block_2) { a || b; }

# group (continued): Main Model Design Option Filter
filterByBoolMask = List.FilterByBoolMask(list=code_block, mask=code_block_3)

in_ = Output(filterByBoolMask.in)  # "in"
out = Output(filterByBoolMask.out)
watch = Watch(code_block_3)
