# Dynamo custom node Material.Properties.dyf (Dynamo 2.3.0.5885)
# category: Antler.Material

material = Input(material: var[]..[])
python_script = Python(IN[0]=material)
# ---------- python_script.python (69 lines) ----------
import clr

clr.AddReference('ProtoGeometry')
from Autodesk.DesignScript.Geometry import *

# Import RevitAPI
clr.AddReference("RevitAPI")
import Autodesk
from Autodesk.Revit.DB import *

# Import DocumentManager and TransactionManager
clr.AddReference("RevitServices")
import RevitServices
from RevitServices.Persistence import DocumentManager
from RevitServices.Transactions import TransactionManager

# Import ToDSType(bool) extension method
clr.AddReference("RevitNodes")
import Revit
clr.ImportExtensions(Revit.Elements)
clr.ImportExtensions(Revit.GeometryConversion)

# Import Revit UI
clr.AddReference('RevitAPIUI')
from Autodesk.Revit.UI import *
#from Autodesk.Revit.UI.Selection import *

from Autodesk.DesignScript import *

# Import Designscript Core
clr.AddReference("DSCoreNodes")
import DSCore

#The inputs to this node will be stored as a list in the IN variables.
input = IN[0]

doc = DocumentManager.Instance.CurrentDBDocument
uiapp = DocumentManager.Instance.CurrentUIApplication
app = uiapp.Application

options = Options()

def function(material):
	color = material.Color
	#category = material.MaterialCategory
	#mclass = material.MaterialClass
	shininess = material.Shininess
	smoothness = material.Smoothness
	transparency = material.Transparency
	
	return convert_to_DScolor(color), shininess, smoothness, transparency

def convert_to_DScolor(Rcolor):
	R = Rcolor.Red
	G = Rcolor.Green
	B = Rcolor.Blue
	DSColor = DSCore.Color.ByARGB(1,R,G,B);
	return DSColor

output = None

if isinstance(input, list):
    output = [function(a) for a in UnwrapElement(input)]
else:
    output = function(UnwrapElement(input))


#Assign your output to the OUT variable.
OUT = output
# ----------------------------------------
code_block = CodeBlock(a=python_script) { a[0]; a[1]; a[2]; a[3]; }
color = Output(code_block.out0)
shininess = Output(code_block.out1)
smoothness = Output(code_block.out1)
transparency = Output(code_block.out1)
