# Dynamo custom node Material.Transparency.dyf (Dynamo 2.3.0.5885)
# category: tholth.Material

material = Input(material: var[]..[])
python_script = Python(IN[0]=material)
# ---------- python_script.python (59 lines) ----------
import clr

clr.AddReference('ProtoGeometry')
from Autodesk.DesignScript.Geometry import *

# Import RevitAPI
clr.AddReference("RevitAPI")
import Autodesk
from Autodesk.Revit.DB import *

# Import DocumentManager and TransactionManager
clr.AddReference("RevitServices")
import RevitServices
from RevitServices.Persistence import DocumentManager
from RevitServices.Transactions import TransactionManager

# Import ToDSType(bool) extension method
clr.AddReference("RevitNodes")
import Revit
clr.ImportExtensions(Revit.Elements)
clr.ImportExtensions(Revit.GeometryConversion)

# Import Revit UI
clr.AddReference('RevitAPIUI')
from Autodesk.Revit.UI import *
#from Autodesk.Revit.UI.Selection import *

from Autodesk.DesignScript.Geometry import *

#The inputs to this node will be stored as a list in the IN variables.
input = IN[0]

doc = DocumentManager.Instance.CurrentDBDocument
uiapp = DocumentManager.Instance.CurrentUIApplication
app = uiapp.Application

options = Options()

def function(material):
	#color = material.Color
	#category = material.MaterialCategory
	#mclass = material.MaterialClass
	#shininess = material.Shininess
	#smoothness = material.Smoothness
	transparency = material.Transparency
	
	return transparency


output = None

if isinstance(input, list):
    output = [function(a) for a in UnwrapElement(input)]
else:
    output = function(UnwrapElement(input))


#Assign your output to the OUT variable.
OUT = output
# ----------------------------------------
transparency = Output(python_script)
