# Dynamo custom node MessageBox.dyf (Dynamo 2.0.2.6826)
# category: tholth.UI
# Displays a simple Message Box

message = Input(message: string)
caption = Input(caption: string)
python_script = Python(IN[0]=message, IN[1]=caption)
# ---------- python_script.python (23 lines) ----------
import clr

clr.AddReference('System.Windows.Forms')
from System.Windows.Forms import MessageBox

# The inputs to this node will be stored as a list in the IN variables.
message = IN[0]
caption = IN[1]

# Place your code below this line
assert message
assert isinstance(message, str)
#assert len(message) <= 2048, "String to long"
max_message_len = 4096
message = message[:max_message_len]

assert len(caption) <= 64, "Caption to long"
caption = caption or "Message"

result = MessageBox.Show(message, caption)

# Assign your output to the OUT variable.
OUT = result
# ----------------------------------------
result = Output(python_script)
