# Dynamo custom node MinimalizeAngle.dyf (Dynamo 2.3.0.5885)
# category: Antler.Math

angle = Input(angle: var[]..[])
python_script = Python(IN[0]=angle)
# ---------- python_script.python (19 lines) ----------
import clr
import math

clr.AddReference('ProtoGeometry')
from Autodesk.DesignScript.Geometry import *
#The inputs to this node will be stored as a list in the IN variable.
angle = IN[0]

if angle <= (math.pi/2):
	angle = angle
elif angle <= math.pi:
	angle = angle - math.pi
elif angle <= (3*math.pi/2):
	angle = angle - math.pi
elif angle <= (2*math.pi):
	angle = angle - (2*math.pi)

#Assign your output to the OUT variable
OUT = angle
# ----------------------------------------
angle_2 = Output(python_script)  # "angle"
