# Dynamo custom node MutualDifference.dyf (Dynamo 2.0.2.6826)
# category: Antler

list1 = Input(list1: var[]..[])
list2 = Input(list2: var[]..[])
python_script = Python(IN[0]=list1, IN[1]=list2)
# ---------- python_script.python (4 lines) ----------
a_not_in_b = [a for a in IN[0] if a not in IN[1]] # a - b
b_not_in_a = [b for b in IN[1] if b not in IN[0]] # b - a

OUT = a_not_in_b, b_not_in_a
# ----------------------------------------
code_block = CodeBlock(t=python_script) { t[0]; t[1]; }
diff1 = Output(code_block.out0)
diff2 = Output(code_block.out1)
