# Dynamo custom node Natural Sort.dyf (Dynamo 2.0.3.8810)
# category: tholth
# Sort list of strings by in "human order", i.e. ["item1", "item2, "item12", "item25"].

text = Input(text: var[]..[])
python_script = Python(IN[0]=text)
# ---------- python_script.python (31 lines) ----------
"""
SOURCES:
https://stackoverflow.com/questions/7851077/how-to-return-index-of-a-sorted-list
https://stackoverflow.com/questions/5967500/how-to-correctly-sort-a-string-with-a-number-inside
"""

import re
from operator import itemgetter

def atoi(text):
    return int(text) if text.isdigit() else text

def natural_keys(text):
    """
    alist.sort(key=natural_keys) sorts in human order
    http://nedbatchelder.com/blog/200712/human_sorting.html
    (See Toothy's implementation in the comments)
    """
    try:
    	result = [atoi(c) for c in re.split(r'(\d+)', text[1])] 
    except:
    	result = None
    return result
    
text_list = IN[0]

temp = [(i, value) for i, value in enumerate(text_list)]

temp.sort(key=natural_keys)

OUT = zip(*temp)
# ----------------------------------------
code_block = CodeBlock(t=python_script) { t[0]; t[1]; }
indices = Output(code_block.out0)
items = Output(code_block.out1)
