# Dynamo custom node Object.Type.dyf (Dynamo 2.3.0.5885)
# category: Antler.Util

object = Input(object: var[]..[])
python_script = Python(IN[0]=object)
# ---------- python_script.python (15 lines) ----------
import clr
clr.AddReference('ProtoGeometry')
from Autodesk.DesignScript.Geometry import *
#The inputs to this node will be stored as a list in the IN variable.
input = IN[0]



output = type(input).__name__




#Assign your output to the OUT variable
OUT = output
# ----------------------------------------
type = Output(python_script)
