# Dynamo custom node OfClass.dyf (Dynamo 2.0.3.8810)
# category: antler.Collector
# Collects elements of API Class. Provide Class name as case sensitive string.

doc = Input(doc: var = null)  # Optional document input
api_class = Input(api_class: string = null)  # API class. Case-sensitive.
get_types = Input(get_types: bool = false)  # True to get Element Types instead of Instance Elements
view = Input(view: Revit.Elements.Views.View = null)  # Optional View to find only elements in View
design_option = Input(design_option: Revit.Elements.Element = null)  # Optional Design Option to find only elements in that Design Option
filters = Input(filters: var[] = null)  # Filters
python_script = Python(IN[0]=doc, IN[1]=api_class, IN[2]=get_types, IN[3]=view, IN[4]=design_option, IN[5]=filters)
# ---------- python_script.python (100 lines) ----------
"""
Sources:
	https://thebuildingcoder.typepad.com/blog/2010/06/element-name-parameter-filter-correction.html
"""

# Enable Python support and load DesignScript library
import clr

clr.AddReference('ProtoGeometry')
from Autodesk.DesignScript.Geometry import *

# Import RevitAPI
clr.AddReference("RevitAPI")
from Autodesk.Revit.DB import *

# Import DocumentManager and TransactionManager
clr.AddReference("RevitServices")
import RevitServices
from RevitServices.Persistence import DocumentManager
from RevitServices.Transactions import TransactionManager

# Import ToDSType(bool) extension method
clr.AddReference("RevitNodes")
import Revit
clr.ImportExtensions(Revit.Elements)
clr.ImportExtensions(Revit.GeometryConversion)

clr.AddReference('System.Collections')
from System import *
from System.Collections.Generic import *

import sys
path = r"C:\Program Files (x86)\IronPython 2.7\Lib"
if not path in sys.path: sys.path.append(path)
import difflib

import operator

import logging
#logging.basicConfig(level=logging.DEBUG)

#The inputs to this node will be stored as a list in the IN variables.
doc = IN[0]
api_class_name = IN[1]
get_types = IN[2]
view = UnwrapElement(IN[3])
design_option = UnwrapElement(IN[4])
filters = IN[5]

log = []

def to_list(item):
	if isinstance(item, list):
		return item
	else:
		return [item]

if not doc:
	doc = DocumentManager.Instance.CurrentDBDocument


if view:
	collector = FilteredElementCollector(doc, view.Id)
elif design_option or api_class_name or filters:
	collector = FilteredElementCollector(doc)
	

if design_option:
	collector.ContainedInDesignOption(design_option.Id)


if get_types:
	collector.WhereElementIsElementType()
else:
	collector.WhereElementIsNotElementType()
	

if api_class_name:
#	try:
	exec("api_class = {}".format(api_class_name))
	collector.OfClass(api_class)
#	except Exception as e:
#		log.append(str(e))

if filters:
	filters = to_list(filters)
	for filter in filters:
		collector.WherePasses(filter)
	
# Collect Elements
log = None

try:
	elements = collector.ToElements()
except Exception as e:
	log.append(str(e))


#Assign your output to the OUT variable.
OUT = elements, log
# ----------------------------------------
code_block = CodeBlock(a=python_script) { a[0]; }
elements = Output(code_block)
