# Dynamo custom node OverrideColorInView.dyf (Dynamo 2.0.3.8104)
# category: tholth.View
# Overrides color in view from list of elements, list of colors and a view

elements = Input(elements: var[]..[])
view = Input(view: var[]..[])
fill_colors = Input(fill_colors: var[]..[])
line_colors = Input(line_colors: var[]..[])
python_script = Python(IN[0]=elements, IN[1]=view, IN[2]=fill_colors, IN[3]=line_colors)
# ---------- python_script.python (73 lines) ----------
import clr
clr.AddReference('ProtoGeometry')
from Autodesk.DesignScript.Geometry import *

# Import DocumentManager and TransactionManager
clr.AddReference ("RevitServices")
import RevitServices
from RevitServices.Persistence import DocumentManager
from RevitServices.Transactions import TransactionManager

# Import RevitAPI
clr.AddReference ("RevitAPI")
from Autodesk.Revit.DB import *

#The inputs to this node will be stored as a list in the IN variables.
elements = IN[0]
view = IN[1]
ds_fill_colors = IN[2]
ds_line_colors = IN[3]

if isinstance(elements, list):
    elements = UnwrapElement(elements)
else:
    elements = [UnwrapElement(elements)]

def dscolor_to_rcolor(dscolor):
	return Color(dscolor.Red, dscolor.Green, dscolor.Blue)


doc = DocumentManager.Instance.CurrentDBDocument
    
# Get solid fill pattern
solid_fill =  FillPatternElement.GetFillPatternElementByName(doc, FillPatternTarget.Drafting, "<Solid fill>")

solid_fill_id = solid_fill.Id





# Start Transaction
TransactionManager.Instance.EnsureInTransaction(doc)

for i, element in enumerate(elements):
	#create graphic overrides properties
	graphic_settings = OverrideGraphicSettings()
	
	if ds_fill_colors[i] is not None:
		fill_color = dscolor_to_rcolor(ds_fill_colors[i])
		
		# Sets projection overrides
		graphic_settings.SetSurfaceBackgroundPatternId(solid_fill_id)
		graphic_settings.SetSurfaceBackgroundPatternColor(fill_color)

		# Sets cut overrides
		graphic_settings.SetCutBackgroundPatternId(solid_fill_id)
		graphic_settings.SetCutBackgroundPatternColor(fill_color)
	
	if ds_line_colors[i] is not None:
		line_color = dscolor_to_rcolor(ds_line_colors[i])
		# Sets projection overrides
		graphic_settings.SetProjectionLineColor(line_color)
		
		# Sets cut overrides
		graphic_settings.SetCutLineColor(line_color)
		
	doc.ActiveView.SetElementOverrides(element.Id, graphic_settings)

# End Transaction
TransactionManager.Instance.TransactionTaskDone()

#Assign your output to the OUT variable.
OUT = None
# ----------------------------------------
elements_2 = Output(python_script)  # "elements"
