# Dynamo custom node Parallelize Element.dyf (Dynamo 2.3.0.5885)
# category: tholth.ModellingAid

element = Input(element: var[]..[])
location = Custom[Element.Location](Element_s=element)  # Returns the location of an element as an XYZ (or if it's line-based the start and end point of the line), along with some booleans to help filtering the results. Use this for some element types (e.g. walls or lines) that do not work with the built-in Get Family Instance Location node.
asVector = Point.AsVector(point=location.Curve_Endpoints)
code_block = CodeBlock(a=asVector) { Flatten(a); }
python_script = Python(IN[0]=code_block)
# ---------- python_script.python (12 lines) ----------
import clr
clr.AddReference('ProtoGeometry')
from Autodesk.DesignScript.Geometry import *
#The inputs to this node will be stored as a list in the IN variable.
a = IN[0]

b = a[1].Subtract(a[0])

c = a[0].Add(b.Scale(0.5))

#Assign your output to the OUT variable
OUT = c
# ----------------------------------------
asPoint = Vector.AsPoint(vector=python_script)
ZAxis = Vector.ZAxis()
code_block_2 = CodeBlock { 1; }
byStartPointDirectionLength = Line.ByStartPointDirectionLength(startPoint=asPoint, direction=ZAxis, length=code_block_2)
grid = Input(grid: var[]..[])
python_script_2 = Python(IN[0]=grid)
# ---------- python_script_2.python (22 lines) ----------
import clr
clr.AddReference('ProtoGeometry')
from Autodesk.DesignScript.Geometry import *

import clr
clr.AddReference('RevitAPI')
from Autodesk.Revit.DB import *

clr.AddReference("RevitNodes")
import Revit
clr.ImportExtensions(Revit.Elements)
clr.ImportExtensions(Revit.GeometryConversion)

#The inputs to this node will be stored as a list in the IN variable.
item = UnwrapElement(IN[0])

a = item.Curve

pt1 = a.Direction

#Assign your output to the OUT variable
OUT = pt1
# ----------------------------------------
python_script_3 = Python(IN[0]=element)
# ---------- python_script_3.python (26 lines) ----------
import clr
clr.AddReference('ProtoGeometry')
from Autodesk.DesignScript.Geometry import *

import clr
clr.AddReference('RevitAPI')
from Autodesk.Revit.DB import *

clr.AddReference("RevitNodes")
import Revit
clr.ImportExtensions(Revit.Elements)
clr.ImportExtensions(Revit.GeometryConversion)

#The inputs to this node will be stored as a list in the IN variable.

item = UnwrapElement(IN[0])

a = item.Location

pt1 = a.Curve.GetEndPoint( 0 )
pt2 = a.Curve.GetEndPoint( 1 )

pt3 = pt1.Subtract(pt2)

#Assign your output to the OUT variable
OUT = pt3
# ----------------------------------------
python_script_4 = Python(IN[0]=python_script_2, IN[1]=python_script_3)
# ---------- python_script_4.python (24 lines) ----------
import clr

clr.AddReference('ProtoGeometry')
from Autodesk.DesignScript.Geometry import *

clr.AddReference('RevitAPI')
from Autodesk.Revit.DB import *

clr.AddReference("RevitNodes")
import Revit

# Import ToProtoType, ToRevitType geometry conversion extension methods
clr.ImportExtensions(Revit.GeometryConversion)


#The inputs to this node will be stored as a list in the IN variable.
vector0 = IN[0]#.ToXyz()
vector1 = IN[1]#.ToXyz()
normal = XYZ.BasisZ

angle = vector0.AngleOnPlaneTo(vector1, normal)

#Assign your output to the OUT variable
OUT = angle
# ----------------------------------------
python_script_5 = Python(IN[0]=python_script_4)
# ---------- python_script_5.python (19 lines) ----------
import clr
import math

clr.AddReference('ProtoGeometry')
from Autodesk.DesignScript.Geometry import *
#The inputs to this node will be stored as a list in the IN variable.
angle = IN[0]

if angle <= (math.pi/2):
	angle = angle
elif angle <= math.pi:
	angle = angle - math.pi
elif angle <= (3*math.pi/2):
	angle = angle - math.pi
elif angle <= (2*math.pi):
	angle = angle - (2*math.pi)

#Assign your output to the OUT variable
OUT = angle
# ----------------------------------------
python_script_6 = Python(IN[0]=element, IN[1]=byStartPointDirectionLength, IN[2]=python_script_5)
# ---------- python_script_6.python (48 lines) ----------
import clr

clr.AddReference('ProtoGeometry')
from Autodesk.DesignScript.Geometry import *

# Import RevitAPI
clr.AddReference("RevitAPI")
import Autodesk
from Autodesk.Revit.DB import ReferencePointArray

# Import DocumentManager and TransactionManager
clr.AddReference("RevitServices")
import RevitServices
from RevitServices.Persistence import DocumentManager
from RevitServices.Transactions import TransactionManager

# Import ToDSType(bool) extension method
clr.AddReference("RevitNodes")
import Revit
clr.ImportExtensions(Revit.Elements)

clr.AddReference('RevitAPI')
from Autodesk.Revit.DB import *

clr.AddReference("RevitNodes")
import Revit
clr.ImportExtensions(Revit.Elements)
clr.ImportExtensions(Revit.GeometryConversion)

#The inputs to this node will be stored as a list in the IN variable.
element = UnwrapElement(IN[0])
axis =  IN[1].ToRevitType()
angle = 0-IN[2]
#commitTransaction = IN[3]


curDoc = DocumentManager.Instance.CurrentDBDocument

# Start Transaction
TransactionManager.Instance.EnsureInTransaction(curDoc)

rotatedElement = ElementTransformUtils.RotateElement(curDoc, element.Id, axis, angle)

# End Transaction
TransactionManager.Instance.TransactionTaskDone()

#Assign your output to the OUT variable
OUT = rotatedElement
# ----------------------------------------
element_2 = Output(python_script_6)  # "element"
