# Dynamo custom node ParameterType.ByName.dyf (Dynamo 2.0.3.8104)
# category: tholth.Parameters

name = Input(name: var[]..[])  # Case sensitive Parameter Type name.
python_script = Python(IN[0]=name)
# ---------- python_script.python (41 lines) ----------
# Enable Python support and load DesignScript library
import clr

clr.AddReference('ProtoGeometry')
from Autodesk.DesignScript.Geometry import *

# Import RevitAPI
clr.AddReference("RevitAPI")
from Autodesk.Revit.DB import *

# Import DocumentManager and TransactionManager
clr.AddReference("RevitServices")
import RevitServices
from RevitServices.Persistence import DocumentManager
from RevitServices.Transactions import TransactionManager

# Import ToDSType(bool) extension method
clr.AddReference("RevitNodes")
import Revit
clr.ImportExtensions(Revit.Elements)
clr.ImportExtensions(Revit.GeometryConversion)

#The inputs to this node will be stored as a list in the IN variables.
type_string = IN[0]

doc = DocumentManager.Instance.CurrentDBDocument
uiapp = DocumentManager.Instance.CurrentUIApplication
app = uiapp.Application

def function(type_string):
	# Do something with item and get a result
	assert type_string in dir(ParameterType), "No Parameter Type found by that name"
	
	exec("result = ParameterType.{}".format(type_string))

	return result

output = function(type_string)

#Assign your output to the OUT variable.
OUT = output
# ----------------------------------------
parameter_type = Output(python_script)
