# Dynamo custom node Parameters.AssociateWithGlobalParameter.dyf "AssociateWithGlobalParameter" (Dynamo 2.0.3.8810)
# category: Antler.Parameters
# Associates this parameter with a global parameter in the same document.

parameter = Input(parameter: var[]..[])
global_parameter = Input(global_parameter: var[]..[])
python_script = Python(IN[0]=parameter, IN[1]=global_parameter)
# ---------- python_script.python (68 lines) ----------
import clr

# Import RevitAPI
clr.AddReference("RevitAPI")
import Autodesk
from Autodesk.Revit import DB

# Import List
from System.Collections.Generic import List

# Import DocumentManager and TransactionManager
clr.AddReference ("RevitServices")
import RevitServices
from RevitServices.Persistence import DocumentManager
from RevitServices.Transactions import TransactionManager

doc = DocumentManager.Instance.CurrentDBDocument
uiapp = DocumentManager.Instance.CurrentUIApplication
app = uiapp.Application

#The inputs to this node will be stored as a list in the IN variable.
parameters = UnwrapElement(IN[0])
global_parameters = UnwrapElement(IN[1])

def function(parameter, global_parameter=None):
	# Do some stuff with inputs
	if global_parameter:
		parameter.AssociateWithGlobalParameter(global_parameter.Id)
	else:
		parameter.DissociateFromGlobalParameter()
	
	return parameter

# Cases
case0 = function

def case1(A, B):
	return [function(a, B) for a in A]

def case2(A, B):
	return [function(a, b) for a, b in zip(A, B)]

def case3(A, B):
	return [function(a, None) for a in A]


	
switch = {
	(DB.Parameter, DB.GlobalParameter): 		 case0,
	(List[object], DB.GlobalParameter): 		case1,
	(List[object], List[object]): 		case2,
	}

# Start Transaction
TransactionManager.Instance.EnsureInTransaction(doc)

# Transaction

output = switch.get(
	(type(parameters), type(global_parameters)),
	case3
		)(parameters, global_parameters)

# End Transaction
TransactionManager.Instance.TransactionTaskDone()

#Assign your output to the OUT variable
OUT = output
# ----------------------------------------
parameter_2 = Output(python_script)  # "parameter"
