# Dynamo custom node Parellize Element.dyf (Dynamo 2.3.0.5885)
# category: tholth.Util

grid = Input(grid: var[]..[])
location = Custom[Element.Location](Element_s=grid)  # Returns the location of an element as an XYZ (or if it's line-based the start and end point of the line), along with some booleans to help filtering the results. Use this for some element types (e.g. walls or lines) that do not work with the built-in Get Family Instance Location node.
asVector = Point.AsVector(point=location.Curve_Endpoints)
code_block = CodeBlock(a=asVector) { Flatten(a); }
python_script = Python(IN[0]=code_block)
# ---------- python_script.python (12 lines) ----------
import clr
clr.AddReference('ProtoGeometry')
from Autodesk.DesignScript.Geometry import *
#The inputs to this node will be stored as a list in the IN variable.
a = IN[0]

b = a[1].Subtract(a[0])

c = a[0].Add(b.Scale(0.5))

#Assign your output to the OUT variable
OUT = c
# ----------------------------------------
X = Vector.X(vector=python_script)
Y = Vector.Y(vector=python_script)
Z = Vector.Z(vector=python_script)
byCoordinates = Point.ByCoordinates(x=X, y=Y, z=Z)
ZAxis = Vector.ZAxis()
code_block_2 = CodeBlock { 1; }
byStartPointDirectionLength = Line.ByStartPointDirectionLength(startPoint=byCoordinates, direction=ZAxis, length=code_block_2)
elementDirection = Custom[ElementDirection](element=grid)
element = Input(element: var[]..[])
python_script_2 = Python(IN[0]=element)
# ---------- python_script_2.python (26 lines) ----------
import clr
clr.AddReference('ProtoGeometry')
from Autodesk.DesignScript.Geometry import *

import clr
clr.AddReference('RevitAPI')
from Autodesk.Revit.DB import *

clr.AddReference("RevitNodes")
import Revit
clr.ImportExtensions(Revit.Elements)
clr.ImportExtensions(Revit.GeometryConversion)

#The inputs to this node will be stored as a list in the IN variable.

item = UnwrapElement(IN[0])

a = item.Location

pt1 = a.Curve.GetEndPoint( 0 )
pt2 = a.Curve.GetEndPoint( 1 )

pt3 = pt1.Subtract(pt2)

#Assign your output to the OUT variable
OUT = pt3
# ----------------------------------------
python_script_3 = Python(IN[0]=elementDirection, IN[1]=python_script_2)
# ---------- python_script_3.python (24 lines) ----------
import clr

clr.AddReference('ProtoGeometry')
from Autodesk.DesignScript.Geometry import *

clr.AddReference('RevitAPI')
from Autodesk.Revit.DB import *

clr.AddReference("RevitNodes")
import Revit

# Import ToProtoType, ToRevitType geometry conversion extension methods
clr.ImportExtensions(Revit.GeometryConversion)


#The inputs to this node will be stored as a list in the IN variable.
vector0 = IN[0]#.ToXyz()
vector1 = IN[1]#.ToXyz()
normal = XYZ.BasisZ

angle = vector0.AngleOnPlaneTo(vector1, normal)

#Assign your output to the OUT variable
OUT = angle
# ----------------------------------------
minimalizeAngle = Custom[MinimalizeAngle](angle=python_script_3)
python_script_4 = Python(IN[0]=grid, IN[1]=byStartPointDirectionLength, IN[2]=minimalizeAngle)
# ---------- python_script_4.python (51 lines) ----------
import clr

clr.AddReference('ProtoGeometry')
from Autodesk.DesignScript.Geometry import *

# Import RevitAPI
clr.AddReference("RevitAPI")
import Autodesk
from Autodesk.Revit.DB import ReferencePointArray

# Import DocumentManager and TransactionManager
clr.AddReference("RevitServices")
import RevitServices
from RevitServices.Persistence import DocumentManager
from RevitServices.Transactions import TransactionManager

# Import ToDSType(bool) extension method
clr.AddReference("RevitNodes")
import Revit
clr.ImportExtensions(Revit.Elements)

clr.AddReference('RevitAPI')
from Autodesk.Revit.DB import *

clr.AddReference("RevitNodes")
import Revit
clr.ImportExtensions(Revit.Elements)
clr.ImportExtensions(Revit.GeometryConversion)

#The inputs to this node will be stored as a list in the IN variable.
element = UnwrapElement(IN[0])
axis =  IN[1].ToRevitType()
angle = 0-IN[2]
#commitTransaction = IN[3]


curDoc = DocumentManager.Instance.CurrentDBDocument

# Start Transaction
TransactionManager.Instance.EnsureInTransaction(curDoc)

try:
	rotatedElement = ElementTransformUtils.RotateElement(curDoc, element.Id, axis, angle)
except:
	pass

# End Transaction
TransactionManager.Instance.TransactionTaskDone()

#Assign your output to the OUT variable
OUT = rotatedElement
# ----------------------------------------
OUT = Output(python_script_4)
