# Dynamo custom node Place Views on Sheet.dyf (Dynamo 2.3.0.5885)
# category: tholth.Sheet
# Places a view on sheet at (0,0,0)

sheet = Input(sheet: var[]..[])
views = Input(views: var[]..[])
point = Input(point: Autodesk.DesignScript.Geometry.Point = Autodesk.DesignScript.Geometry.Point.ByCoordinates(0, 0, 0))
python_script = Python(IN[0]=sheet, IN[1]=views, IN[2]=point)
# ---------- python_script.python (85 lines) ----------
import clr
clr.AddReference('ProtoGeometry')
from Autodesk.DesignScript.Geometry import Point

# Import RevitAPI
clr.AddReference("RevitAPI")
import Autodesk
from Autodesk.Revit import DB

# Import ToDSType(bool) extension method
clr.AddReference("RevitNodes")
import Revit
clr.ImportExtensions(Revit.Elements)
clr.ImportExtensions(Revit.GeometryConversion)

# Import DocumentManager and TransactionManager
clr.AddReference ("RevitServices")
import RevitServices
from RevitServices.Persistence import DocumentManager
from RevitServices.Transactions import TransactionManager

# Import List
from System.Collections.Generic import List

#The inputs to this node will be stored as a list in the IN variable.
sheets = UnwrapElement(IN[0])
views = UnwrapElement(IN[1])
placement_pts = IN[2]

doc = DocumentManager.Instance.CurrentDBDocument

def create_viewport(sheet, view, pt):
	if sheet and view and pt:
		viewport = DB.Viewport.Create(doc, sheet.Id, view.Id, pt.ToXyz())
	else:
		viewport = None
		
	return viewport

# Cases
case0 = create_viewport

def case1(sheet, views, pt):
	viewports = [create_viewport(sheet, view, pt) for view in views]
		
	return viewports
	
def case2(sheet, views, pts):
	viewports = [create_viewport(sheet, view, pt) for view, pt in zip(views, pts)]
	
	return viewports

def case3(sheets, views, pt):
	viewports = [create_viewport(sheet, view, pt) for sheet, view in zip(sheets, views)]
	
	return viewports

def case4(sheets, views, pts):
	viewports = [create_viewport(sheet, view, pt) for sheet, view, pt in zip(sheets, views, pts)]
		
	return viewports


case_switch_dict = {
	(DB.ViewSheet, DB.ViewPlan,  Point): 		case0,
	(DB.ViewSheet, DB.ViewSection,  Point): 	case0,
	(DB.ViewSheet, List[object], Point): 		case1,
	(DB.ViewSheet, List[object], list): 		case2,
	(List[object], List[object], Point): 		case3,
	(List[object], List[object], list): 		case4,
	}
	
if not placement_pts:
	placement_pts = Point.ByCoordinates(0,0,0)

# Start Transaction
TransactionManager.Instance.EnsureInTransaction(doc)

viewports = case_switch_dict[(type(sheets), type(views), type(placement_pts))](sheets, views, placement_pts)

# End Transaction
TransactionManager.Instance.TransactionTaskDone()

#Assign your output to the OUT variable
OUT = viewports
# ----------------------------------------
viewports = Output(python_script)
