# Dynamo custom node Place view on sheet.dyf (Dynamo 2.3.0.5885)
# category: tholth.View.Actions
# Places a view on sheet at (0,0,0)

view = Input(view: var[]..[])
sheet = Input(sheet: var[]..[])
pt = Input(pt: var[]..[])
python_script = Python(IN[0]=view, IN[1]=sheet, IN[2]=pt)
# ---------- python_script.python (48 lines) ----------
import clr
clr.AddReference('ProtoGeometry')
from Autodesk.DesignScript.Geometry import *
# Import RevitAPI
clr.AddReference("RevitAPI")
import Autodesk
from Autodesk.Revit.DB import *

# Import DocumentManager and TransactionManager
clr.AddReference("RevitServices")
import RevitServices
from RevitServices.Persistence import DocumentManager
from RevitServices.Transactions import TransactionManager

# Import ToDSType(bool) extension method
clr.AddReference("RevitNodes")
import Revit
clr.ImportExtensions(Revit.Elements)
clr.ImportExtensions(Revit.GeometryConversion)
#The inputs to this node will be stored as a list in the IN variable.
views = UnwrapElement(IN[0])
sheets = UnwrapElement(IN[1])
placement_pts = IN[2]

doc = DocumentManager.Instance.CurrentDBDocument
i = 0

#views_id_new = []

# Start Transaction
TransactionManager.Instance.EnsureInTransaction(doc)

for view, sheet, placement_pt in zip(views, sheets, placement_pts):
	Viewport.Create(doc, sheet, view, placement_pt.ToXyz())

"""
while i < len(sheets):
	Viewport.Create(doc, sheets[i].Id, views[i].Id, XYZ(0,0,0))
	i += 1
"""

# End Transaction
TransactionManager.Instance.TransactionTaskDone()

#views_new = [doc.GetElement(a) for a in views_id_new]

#Assign your output to the OUT variable
OUT = None
# ----------------------------------------
view_2 = Output(python_script)  # "view"
