# Dynamo custom node PlanarizedCurveLoops.dyf (Dynamo 2.0.3.8810)
# category: Antler.CurtainWall
# The planarized curve loops for cell boundaries. The boundaries can have more than one CurveLoop. Each item in the returned array represents a CurveLoop containing 3 or more than 3 edges.

curtain_cell = Input(curtain_cell: var[]..[])
python_script = Python(IN[0]=curtain_cell)
# ---------- python_script.python (31 lines) ----------
# Enable Python support and load DesignScript library
import clr

# Import RevitAPI
clr.AddReference("RevitAPI")
from Autodesk.Revit import DB

# Import ToDSType(bool) extension method
clr.AddReference("RevitNodes")
import Revit
clr.ImportExtensions(Revit.Elements)
clr.ImportExtensions(Revit.GeometryConversion)

#The inputs to this node will be stored as a list in the IN variable.
elements = IN[0]

def function(element):
	if isinstance(element, (list, tuple)):
		return [function(e) for e in element]
	else:
		# Code follows here:
		element = UnwrapElement(element)
		
		try:
			crvs = [a.ToProtoType() for a in element.PlanarizedCurveLoops]
		except:
			crvs = None
		
		return crvs

OUT = function(elements)
# ----------------------------------------
crvs = Output(python_script)
