# Dynamo custom node PointCloudTypeProperties.dyf (Dynamo 2.3.0.5885)
# category: Antler.PointCloudInstance

point_cloud_instance = Input(point_cloud_instance: var[]..[])
python_script = Python(IN[0]=point_cloud_instance)
# ---------- python_script.python (42 lines) ----------
# Enable Python support and load DesignScript library
import clr

# Import RevitAPI
clr.AddReference("RevitAPI")
from Autodesk.Revit import DB

# Import DocumentManager and TransactionManager
clr.AddReference ("RevitServices")
import RevitServices
from RevitServices.Persistence import DocumentManager
from RevitServices.Transactions import TransactionManager

doc = DocumentManager.Instance.CurrentDBDocument
uiapp = DocumentManager.Instance.CurrentUIApplication
app = uiapp.Application

#The inputs to this node will be stored as a list in the IN variable.
elements = IN[0]

def function(element):
	if isinstance(element, (list, tuple)):
		return [function(e) for e in element]
	else:
		# Code follows here:
		element = UnwrapElement(element)
		
		id = element.GetTypeId()
		
		pt_cloud_type = doc.GetElement(id)
		
		data_dict = {
			'Scale': pt_cloud_type.Scale, 
			'Offset': pt_cloud_type.Offset,
			'ColorEncoding': pt_cloud_type.ColorEncoding,
			'FoundStatus': pt_cloud_type.FoundStatus,
			'Path': pt_cloud_type.GetPath()
			}
		
		return data_dict

OUT = function(elements)
# ----------------------------------------
properties = Output(python_script)
