# Dynamo custom node PointGridFromCrvGrid.dyf (Dynamo 2.0.3.8810)
# category: antler.Points

crv_grid_u = Input(crv_grid_u: var[]..[])
crv_grid_v = Input(crv_grid_v: var[]..[])
python_script = Python(IN[0]=crv_grid_u, IN[1]=crv_grid_v)
# ---------- python_script.python (39 lines) ----------
# Enable Python support and load DesignScript library
import clr

# Import RevitAPI
clr.AddReference("RevitAPI")
from Autodesk.Revit import DB

# For working with DesignScript abstract geometry
clr.AddReference('ProtoGeometry')
from Autodesk.DesignScript.Geometry import *

# Import ToDSType(bool) extension method
clr.AddReference("RevitNodes")
import Revit
clr.ImportExtensions(Revit.Elements)
clr.ImportExtensions(Revit.GeometryConversion)

#The inputs to this node will be stored as a list in the IN variable.
crvs_u = IN[0]
crvs_v = IN[1]


quad_tree = []

for i, u in enumerate(crvs_u):
	quads = []
	for j, v in enumerate(crvs_v):
			
		pt0 = Point.ByCoordinates(v.StartPoint.X, u.StartPoint.Y, 0)
		pt1 = Point.ByCoordinates(v.StartPoint.X, u.EndPoint.Y,   0)		
		pt2 = Point.ByCoordinates(v.EndPoint.X,   u.EndPoint.Y,   0)
		pt3 = Point.ByCoordinates(v.EndPoint.X,   u.StartPoint.Y, 0)

		quads.append((pt0, pt1, pt2, pt3))
	
	quad_tree.append(quads)	

#Assign your output to the OUT variable.
OUT = quad_tree
# ----------------------------------------
pt_grid = Output(python_script)
