# Dynamo custom node Points.AveragePoint.dyf "AveragePoint" (Dynamo 2.0.3.8810)
# category: Antler.Geometry.Points
# Average point from list of points.

pts = Input(pts: var[]..[])
code_block = CodeBlock(pts=pts)
# ---------- code_block.designscript (26 lines) ----------
// Average point

pts;

avg_pt = [Imperative]
{
   x = 0;
   y = 0;
   z = 0;

   for (pt in pts)
   {
	x = pt.X + x;
	y = pt.Y + y;
	z = pt.Z + z;
   }

   count = List.Count(pts);
   avg_pt = Point.ByCoordinates(
   x/count,
   y/count,
   z/count
   );

return = avg_pt;
};
# ----------------------------------------
avg_pt = Output(code_block.out1)
