# Dynamo custom node PointsInBoundingBox.dyf (Dynamo 2.3.0.5885)
# category: Antler.PointCloudInstance
# Extract Point Cloud Points inside Bounding Box. Optional toggle to ignore top and bottom limits of Bounding Box

point_cloud_instance = Input(point_cloud_instance: var[]..[])
bounding_box = Input(bounding_box: var[]..[])
ignore_top_bottom = Input(ignore_top_bottom: var[]..[])
python_script = Python(IN[0]=point_cloud_instance, IN[1]=bounding_box, IN[2]=ignore_top_bottom)
# ---------- python_script.python (56 lines) ----------
# Enable Python support and load DesignScript library
import clr

# Import RevitAPI
clr.AddReference("RevitAPI")
from Autodesk.Revit import DB

from System.Collections.Generic import List

# Import ToDSType(bool) extension method
clr.AddReference("RevitNodes")
import Revit
clr.ImportExtensions(Revit.Elements)
clr.ImportExtensions(Revit.GeometryConversion)

#The inputs to this node will be stored as a list in the IN variable.
ptcloud = IN[0]
bbox = IN[1]
ignore = IN[2]

def ptcloud_filter_from_bounding_box(bbox, ignore_top_bottom=False):
	#// Filter will match 1/8 of the overall point cloud
	#// Use the bounding box (filter coordinates are in the coordinates of the model)

	planes = List[DB.Plane]()
	
	#// X boundaries
	planes.Add(DB.Plane.CreateByNormalAndOrigin(DB.XYZ.BasisX, bbox.Min))
	planes.Add(DB.Plane.CreateByNormalAndOrigin(-DB.XYZ.BasisX, bbox.Max))
	
	#// Y boundaries
	planes.Add(DB.Plane.CreateByNormalAndOrigin(DB.XYZ.BasisY, bbox.Min))
	planes.Add(DB.Plane.CreateByNormalAndOrigin(-DB.XYZ.BasisY, bbox.Max))
	
	if not ignore_top_bottom:
		#// Z boundaries
		planes.Add(DB.Plane.CreateByNormalAndOrigin(DB.XYZ.BasisZ, bbox.Min))
		planes.Add(DB.Plane.CreateByNormalAndOrigin(-DB.XYZ.BasisZ, bbox.Max))
	
	#// Create filter
	filter = DB.PointClouds.PointCloudFilterFactory.CreateMultiPlaneFilter(planes)
	
	return filter

def extract_pts(ptcloud, bbox, avg_dist=0.1, num_pts=999999):
	
	filter = ptcloud_filter_from_bounding_box(bbox)
	
	pts = ptcloud.GetPoints(filter, avg_dist, num_pts)
	
	return pts

ptcloud = UnwrapElement(ptcloud)
bbox = bbox.ToRevitType()

OUT = extract_pts(ptcloud, bbox, ignore)
# ----------------------------------------
python_script_2 = Python(IN[0]=python_script)
# ---------- python_script_2.python (24 lines) ----------
# Enable Python support and load DesignScript library
import clr

# Import RevitAPI
clr.AddReference("RevitAPI")
from Autodesk.Revit import DB

# For working with DesignScript abstract geometry
clr.AddReference('ProtoGeometry')
from Autodesk.DesignScript.Geometry import *

#The inputs to this node will be stored as a list in the IN variable.
elements = IN[0]

def function(element):
	if isinstance(element, (list, tuple)):
		return [function(e) for e in element]
	else:
		# Code follows here:
		element = UnwrapElement(element)		
		
		return element.X, element.Y, element.Z, element.Color

OUT = function(elements)
# ----------------------------------------
code_block = CodeBlock { 0; }
getItemAtIndex = List.GetItemAtIndex(list=python_script_2@L2, index=code_block)
# note: May have to modify this for other units. Works when cloud is in meters and revit project is in millimeters.
convert_between_units = DynamoConvert(getItemAtIndex, MeasurementType="Length", FromConversion="Meters", ToConversion="Millimeters")
code_block_2 = CodeBlock { 1; }
getItemAtIndex_2 = List.GetItemAtIndex(list=python_script_2@L2, index=code_block_2)
convert_between_units_2 = DynamoConvert(getItemAtIndex_2, MeasurementType="Length", FromConversion="Meters", ToConversion="Millimeters")
code_block_3 = CodeBlock { 2; }
getItemAtIndex_3 = List.GetItemAtIndex(list=python_script_2@L2, index=code_block_3)
convert_between_units_3 = DynamoConvert(getItemAtIndex_3, MeasurementType="Length", FromConversion="Meters", ToConversion="Millimeters")
byCoordinates = Point.ByCoordinates(x=convert_between_units, y=convert_between_units_2, z=convert_between_units_3)
transforms = Custom[Transforms](point_cloud=point_cloud_instance)  # Get transforms of Point Cloud Instance, both Transform and Total Transform.
transform = Geometry.Transform(geometry=byCoordinates, cs=transforms.transform)
points = Output(transform)
code_block_4 = CodeBlock { 3; }
getItemAtIndex_4 = List.GetItemAtIndex(list=python_script_2@L2, index=code_block_4)
color = Output(getItemAtIndex_4)
