# Dynamo custom node PrimaryDesignOptionMemberFilter.dyf (Dynamo 2.0.3.8810)
# category: Antler.Collector

inverted = Input(inverted: bool = False)
python_script = Python(IN[0]=inverted)  # "Python Script - PrimaryDesignOptionMemberFilter"
# ---------- python_script.python (29 lines) ----------
# Enable Python support and load DesignScript library
import clr

clr.AddReference('ProtoGeometry')
from Autodesk.DesignScript.Geometry import *

# Import RevitAPI
clr.AddReference("RevitAPI")
from Autodesk.Revit.DB import *

# Import ToDSType(bool) extension method
clr.AddReference("RevitNodes")
import Revit
clr.ImportExtensions(Revit.Elements)
clr.ImportExtensions(Revit.GeometryConversion)

#The inputs to this node will be stored as a list in the IN variables.
inverted = IN[0]

def function(inverted):
	# Do something with item and get a result
	filter = PrimaryDesignOptionMemberFilter(inverted)

	return filter

output = function(inverted)

#Assign your output to the OUT variable.
OUT = output
# ----------------------------------------
filter = Output(python_script)
