# Dynamo custom node ProjectCoordinateSystem.dyf (Dynamo 2.3.0.5885)
# category: Bru

east = Input(east: var[]..[])
north = Input(north: var[]..[])
elevation = Input(elevation: var[]..[])
byCoordinates = Point.ByCoordinates(x=east, y=north, z=elevation)
XAxis = Vector.XAxis()
ZAxis = Vector.ZAxis()
AngleToTrueNorth = Input(AngleToTrueNorth: var[]..[])
code_block = CodeBlock(rot=AngleToTrueNorth) { -rot; }
rotate = Vector.Rotate(vector=XAxis, axis=ZAxis, degrees=code_block)
YAxis = Vector.YAxis()
rotate_2 = Vector.Rotate(vector=YAxis, axis=ZAxis, degrees=code_block)
byOriginVectors = CoordinateSystem.ByOriginVectors(origin=byCoordinates, xAxis=rotate, yAxis=rotate_2)
ProjectCoordinateSystem = Output(byOriginVectors)
