# Dynamo custom node ProjectCoordinateSystemByFile.dyf (Dynamo 2.3.0.5885)
# category: Bru

file_path = Input(file_path: var[]..[])
readProjectBasepointInformationFile = Custom[Document.ReadProjectBasepointInformationFile](FileName=file_path)  # Reads a Project Basepoint Information file (*.MCInf) Containing information on Norting, Easting, Elevation and Angle to True North.
projectCoordinateSystem = Custom[ProjectCoordinateSystem](north=readProjectBasepointInformationFile.N_S, east=readProjectBasepointInformationFile.E_W, elevation=readProjectBasepointInformationFile.Elev, AngleToTrueNorth=readProjectBasepointInformationFile.AngleToTrueNorth)
ProjectCoordinateSystem = Output(projectCoordinateSystem)
