# Dynamo custom node PtCloud.Scans.dyf "Scans" (Dynamo 2.3.0.5885)
# category: Antler.PointCloudInstance
# Get Scans of Point Cloud

PtCloud = Input(PtCloud: var[]..[])
python_script = Python(IN[0]=PtCloud)
# ---------- python_script.python (21 lines) ----------
# Enable Python support and load DesignScript library
import clr

# Import RevitAPI
clr.AddReference("RevitAPI")
from Autodesk.Revit import DB

#The inputs to this node will be stored as a list in the IN variable.
elements = IN[0]

def function(element):
	if isinstance(element, (list, tuple)):
		return [function(e) for e in element]
	else:
		# Code follows here:
		element = UnwrapElement(element)
		
		
		return element.GetScans()
		
OUT = function(elements)
# ----------------------------------------
Scans = Output(python_script)
