# Dynamo custom node Python Any.dyf (Dynamo 2.3.0.5885)
# category: Antler.Logic

list = Input(list: var[]..[])
any = Python(IN[0]=list)
# ---------- any.python (11 lines) ----------
import clr
clr.AddReference('ProtoGeometry')
from Autodesk.DesignScript.Geometry import *
#The inputs to this node will be stored as a list in the IN variables.
input = IN[0]


output= any(input)

#Assign your output to the OUT variable.
OUT = output
# ----------------------------------------
bool = Output(any)
