# Dynamo custom node Python dir().dyf (Dynamo 2.0.3.8810)
# category: Antler.Utils
# The dir() method tries to return a list of valid attributes of the object.

object = Input(object: var[]..[])
python_script = Python(IN[0]=object)
# ---------- python_script.python (21 lines) ----------
# Enable Python support and load DesignScript library
import clr

# Import RevitAPI
clr.AddReference("RevitAPI")
from Autodesk.Revit import DB

#The inputs to this node will be stored as a list in the IN variable.
elements = IN[0]

def function(element):
	if isinstance(element, (list, tuple)):
		return [function(e) for e in element]
	else:
		# Code follows here:
		element = UnwrapElement(element)
		
		
		return dir(element)

OUT = function(elements)
# ----------------------------------------
attributes = Output(python_script)
