# Dynamo custom node QuadsFromPointMatrix.dyf (Dynamo 2.0.3.8810)
# category: antler.Points
# Returns point quads from 2-dimensional point matrix.

point_matrix = Input(point_matrix: var[]..[])
python_script = Python(IN[0]=point_matrix)
# ---------- python_script.python (38 lines) ----------
# Enable Python support and load DesignScript library
import clr

# Import RevitAPI
clr.AddReference("RevitAPI")
from Autodesk.Revit import DB

# For working with DesignScript abstract geometry
clr.AddReference('ProtoGeometry')
from Autodesk.DesignScript.Geometry import *

# Import ToDSType(bool) extension method
clr.AddReference("RevitNodes")
import Revit
clr.ImportExtensions(Revit.Elements)
clr.ImportExtensions(Revit.GeometryConversion)

#The inputs to this node will be stored as a list in the IN variable.
grid = IN[0]

quad_tree = []

for i in range(len(grid)-1):
	quads = []
	
	for j in range(len(grid[i])-1):

		quads.append((
			grid[i][j], 
			grid[i+1][j], 
			grid[i+1][j+1], 
			grid[i][j+1]
			))
	
	quad_tree.append(quads)

#Assign your output to the OUT variable.
OUT = quad_tree
# ----------------------------------------
quads = Output(python_script)
