# Dynamo custom node Random Choice.dyf (Dynamo 2.0.3.8810)
# category: antler.Math
# Random choose from options. Each option has a chance value. Higher chance value means higher chance of option being chosen.

options = Input(options: var[]..[])
chances = Input(chances: var[]..[])
seed = Input(seed: var[]..[])
python_script = Python(IN[0]=options, IN[1]=chances, IN[2]=seed)
# ---------- python_script.python (33 lines) ----------
# Enable Python support and load DesignScript library
import clr
clr.AddReference('ProtoGeometry')
from Autodesk.DesignScript.Geometry import *

from System import Random

# The inputs to this node will be stored as a list in the IN variables.
options = IN[0] # List of options
chances = IN[1] # Corresponding list of priorities
seed = IN[2] # Random seed


# Place your code below this line
def choose(options, chances, seed):
	rand = Random(int(hash(seed)))
	
	draw = rand.NextDouble() * sum(chances)
	
	for i in range(len(chances)):
		if draw < sum(chances[:i+1]):
			return options[i]
			


if isinstance(seed, list):
	output = [choose(options, chances, s) for s in seed]
else:
	output = choose(options, chances, seed)


# Assign your output to the OUT variable.
OUT = output
# ----------------------------------------
choice = Output(python_script)
