# Dynamo custom node Random Number List.dyf (Dynamo 2.0.3.8104)
# category: tholth
# Generates a random list of numbers. Seed input accepts anything that can be hashed, even Revit classes.

seed = Input(seed: var[]..[])
count = Input(count: int = 1)
python_script = Python(IN[0]=seed, IN[1]=count)
# ---------- python_script.python (15 lines) ----------
# Enable Python support and load DesignScript library
#import random¨
from System import Random

# The inputs to this node will be stored as a list in the IN variables.
seed = IN[0]
count = IN[1]

# Place your code below this line
rand = Random(int(hash(seed)))

numbers = [rand.NextDouble() for _ in range(count)]

# Assign your output to the OUT variable.
OUT = numbers
# ----------------------------------------
numbers = Output(python_script)
