# Dynamo custom node Recursive Random.dyf (Dynamo 2.0.3.8810)
# category: Antler.Math
# Turns all values in list of list (of list etc) to random values between 0 and 1. Randomize boolean adds extra time based randomness.

list = Input(list: var[]..[])
randomize = Input(randomize: bool = false)
python_script = Python(IN[0]=list, IN[1]=randomize)
# ---------- python_script.python (20 lines) ----------
from System import Random
import time

seed = IN[0]
randomize = IN[1]


def recursive_random(hashable, randomize=False):
    if isinstance(hashable, (list, tuple)):
        return [recursive_random(a, randomize) for a in hashable]
        
    else:
    	if randomize:
    		rand = Random(int(hash((hashable, time.time()))))
    	else:
    		rand = Random(int(hash(hashable)))
    		
        return rand.NextDouble()

OUT = recursive_random(seed, bool(randomize))
# ----------------------------------------
numbers = Output(python_script)
