# Dynamo custom node Room.CentrePt.dyf "Center Point" (Dynamo 2.0.2.6826)
# category: Antler.Rooms.Query
# Center point of Room

room = Input(room: var[]..[])
finishBoundary = Room.FinishBoundary(room=room)
startPoint = Curve.StartPoint(curve=finishBoundary)
byPoints = Polygon.ByPoints(points=startPoint)
code_block = CodeBlock { 0; }
getItemAtIndex = List.GetItemAtIndex(list=byPoints@L2, index=code_block)
center = Polygon.Center(polygon=getItemAtIndex)
Point = Output(center)
