# Dynamo custom node Room.Doors.dyf "Doors" (Dynamo 2.3.0.5885)
# category: Antler.Rooms.Query
# Gets doors to room and from room

rooms = Input(rooms: var[]..[])
python_script = Python(IN[0]=rooms)
# ---------- python_script.python (52 lines) ----------
import clr
clr.AddReference('ProtoGeometry')
from Autodesk.DesignScript.Geometry import *

# Import RevitAPI
clr.AddReference("RevitAPI")
import Autodesk
from Autodesk.Revit.DB import *

# Import DocumentManager and TransactionManager
clr.AddReference("RevitServices")
import RevitServices
from RevitServices.Persistence import DocumentManager

#The inputs to this node will be stored as a list in the IN variable.
rooms = IN[0]

doc = DocumentManager.Instance.CurrentDBDocument
phase = list(doc.Phases)[-1] 

output = []

if not isinstance(rooms, list):
    rooms = [UnwrapElement(rooms)]
else:
	rooms = UnwrapElement(rooms)

room_ids = [room.Id for room in rooms]

room_range = range(len(rooms))
room_fromdoors = [[] for i in room_range]
room_todoors = [[] for i in room_range]

door_collector = FilteredElementCollector(doc).OfCategory(BuiltInCategory.OST_Doors).OfClass(FamilyInstance)


for door in door_collector:
	try:
		fromroom = door.FromRoom[phase]
		if fromroom.Id in room_ids:
			room_fromdoors[room_ids.index(fromroom.Id)].append(door)
	except:
		pass
	try:
		toroom = door.ToRoom[phase]
		if toroom.Id in room_ids:
			room_todoors[room_ids.index(toroom.Id)].append(door)
	except:
		pass

#Assign your output to the OUT variable
OUT = room_fromdoors, room_todoors
# ----------------------------------------
code_block = CodeBlock(a=python_script) { a[0]; a[1]; }
doors_fromroom = Output(code_block.out0)  # "doors.fromroom"
doors_toroom = Output(code_block.out1)  # "doors.toroom"
