# Dynamo custom node Room.GeneratingElements.dyf "GeneratingElements" (Dynamo 2.0.2.6826)
# category: Antler.Rooms.Query
# Gets surfaces of room solid, and associated elements generating room geometry, together with the surface material. Will only get surfaces where room is bounded by an element, and not any surfaces where room is not bounded. For example if a room is not bounded on top, this node will not output the top surface of the room geometry.

room = Input(room: var[]..[])
python_script = Python(IN[0]=room)
# ---------- python_script.python (104 lines) ----------
# Sourc: https://knowledge.autodesk.com/search-result/caas/CloudHelp/cloudhelp/2016/ENU/Revit-API/files/GUID-E7B451BB-21DC-4D72-AD26-75F0C2E911E4-htm.html

import clr

clr.AddReference('ProtoGeometry')
from Autodesk.DesignScript.Geometry import *

# Import RevitAPI
clr.AddReference("RevitAPI")
import Autodesk
from Autodesk.Revit.DB import *

# Import DocumentManager and TransactionManager
clr.AddReference("RevitServices")
import RevitServices
from RevitServices.Persistence import DocumentManager
from RevitServices.Transactions import TransactionManager

# Import ToDSType(bool) extension method
clr.AddReference("RevitNodes")
import Revit
clr.ImportExtensions(Revit.Elements)
clr.ImportExtensions(Revit.GeometryConversion)

# Import Revit UI
clr.AddReference('RevitAPIUI')
from Autodesk.Revit.UI import *
#from Autodesk.Revit.UI.Selection import *

from Autodesk.DesignScript.Geometry import *

from System import *
from System.Collections.Generic import *


def to_list(item):
	if isinstance(item, list):
		return item
	else:
		return [item]

def room_query(room):
	faces = []
	elements = []
	mat_ids = []

	spatialElementBoundaryOptions = SpatialElementBoundaryOptions()
	spatialElementBoundaryOptions.SpatialElementBoundaryLocation = SpatialElementBoundaryLocation.Finish

	calculator = SpatialElementGeometryCalculator(doc, spatialElementBoundaryOptions) # Returns a SpatialElementGeometryCalculator Class object
	
	try:
		results = calculator.CalculateSpatialElementGeometry(room) # Returns a SpatialElement object
		roomSolid = results.GetGeometry()
	except:
		return  [None], [None], [None]
		
	for roomSolidFace in roomSolid.Faces:
		faces_tmp = []
		elements_tmp = []
		mat_ids_tmp = []
		
		for subface in results.GetBoundaryFaceInfo(roomSolidFace):
			try:
				boundingElementface = subface.GetBoundingElementFace()
				spatialElementface = subface.GetSpatialElementFace()
				subface_geo = subface.GetSubface()		
				
				#try:
				subface_geo_converted = subface_geo.Convert()[0]
				faces_tmp.append(subface_geo_converted)
				#except:
				#	faces_tmp.append(None)
	
				element_id = subface.SpatialBoundaryElement.HostElementId
				element = doc.GetElement(element_id)
				elements_tmp.append(element)
				
				mat_id = boundingElementface.MaterialElementId
				mat_element = doc.GetElement(mat_id)
				mat_ids_tmp.append(mat_element)
					
			#types.append(SubfaceType)
			except:
				pass

		faces_tmp = faces_tmp or [None]
		elements_tmp = elements_tmp or [None]
		mat_ids_tmp = mat_ids_tmp or [None]
		
		faces.extend(faces_tmp)
		elements.extend(elements_tmp)
		mat_ids.extend(mat_ids_tmp)

	return faces, elements, mat_ids

input = to_list(IN[0])

doc = DocumentManager.Instance.CurrentDBDocument

output = [room_query(a) for a in UnwrapElement(input)]

#Assign your output to the OUT variable.
OUT = output
# ----------------------------------------
transpose = List.Transpose(lists=python_script)
code_block = CodeBlock(a=transpose) { a[0]; a[1]; a[2]; }
surfaces = Output(code_block.out0)
elements = Output(code_block.out1)
materials = Output(code_block.out2)
