# Dynamo custom node Room.Level.dyf "Level" (Dynamo 2.0.2.6826)
# category: Antler.Rooms.Query
# Get Room Level

room = Input(room: var[]..[])
python_script = Python(IN[0]=room)
# ---------- python_script.python (45 lines) ----------
# Enable Python support and load DesignScript library
import clr

clr.AddReference('ProtoGeometry')
from Autodesk.DesignScript.Geometry import *

# Import RevitAPI
clr.AddReference("RevitAPI")
from Autodesk.Revit.DB import *

# Import DocumentManager and TransactionManager
clr.AddReference("RevitServices")
import RevitServices
from RevitServices.Persistence import DocumentManager
from RevitServices.Transactions import TransactionManager

# Import ToDSType(bool) extension method
clr.AddReference("RevitNodes")
import Revit
clr.ImportExtensions(Revit.Elements)
clr.ImportExtensions(Revit.GeometryConversion)

#The inputs to this node will be stored as a list in the IN variables.
input = IN[0]

doc = DocumentManager.Instance.CurrentDBDocument
uiapp = DocumentManager.Instance.CurrentUIApplication
app = uiapp.Application

def function(item):
	# Do something with item and get a result
	result = item.Level	

	return result

output = None

# To handle single items or lists..
if isinstance(input, list):
	output = [function(a) for a in UnwrapElement(input)]
else:
	output = function(UnwrapElement(input))

#Assign your output to the OUT variable.
OUT = output
# ----------------------------------------
level = Output(python_script)
