# Dynamo custom node Room.LocationPoint.dyf "LocationPoint" (Dynamo 2.3.0.5885)
# category: Antler.Rooms.Query
# Returns locationpoint of room

room = Input(room: var[]..[])
python_script = Python(IN[0]=room)
# ---------- python_script.python (22 lines) ----------
import clr
clr.AddReference('ProtoGeometry')
from Autodesk.DesignScript.Geometry import *

# Import DocumentManager and TransactionManager
clr.AddReference( "RevitServices")
import RevitServices
from RevitServices.Persistence import DocumentManager
from RevitServices.Transactions import TransactionManager

# Import ToDSType(bool) extension method
clr.AddReference( "RevitNodes")
import Revit
clr.ImportExtensions(Revit.Elements)

#The inputs to this node will be stored as a list in the IN variable.
room = UnwrapElement(IN[0])

output = room.Location.Point

#Assign your output to the OUT variable
OUT = output
# ----------------------------------------
point = Output(python_script)
