# Dynamo custom node RoomCentrePt.dyf (Dynamo 2.0.2.6826)
# category: Antler.Room.Query
# Center point of Room

room = Input(room: var[]..[])
finishBoundary = Room.FinishBoundary(room=room)
startPoint = Curve.StartPoint(curve=finishBoundary)
byPoints = Polygon.ByPoints(points=startPoint)
code_block = CodeBlock { 0; }
getItemAtIndex = List.GetItemAtIndex(list=byPoints@L2, index=code_block)
center = Polygon.Center(polygon=getItemAtIndex)
Point = Output(center)
