# Dynamo custom node Rooms.RoomAtPoint.dyf "RoomAtPoint" (Dynamo 2.3.0.5885)
# category: Antler.Rooms.Query
# Get Room from point. Phase is also a required parameter

pts = Input(pts: var[]..[])
phase = Input(phase: var[]..[])
python_script = Python(IN[0]=pts, IN[1]=phase)
# ---------- python_script.python (65 lines) ----------
# Enable Python support and load DesignScript library
import clr

# Import RevitAPI
clr.AddReference("RevitAPI")
from Autodesk.Revit import DB

# Import ToDSType(bool) extension method
clr.AddReference("RevitNodes")
import Revit
clr.ImportExtensions(Revit.Elements)
clr.ImportExtensions(Revit.GeometryConversion)

# Import DocumentManager and TransactionManager
clr.AddReference ("RevitServices")
import RevitServices
from RevitServices.Persistence import DocumentManager
#from RevitServices.Transactions import TransactionManager

doc = DocumentManager.Instance.CurrentDBDocument



def room_collector(doc=doc, phase_id=None):
    collector = DB.FilteredElementCollector(doc).WhereElementIsNotElementType()
    #collector.OfClass(DB.SpatialElement)
    collector.OfCategory(DB.BuiltInCategory.OST_Rooms)

    if phase_id:
        provider = DB.ParameterValueProvider(DB.ElementId(DB.BuiltInParameter.ROOM_PHASE_ID))
        rule = DB.FilterElementIdRule(provider , DB.FilterNumericEquals(), phase_id)
        parameter_filter = DB.ElementParameterFilter(rule)

        collector.WherePasses(parameter_filter)

    return collector


def room_at_pt(rooms, pt):
    for room in rooms:
        if room.IsPointInRoom(pt):
            return room


def get_rooms_from_pt_list(pts, phase):
    # if not phase:
    #     phase_parameter = view.get_Parameter(DB.BuiltInParameter.VIEW_PHASE)
    #     phase_id = phase_parameter.AsElementId()

    rooms = room_collector(phase_id=phase.Id).ToElements()

    return [room_at_pt(rooms, pt) for pt in pts]


pts = IN[0]
phase = UnwrapElement(IN[1])

xyzs = [pt.ToXyz() for pt in pts]

rooms = get_rooms_from_pt_list(xyzs, phase)



#Assign your output to the OUT variable.
OUT = rooms
# ----------------------------------------
rooms = Output(python_script)
