# Dynamo custom node ScheduleSortGroupFields.dyf (Dynamo 2.0.2.6826)
# category: tholth.ScheduleView
# Grouping and sorting fields in Schedule

view_shedule = Input(view_shedule: var[]..[])
python_script = Python(IN[0]=view_shedule)
# ---------- python_script.python (60 lines) ----------
# Enable Python support and load DesignScript library
import clr

clr.AddReference('ProtoGeometry')
from Autodesk.DesignScript.Geometry import *

# Import RevitAPI
clr.AddReference("RevitAPI")
from Autodesk.Revit.DB import *

# Import DocumentManager and TransactionManager
clr.AddReference("RevitServices")
import RevitServices
from RevitServices.Persistence import DocumentManager
from RevitServices.Transactions import TransactionManager

# Import ToDSType(bool) extension method
clr.AddReference("RevitNodes")
import Revit
clr.ImportExtensions(Revit.Elements)
clr.ImportExtensions(Revit.GeometryConversion)

#The inputs to this node will be stored as a list in the IN variables.
item = IN[0]

doc = DocumentManager.Instance.CurrentDBDocument
uiapp = DocumentManager.Instance.CurrentUIApplication
app = uiapp.Application

def function(item):
	# Do something with item and get a result
	definition = item.Definition
	
	parameters = []
	parameter_ids = []
	field_types = []
	field_names = []
	
	sortgroup_fields = definition.GetSortGroupFields()
	
	for sortgroup_field in sortgroup_fields:
		field_id = sortgroup_field.FieldId 

		field = definition.GetField(field_id)
		parameter_id = field.ParameterId
		
		parameter = doc.GetElement(parameter_id)
		
		field_type = field.FieldType
	
		field_names.append(field.GetName())
		parameter_ids.append(parameter_id)
		field_types.append(field_type)
	
	return field_names, field_types

output = function(UnwrapElement(item))

#Assign your output to the OUT variable.
OUT = output
# ----------------------------------------
code_block = CodeBlock(a=python_script) { a[0]; a[1]; }
parameter_name = Output(code_block.out0)
field_type = Output(code_block.out1)
