# Dynamo custom node ScheduleView.Category Id.dyf "Category Id" (Dynamo 2.0.2.6826)
# category: Antler.ScheduleView.Query
# Category Id of Schedule

view_schedule = Input(view_schedule: var[]..[])
python_script = Python(IN[0]=view_schedule)
# ---------- python_script.python (42 lines) ----------
# Enable Python support and load DesignScript library
import clr

clr.AddReference('ProtoGeometry')
from Autodesk.DesignScript.Geometry import *

# Import RevitAPI
clr.AddReference("RevitAPI")
from Autodesk.Revit.DB import *

# Import DocumentManager and TransactionManager
clr.AddReference("RevitServices")
import RevitServices
from RevitServices.Persistence import DocumentManager
from RevitServices.Transactions import TransactionManager

# Import ToDSType(bool) extension method
clr.AddReference("RevitNodes")
import Revit
clr.ImportExtensions(Revit.Elements)
clr.ImportExtensions(Revit.GeometryConversion)

#The inputs to this node will be stored as a list in the IN variables.
item = IN[0]

doc = DocumentManager.Instance.CurrentDBDocument
uiapp = DocumentManager.Instance.CurrentUIApplication
app = uiapp.Application

def function(item):
	# Do something with item and get a result
	definition = item.Definition
	
	category_id = definition.CategoryId
	category = doc.GetElement(category_id)
	
	return category_id

output = function(UnwrapElement(item))

#Assign your output to the OUT variable.
OUT = output
# ----------------------------------------
category_id = Output(python_script)
