# Dynamo custom node ScheduleView.Elements.dyf (Dynamo 2.0.3.8104)
# category: tholth.ScheduleView
# All Elements in Schedule, including Elements from Links.

view = Input(view: var[]..[])
python_script = Python(IN[0]=view)
# ---------- python_script.python (53 lines) ----------
# Enable Python support and load DesignScript library
import clr

clr.AddReference('ProtoGeometry')
from Autodesk.DesignScript.Geometry import *

# Import RevitAPI
clr.AddReference("RevitAPI")
from Autodesk.Revit.DB import *

# Import DocumentManager and TransactionManager
clr.AddReference("RevitServices")
import RevitServices
from RevitServices.Persistence import DocumentManager
from RevitServices.Transactions import TransactionManager

# Import ToDSType(bool) extension method
clr.AddReference("RevitNodes")
import Revit
clr.ImportExtensions(Revit.Elements)
clr.ImportExtensions(Revit.GeometryConversion)

#The inputs to this node will be stored as a list in the IN variables.
item = IN[0]

doc = DocumentManager.Instance.CurrentDBDocument
uiapp = DocumentManager.Instance.CurrentUIApplication
app = uiapp.Application

def function(schedule):
	# Source: https://stackoverflow.com/questions/51620590/get-linked-elements-that-appear-on-schedule-revit-api

	scheduledElements = list(FilteredElementCollector(doc, schedule.Id))
	
	
	# Extra function to get linked elements as well
	allElements = []
	
	for element in scheduledElements:
	    if element.Category.Name == 'RVT Links':
	        linkedElements = list(FilteredElementCollector(element.GetLinkDocument(), schedule.Id))
	        for linkedElement in linkedElements:
	            allElements.Add(linkedElement)
	    else:
	        allElements.Add(element)
	

	return allElements

output = function(UnwrapElement(item))

#Assign your output to the OUT variable.
OUT = output
# ----------------------------------------
elements = Output(python_script)
