# Dynamo custom node ScheduleView.ElementsandParameters.dyf (Dynamo 2.0.3.8104)
# category: tholth.ScheduleView

view_shedule = Input(view_shedule: var[]..[])
isItemized = Custom[ScheduleView.IsItemized](view_schedule=view_shedule)  # Returns True if "Itemize every instance" is turned on.
elements = Custom[ScheduleView.Elements](view=view_shedule)  # All Elements in Schedule, including Elements from Links.
elements_2 = Output(elements)  # "elements"
category = Custom[ScheduleView.Category](view_schedule=view_shedule)  # Category of Schedule View
category_2 = Output(category)  # "category"
scheduleSortGroupFields = Custom[ScheduleSortGroupFields](view_shedule=view_shedule)  # Grouping and sorting fields in Schedule
string_from_object = FromObject(obj=scheduleSortGroupFields.field_type)
str = Output(string_from_object)
string_from_object_2 = FromObject(obj=scheduleSortGroupFields.parameter_name)
str_2 = Output(string_from_object_2)  # "str"
code_block = CodeBlock { "Instance"; }
allIndicesOf = List.AllIndicesOf(list=string_from_object, item=code_block)
getItemAtIndex = List.GetItemAtIndex(list=string_from_object_2, index=allIndicesOf)
getParameterValueByName = Element.GetParameterValueByName(element=elements, parameterName=getItemAtIndex, lacing=CrossProduct)
transpose = List.Transpose(lists=getParameterValueByName)
type = archilab.Revit.Elements.Elements.Type(element=elements)
code_block_2 = CodeBlock { "ElementType"; }
allIndicesOf_2 = List.AllIndicesOf(list=string_from_object, item=code_block_2)
getItemAtIndex_2 = List.GetItemAtIndex(list=string_from_object_2, index=allIndicesOf_2)
getParameterValueByName_2 = Element.GetParameterValueByName(element=type, parameterName=getItemAtIndex_2, lacing=CrossProduct)
transpose_2 = List.Transpose(lists=getParameterValueByName_2)
join = List.Join(list0=transpose, list1=transpose_2)
transpose_3 = List.Transpose(lists=join)
join_2 = List.Join(list0=allIndicesOf, list1=allIndicesOf_2)
code_block_3 = CodeBlock(t=join_2) { a = 0..List.Count(t)-1; sorted = List.SortByKey(a, t); DesignScript.Dictionary.ValueAtKey(sorted, "sorted list"); }
reorder = List.Reorder(list=transpose_3@L2, indices=code_block_3.out2)
parametervalues = Output(reorder)
