# Dynamo custom node ScheduleView.GetFieldParameters.dyf (Dynamo 2.0.3.8104)
# category: tholth.ScheduleView

element = Input(element: var[]..[])
parameter = Input(parameter: var[]..[])
field_type = Input(field_type: var[]..[])
code_block = CodeBlock { "Instance"; }
allIndicesOf = List.AllIndicesOf(list=field_type, item=code_block)
getItemAtIndex = List.GetItemAtIndex(list=parameter, index=allIndicesOf)
getParameterValueByName = Element.GetParameterValueByName(element=element, parameterName=getItemAtIndex, lacing=CrossProduct)
transpose = List.Transpose(lists=getParameterValueByName)
type = archilab.Revit.Elements.Elements.Type(element=element)
code_block_2 = CodeBlock { "ElementType"; }
allIndicesOf_2 = List.AllIndicesOf(list=field_type, item=code_block_2)
getItemAtIndex_2 = List.GetItemAtIndex(list=parameter, index=allIndicesOf_2)
getParameterValueByName_2 = Element.GetParameterValueByName(element=type, parameterName=getItemAtIndex_2, lacing=CrossProduct)
transpose_2 = List.Transpose(lists=getParameterValueByName_2)
join = List.Join(list0=transpose, list1=transpose_2)
transpose_3 = List.Transpose(lists=join)
join_2 = List.Join(list0=allIndicesOf, list1=allIndicesOf_2)
code_block_3 = CodeBlock(t=join_2) { a = 0..List.Count(t)-1; sorted = List.SortByKey(a, t); DesignScript.Dictionary.ValueAtKey(sorted, "sorted list"); }
reorder = List.Reorder(list=transpose_3@L2, indices=code_block_3.out2)
values = Output(reorder)
watch = Watch(transpose_3)
