# Dynamo custom node ScheduleView.IsItemized.dyf (Dynamo 2.0.3.8104)
# category: Antler.ScheduleView
# Returns True if "Itemize every instance" is turned on.

view_schedule = Input(view_schedule: var[]..[])
python_script = Python(IN[0]=view_schedule)
# ---------- python_script.python (41 lines) ----------
# Enable Python support and load DesignScript library
import clr

clr.AddReference('ProtoGeometry')
from Autodesk.DesignScript.Geometry import *

# Import RevitAPI
clr.AddReference("RevitAPI")
from Autodesk.Revit.DB import *

# Import DocumentManager and TransactionManager
clr.AddReference("RevitServices")
import RevitServices
from RevitServices.Persistence import DocumentManager
from RevitServices.Transactions import TransactionManager

# Import ToDSType(bool) extension method
clr.AddReference("RevitNodes")
import Revit
clr.ImportExtensions(Revit.Elements)
clr.ImportExtensions(Revit.GeometryConversion)

#The inputs to this node will be stored as a list in the IN variables.
item = IN[0]

doc = DocumentManager.Instance.CurrentDBDocument
uiapp = DocumentManager.Instance.CurrentUIApplication
app = uiapp.Application

def function(item):
	# Do something with item and get a result
	definition = item.Definition
	

	
	return definition.IsItemized

output = function(UnwrapElement(item))

#Assign your output to the OUT variable.
OUT = output
# ----------------------------------------
boolean = Output(python_script)
