# Dynamo custom node ScopeBox.Query.dyf (Dynamo 2.3.0.5885)
# category: Antler.ScopeBox.Query

scope_box = Input(scope_box: var[]..[])
geometry = Element.Geometry(element=scope_box)
code_block = CodeBlock { 0; }
getItemAtIndex = List.GetItemAtIndex(list=geometry, index=code_block)
length = Curve.Length(curve=getItemAtIndex)
endPoint = Curve.EndPoint()  # unwired: curve
startPoint = Curve.StartPoint()  # unwired: curve
code_block_2 = CodeBlock { 8; }
getItemAtIndex_2 = List.GetItemAtIndex(list=geometry, index=code_block_2)
length_2 = Curve.Length(curve=getItemAtIndex_2)
endPoint_2 = Curve.EndPoint()  # unwired: curve
startPoint_2 = Curve.StartPoint()  # unwired: curve
endPoint_3 = Curve.EndPoint()  # unwired: curve
code_block_3 = CodeBlock { 6; }
getItemAtIndex_3 = List.GetItemAtIndex(list=geometry, index=code_block_3)
startPoint_3 = Curve.StartPoint(curve=getItemAtIndex_3)
length_3 = Curve.Length(curve=getItemAtIndex_3)
code_block_4 = CodeBlock { [3,4,6,8]; }
getItemAtIndex_4 = List.GetItemAtIndex(list=geometry, index=code_block_4)
direction = Line.Direction(line=getItemAtIndex_3)
yDirection = Output(direction)
direction_2 = Line.Direction(line=getItemAtIndex_2)
reverse = Vector.Reverse(vector=direction_2)
xDirection = Output(reverse)
direction_3 = Line.Direction(line=getItemAtIndex)
zDirection = Output(direction_3)
startPoint_4 = Curve.StartPoint(curve=geometry)
endPoint_4 = Curve.EndPoint(curve=geometry)
create = List.Create(item0=startPoint_4, item1=endPoint_4)
flatten = List.Flatten(list=create)
python_script = Python(IN[0]=flatten)
# ---------- python_script.python (46 lines) ----------
import clr

clr.AddReference('ProtoGeometry')
from Autodesk.DesignScript.Geometry import *

# Import RevitAPI
clr.AddReference( "RevitAPI")
import Autodesk

clr.AddReference("RevitNodes")
import Revit

# Import ToProtoType, ToRevitType geometry conversion extension methods
clr.ImportExtensions(Revit.GeometryConversion)

# Import Element wrapper extension methods
clr.ImportExtensions(Revit.Elements)

# Converts input to XYZ
def convertToXYZ(a):
	if type(a) == Autodesk.Revit.DB.XYZ:
		return a
	else:
		return a.ToXyz()
		
def AveragePt(ptList):
	xCoords = [a.X for a in ptList]
	yCoords = [a.Y for a in ptList]
	zCoords = [a.Z for a in ptList]
	
	xAverage = sum(xCoords)/float(len(xCoords))
	yAverage = sum(yCoords)/float(len(yCoords))
	zAverage = sum(zCoords)/float(len(zCoords))
	
	newPt = Autodesk.Revit.DB.XYZ(xAverage, yAverage, zAverage)
	
	return newPt

# Inputs
inPts = [convertToXYZ(i) for i in IN[0]]

averageXYZ = AveragePt(inPts)
averagePt = averageXYZ.ToPoint()

#Assign your output to the OUT variable
OUT = averagePt
# ----------------------------------------
centerPt = Output(python_script)
