# Dynamo custom node Set Crop Box.dyf (Dynamo 2.0.2.6826)
# category: Antler.Views
# Sets crop box of view.

view = Input(view: var[]..[])
boundingbox = Input(boundingbox: var[]..[])
python_script = Python(IN[0]=view, IN[1]=boundingbox)
# ---------- python_script.python (66 lines) ----------
# Enable Python support and load DesignScript library
import clr

clr.AddReference('ProtoGeometry')
from Autodesk.DesignScript.Geometry import *

# Import RevitAPI
clr.AddReference("RevitAPI")
from Autodesk.Revit.DB import *

# Import DocumentManager and TransactionManager
clr.AddReference("RevitServices")
import RevitServices
from RevitServices.Persistence import DocumentManager
from RevitServices.Transactions import TransactionManager

clr.AddReference('RevitNodes')
import Revit
clr.ImportExtensions(Revit.GeometryConversion)
clr.ImportExtensions(Revit.Elements)

#The inputs to this node will be stored as a list in the IN variables.
view = IN[0]
bbox = IN[1]

doc = DocumentManager.Instance.CurrentDBDocument
uiapp = DocumentManager.Instance.CurrentUIApplication
app = uiapp.Application


def set_crop_box(view, bbox):
	"""
	"""
	view.CropBox = bbox
	
	return view

def ds_bbox_to_bbox_xyz(ds_bbox):
	xyz_min = ds_bbox.MinPoint.ToXyz()
	xyz_max = ds_bbox.MaxPoint.ToXyz()
	
	r_bbox = BoundingBoxXYZ()
	r_bbox.Min = xyz_min
	r_bbox.Max = xyz_max
	
	return r_bbox
	
bbox = ds_bbox_to_bbox_xyz(bbox)

# Start Transaction
TransactionManager.Instance.EnsureInTransaction(doc)

# Transaction
#view = set_crop_box(UnwrapElement(view), UnwrapElement(bbox))

view = UnwrapElement(view)

view = set_crop_box(view, bbox)


# End Transaction
TransactionManager.Instance.TransactionTaskDone()


#Assign your output to the OUT variable.
OUT = view
# ----------------------------------------
view_2 = Output(python_script)  # "view"
