# Dynamo custom node SetElementCutPatternColorInView.dyf (Dynamo 2.3.0.5885)
# category: Antler.View
# SetElementProjectionLineColorInView

element = Input(element: var[]..[])
color = Input(color: var[]..[])
python_script = Python(IN[0]=element, IN[1]=color)
# ---------- python_script.python (45 lines) ----------
import clr
clr.AddReference('ProtoGeometry')
from Autodesk.DesignScript.Geometry import *

# Import DocumentManager and TransactionManager
clr.AddReference ("RevitServices")
import RevitServices
from RevitServices.Persistence import DocumentManager
from RevitServices.Transactions import TransactionManager

# Import RevitAPI
clr.AddReference ("RevitAPI")
import Autodesk

item = UnwrapElement(IN[0])

curDoc = DocumentManager.Instance.CurrentDBDocument

#deconstruct DS Color Object and convert to RevitAPI color
dsColor = IN[1]
colRed = dsColor.Red
colGreen = dsColor.Green
colBlue = dsColor.Blue
color = Autodesk.Revit.DB.Color(colRed, colGreen, colBlue)

#create graphic overrides properties
gSettings = Autodesk.Revit.DB.OverrideGraphicSettings()

fillPatTarget = Autodesk.Revit.DB.FillPatternTarget()
fillPat = Autodesk.Revit.DB.FillPatternElement.GetFillPatternElementByName(curDoc, fillPatTarget, 'Solid fill')
gSettings.SetCutFillPatternId(fillPat.Id)
gSettings.SetCutFillColor(color)



# Start Transaction
TransactionManager.Instance.EnsureInTransaction(curDoc)

curDoc.ActiveView.SetElementOverrides(item.Id, gSettings)

# End Transaction
TransactionManager.Instance.TransactionTaskDone()

#Assign your output to the OUT variable
OUT = 0
# ----------------------------------------
element_2 = Output(python_script)  # "element"
