# Dynamo custom node SetElementProjectionLineColorInView.dyf (Dynamo 2.3.0.5885)
# category: Antler.View
# SetElementProjectionLineColorInView

element = Input(element: var[]..[])
color = Input(color: var[]..[])
python_script = Python(IN[0]=element, IN[1]=color)
# ---------- python_script.python (41 lines) ----------
import clr
clr.AddReference('ProtoGeometry')
from Autodesk.DesignScript.Geometry import *

# Import DocumentManager and TransactionManager
clr.AddReference ("RevitServices")
import RevitServices
from RevitServices.Persistence import DocumentManager
from RevitServices.Transactions import TransactionManager

# Import RevitAPI
clr.AddReference ("RevitAPI")
import Autodesk

item = UnwrapElement(IN[0])

#deconstruct DS Color Object and convert to RevitAPI color
dsColor = IN[1]
colRed = dsColor.Red
colGreen = dsColor.Green
colBlue = dsColor.Blue
color = Autodesk.Revit.DB.Color(colRed, colGreen, colBlue)

#create graphic overrides properties
gSettings = Autodesk.Revit.DB.OverrideGraphicSettings()

gSettings.SetProjectionLineColor(color)


curDoc = DocumentManager.Instance.CurrentDBDocument

# Start Transaction
TransactionManager.Instance.EnsureInTransaction(curDoc)

curDoc.ActiveView.SetElementOverrides(item.Id, gSettings)

# End Transaction
TransactionManager.Instance.TransactionTaskDone()

#Assign your output to the OUT variable
OUT = 0
# ----------------------------------------
OUT = Output(python_script)
