# Dynamo custom node SetIntersection ex.dyf (Dynamo 2.0.2.6826)
# category: Antler.Util
# Same as List.SetIntersection, but returns two lists. One for each incoming list. Good for comparing Elements.

list1 = Input(list1: var[]..[])
list2 = Input(list2: var[]..[])
python_script = Python(IN[0]=list1, IN[1]=list2)
# ---------- python_script.python (4 lines) ----------
a_in_b = [a for a in IN[0] if a in IN[1]]
b_in_a = [b for b in IN[1] if b in IN[0]]

OUT = a_in_b, b_in_a
# ----------------------------------------
code_block = CodeBlock(t=python_script) { t[0]; t[1]; }
intersection1 = Output(code_block.out0)
intersection2 = Output(code_block.out1)
