# Dynamo custom node Sheets.Create Placeholder Sheet.dyf "Create Placeholder Sheet" (Dynamo 2.3.0.5885)
# category: Antler.Sheets
# Creates placeholder sheet from number and optional name. Returns newly created sheets.

number = Input(number: var[]..[])
name = Input(name: string[] = null)
python_create_placeholder_sheets = Python(IN[0]=number, IN[1]=name)
# ---------- python_create_placeholder_sheets.python (75 lines) ----------
# encoding: utf-8

# Enable Python support and load DesignScript library
import clr

clr.AddReference('ProtoGeometry')
from Autodesk.DesignScript.Geometry import *

# Import RevitAPI
clr.AddReference("RevitAPI")
from Autodesk.Revit.DB import *

# Import DocumentManager and TransactionManager
clr.AddReference("RevitServices")
import RevitServices
from RevitServices.Persistence import DocumentManager
from RevitServices.Transactions import TransactionManager

# Import ToDSType(bool) extension method
clr.AddReference("RevitNodes")
import Revit
clr.ImportExtensions(Revit.Elements)
clr.ImportExtensions(Revit.GeometryConversion)

import itertools

#The inputs to this node will be stored as a list in the IN variables.
numbers = IN[0]
names = IN[1]

doc = DocumentManager.Instance.CurrentDBDocument
uiapp = DocumentManager.Instance.CurrentUIApplication
app = uiapp.Application

def to_list(item):
	if isinstance(item, list):
		return item
	else:
		return [item]

# Collect Sheet Numbers to prevent the script from creating placeholder sheets if number is already in model.
sheets_collected = FilteredElementCollector(doc).OfClass(ViewSheet).WhereElementIsNotElementType().ToElements()
sheet_numbers = [sheet.SheetNumber for sheet in sheets_collected]


def function(number, name=None):
	# Do something with item and get a result
	if number not in sheet_numbers:
		sheet = ViewSheet.CreatePlaceholder(doc)
		sheet.SheetNumber = number
		
		if name:
			sheet.Name = name
		
		sheet_numbers.append(number)
		
		return sheet
		
	else:
		return None



if numbers:
	numbers = to_list(numbers)
	names = to_list(names)
	
	TransactionManager.Instance.EnsureInTransaction(doc)
	
	sheets = [function(unicode(number), unicode(name)) for number, name in itertools.izip_longest(numbers, names)]
	
	TransactionManager.Instance.TransactionTaskDone()

	#Assign your output to the OUT variable.
	OUT = sheets
# ----------------------------------------
sheet = Output(python_create_placeholder_sheets)
