# Dynamo custom node SortListFromIndices.dyf (Dynamo 2.3.0.5885)
# category: Antler.List.Sort

list = Input(list: var[]..[])
indices = Input(indices: var[]..[])
python_script = Python(IN[0]=list, IN[1]=indices)
# ---------- python_script.python (11 lines) ----------
import clr
clr.AddReference('ProtoGeometry')
from Autodesk.DesignScript.Geometry import *
#The inputs to this node will be stored as a list in the IN variable.
listToSort = IN[0]
indices = IN[1]

output = [listToSort[a] for a in indices]

#Assign your output to the OUT variable
OUT = output
# ----------------------------------------
sortedList = Output(python_script)
