# Dynamo custom node String.BestMatches.dyf (Dynamo 2.0.2.6826)
# category: tholth.String
# Returns best matches from string list of given word. Uses the Python difflib library for comparing sequenses.

possibilites = Input(possibilites: var[]..[])  # List of strings to fint best matches in
word = Input(word: var[]..[])  # String to search with
n = Input(n: int = 3)  # Maximum number of matches
cutoff = Input(cutoff: double = 0.6)  # Match ratio minimum cutoff value
python_script = Python(IN[0]=possibilites, IN[1]=word, IN[2]=n, IN[3]=cutoff)
# ---------- python_script.python (21 lines) ----------
# Enable Python support and load DesignScript library
import clr
clr.AddReference('ProtoGeometry')
from Autodesk.DesignScript.Geometry import *

import sys
path = r"C:\Program Files (x86)\IronPython 2.7\Lib"
if not path in sys.path: sys.path.append(path)
import difflib

# The inputs to this node will be stored as a list in the IN variables.
possibilites = IN[0]
word = IN[1]
n = IN[2]
cutoff = IN[3]

# Place your code below this line
close_matches = difflib.get_close_matches(word, possibilites, n=n, cutoff=cutoff)

# Assign your output to the OUT variable.
OUT = close_matches
# ----------------------------------------
best_matches = Output(python_script)  # List of best matches from possibilities
