# Dynamo custom node StringFormat.dyf (Dynamo 2.0.3.8104)
# category: Antler.String
# Format string with Python string format

str = Input(str: var[]..[])
format = Input(format: var[]..[])
python_script = Python(IN[0]=str, IN[1]=format)
# ---------- python_script.python (47 lines) ----------
# Enable Python support and load DesignScript library
import clr

clr.AddReference('ProtoGeometry')
from Autodesk.DesignScript.Geometry import *

# Import RevitAPI
clr.AddReference("RevitAPI")
from Autodesk.Revit.DB import *

# Import DocumentManager and TransactionManager
clr.AddReference("RevitServices")
import RevitServices
from RevitServices.Persistence import DocumentManager
from RevitServices.Transactions import TransactionManager

# Import ToDSType(bool) extension method
clr.AddReference("RevitNodes")
import Revit
clr.ImportExtensions(Revit.Elements)
clr.ImportExtensions(Revit.GeometryConversion)

#The inputs to this node will be stored as a list in the IN variables.
input = IN[0]
format_string = IN[1]

doc = DocumentManager.Instance.CurrentDBDocument
uiapp = DocumentManager.Instance.CurrentUIApplication
app = uiapp.Application

def function(item, format):
	# Do something with item and get a result
	try:
		result = format.format(item)
	except:
		result = None
	return result
output = None

# To handle single items or lists..
if isinstance(input, list):
	output = [function(a, format_string) for a in input]
else:
	output = function(input, format_string)

#Assign your output to the OUT variable.
OUT = output
# ----------------------------------------
string = Output(python_script)
