# Dynamo custom node SymbolFaces.dyf "FamilyInstance.SymbolGeometry" (Dynamo 2.3.0.5885)
# category: Antler.FamilyInstance
# Gets symbol geometry as solid and faces with materials

family_instance = Input(family_instance: var[]..[])
symbol_geomtry = Python(IN[0]=family_instance)
# ---------- symbol_geomtry.python (79 lines) ----------
import clr

clr.AddReference('ProtoGeometry')
from Autodesk.DesignScript.Geometry import *

# Import RevitAPI
clr.AddReference("RevitAPI")
import Autodesk
from Autodesk.Revit.DB import *

# Import DocumentManager and TransactionManager
clr.AddReference("RevitServices")
import RevitServices
from RevitServices.Persistence import DocumentManager
from RevitServices.Transactions import TransactionManager

# Import ToDSType(bool) extension method
clr.AddReference("RevitNodes")
import Revit
clr.ImportExtensions(Revit.Elements)
clr.ImportExtensions(Revit.GeometryConversion)

# Import Revit UI
clr.AddReference('RevitAPIUI')
from Autodesk.Revit.UI import *
#from Autodesk.Revit.UI.Selection import *

from Autodesk.DesignScript.Geometry import *

#The inputs to this node will be stored as a list in the IN variables.
input = IN[0]

doc = DocumentManager.Instance.CurrentDBDocument
uiapp = DocumentManager.Instance.CurrentUIApplication
app = uiapp.Application

def get_family_instance_faces(family_instance, options=DB.Options()):
	faces = []
	# material_ids = []

	for geometry_element in family_instance.get_Geometry(options):

		geometry_element_faces = []
		# geometry_element_material_ids = []

		for geometry in geometry_element.GetSymbolGeometry():
			if isinstance(geometry, Autodesk.Revit.DB.Solid):
				# face_materials_ids = []
				# faces = []
				geometry_element_faces.append(geometry.Faces)

				# for face in geometry.Faces:
				# 	faces.append(face)
					# face_materials_ids.append(face.MaterialElementId)

				# geometry_element_faces.append(faces)
				# geometry_element_material_ids.append(face_materials_ids)

			# geometry_element_faces.append(solid_faces)
			# geometry_element_material_ids.append(solid_face_material_ids)

		faces.append(geometry_element_faces)
		# material_ids.append(geometry_element_material_ids)

	return faces


output = None

if isinstance(input, list):
    output = [function(a) for a in UnwrapElement(input)]
elif input is None:
	output = None
else:
    output = function(UnwrapElement(input))


#Assign your output to the OUT variable.
OUT = output
# ----------------------------------------
transpose = List.Transpose(lists=symbol_geomtry)
code_block = CodeBlock(a=transpose) { a[0]; a[1]; a[2]; }
solids = Output(code_block.out0)
materials = Output(code_block.out1)
coordinate_systems = Output(code_block.out2)
