# Dynamo custom node SymbolGeometry.dyf (Dynamo 2.3.0.5885)
# category: antler.FamilyInstance
# The geometric representation of the symbol which generates this instance.

family_instance = Input(family_instance: var[]..[])
view = Input(view: Revit.Elements.Views.View = null)
symbol_geomtry = Python(IN[0]=family_instance, IN[1]=view)
# ---------- symbol_geomtry.python (92 lines) ----------
import clr

clr.AddReference('ProtoGeometry')
from Autodesk.DesignScript.Geometry import *

# Import RevitAPI
clr.AddReference("RevitAPI")
import Autodesk
from Autodesk.Revit.DB import *

# Import DocumentManager and TransactionManager
clr.AddReference("RevitServices")
import RevitServices
from RevitServices.Persistence import DocumentManager
from RevitServices.Transactions import TransactionManager

# Import ToDSType(bool) extension method
clr.AddReference("RevitNodes")
import Revit
clr.ImportExtensions(Revit.Elements)
clr.ImportExtensions(Revit.GeometryConversion)

# Import Revit UI
clr.AddReference('RevitAPIUI')
from Autodesk.Revit.UI import *
#from Autodesk.Revit.UI.Selection import *

from Autodesk.DesignScript.Geometry import *

#The inputs to this node will be stored as a list in the IN variables.
input = IN[0]
view = UnwrapElement(IN[1])

doc = DocumentManager.Instance.CurrentDBDocument
uiapp = DocumentManager.Instance.CurrentUIApplication
app = uiapp.Application

options = Options()

if view:
	options.View = view

def function(element):
	geometry_instance = element.get_Geometry(options)
	
	transform = element.GetTransform()
	
	#symbol_geometry = element.GetSymbolGeometry()
	
	geometry = []
	
	for geo in geometry_instance:
		symbol_geo = geo.GetSymbolGeometry()
		
		geometry.append(symbol_geo)

	coordinate_system = transform2coordinatesystem(transform)
		
	return {
		"Geometry": geometry,
		"CoordinateSystem": coordinate_system
		}

def transform2coordinatesystem(transform):
	origin = transform.Origin
	origin_pt = Autodesk.DesignScript.Geometry.Point.ByCoordinates(origin.X, origin.Y, origin.Z)
	
	basisX = transform.BasisX
	vectorX = Vector.ByCoordinates(basisX.X,basisX.Y,basisX.Z)
	
	basisY = transform.BasisY
	vectorY = Vector.ByCoordinates(basisY.X,basisY.Y,basisY.Z)	
	
	basisZ = transform.BasisZ
	vectorZ = Vector.ByCoordinates(basisZ.X,basisZ.Y,basisZ.Z)		
	
	coordinate_system = CoordinateSystem.ByOriginVectors(origin_pt, vectorX, vectorY, vectorZ)
	
	return coordinate_system

output = None

if isinstance(input, list):
    output = [function(a) for a in UnwrapElement(input)]
elif input is None:
	output = None
else:
    output = function(UnwrapElement(input))


#Assign your output to the OUT variable.
OUT = output
# ----------------------------------------
code_block = CodeBlock { "Geometry"; }
valueAtKey = DesignScript.Builtin.Dictionary.ValueAtKey(dictionary=symbol_geomtry, key=code_block)
toprototype = Python(IN[0]=valueAtKey)
# ---------- toprototype.python (25 lines) ----------
# Enable Python support and load DesignScript library
import clr

# Import RevitAPI
clr.AddReference("RevitAPI")
from Autodesk.Revit import DB

# Import ToDSType(bool) extension method
clr.AddReference("RevitNodes")
import Revit
clr.ImportExtensions(Revit.Elements)
clr.ImportExtensions(Revit.GeometryConversion)

#The inputs to this node will be stored as a list in the IN variable.
elements = IN[0]

def function(element):
	if isinstance(element, (list, tuple)):
		return [function(e) for e in element]
	else:
		# Code follows here:
		
		return element.ToProtoType()

OUT = function(elements)
# ----------------------------------------
geometry = Output(toprototype)
watch = Watch(symbol_geomtry)
code_block_2 = CodeBlock { "CoordinateSystem"; }
valueAtKey_2 = DesignScript.Builtin.Dictionary.ValueAtKey(dictionary=symbol_geomtry, key=code_block_2)
coordinate_system = Output(valueAtKey_2)
