# Dynamo custom node TEST 160817-151102.dyf (Dynamo 2.3.0.5885)
# category: tholth.Test

a = Input(a: var[]..[])
b = Input(b: var[]..[])
c = Input(c: var[]..[])
code_block = CodeBlock(a=a, b=b, c=c) { a+b+c; }
python_script = Python(IN[0]=a, IN[1]=b, IN[2]=c)
# ---------- python_script.python (5 lines) ----------
a = IN[0]
b = IN[1]
c = IN[2]

OUT = a + b + c
# ----------------------------------------
out = Output(python_script)
