# Dynamo custom node Time.dyf (Dynamo 2.3.0.5885)
# category: tholth.Time
# Outputs the input and a time decimal

data = Input(data: var[]..[])
python_script = Python(IN[0]=data)
# ---------- python_script.python (5 lines) ----------
import time

time = time.time()

OUT = IN[0], time
# ----------------------------------------
code_block = CodeBlock(a=python_script) { a[0]; a[1]; }
data_2 = Output(code_block.out0)  # "data"
time = Output(code_block.out1)
