# Dynamo custom node Transforms.dyf (Dynamo 2.3.0.5885)
# category: Antler.PointCloudInstance
# Get transforms of Point Cloud Instance, both Transform and Total Transform.

element = Input(element: var[]..[])
python_script = Python(IN[0]=element)
# ---------- python_script.python (27 lines) ----------
# Enable Python support and load DesignScript library
import clr

# Import RevitAPI
clr.AddReference("RevitAPI")
from Autodesk.Revit import DB

# Import ToDSType(bool) extension method
clr.AddReference("RevitNodes")
import Revit
clr.ImportExtensions(Revit.Elements)
clr.ImportExtensions(Revit.GeometryConversion)

#The inputs to this node will be stored as a list in the IN variable.
elements = IN[0]

def function(element):
	if isinstance(element, (list, tuple)):
		return [function(e) for e in element]
	else:
		# Code follows here:
		element = UnwrapElement(element)
		
		
		return {'Transform': element.GetTransform().ToCoordinateSystem(), 'TotalTransform': element.GetTotalTransform().ToCoordinateSystem()}
		
OUT = function(elements)
# ----------------------------------------
code_block = CodeBlock { "Transform"; "TotalTransform"; }
valueAtKey = DesignScript.Builtin.Dictionary.ValueAtKey(dictionary=python_script, key=code_block.out0)
transform = Output(valueAtKey)
valueAtKey_2 = DesignScript.Builtin.Dictionary.ValueAtKey(dictionary=python_script, key=code_block.out1)
watch = Watch(valueAtKey_2)
total_transform = Output(valueAtKey_2)
