# Dynamo custom node Tuple.IndexOf.dyf (Dynamo 2.0.3.8104)
# category: Antler.List

tuples = Input(tuples: var[]..[])
tuple = Input(tuple: var[]..[])
python_script = Python(IN[0]=tuples, IN[1]=tuple)
# ---------- python_script.python (24 lines) ----------
# Enable Python support and load DesignScript library
import clr
clr.AddReference('ProtoGeometry')
from Autodesk.DesignScript.Geometry import *

# The inputs to this node will be stored as a list in the IN variables.
a_list = IN[0]
b_list = IN[1]

# Place your code below this line
a_tuples = [tuple(a) for a in a_list]
b_tuples = [tuple(b) for b in b_list]

indices = []

for b in b_tuples:
	if b in a_tuples:
		indices.append(a_tuples.index(b))
	else:
		indices.append(None)


# Assign your output to the OUT variable.
OUT = indices
# ----------------------------------------
index = Output(python_script)
