# Dynamo custom node Tuples.Diff.dyf (Dynamo 2.0.3.8104)
# category: tholth.List

tuples_a = Input(tuples_a: var[]..[])
tuples_b = Input(tuples_b: var[]..[])
python_script = Python(IN[0]=tuples_a, IN[1]=tuples_b)
# ---------- python_script.python (17 lines) ----------
# Enable Python support and load DesignScript library
import clr
clr.AddReference('ProtoGeometry')
from Autodesk.DesignScript.Geometry import *

# The inputs to this node will be stored as a list in the IN variables.
list_set_a = IN[0]
list_set_b = IN[1]

# Place your code below this line
list_set_a = set([tuple(a) for a in list_set_a])
list_set_b = set([tuple(a) for a in list_set_b])



# Assign your output to the OUT variable.
OUT = list(list_set_a.difference(list_set_b))
# ----------------------------------------
tuples_diff = Output(python_script)
