# Dynamo custom node Tuples.Unique.dyf "Unique Lists" (Dynamo 2.0.3.8104)
# category: tholth.List
# Returns unique lists and indices of lists in input list of lists.

lists = Input(lists: var[]..[])
python_script = Python(IN[0]=lists)
# ---------- python_script.python (26 lines) ----------
# Enable Python support and load DesignScript library
import clr
clr.AddReference('ProtoGeometry')
from Autodesk.DesignScript.Geometry import *

# The inputs to this node will be stored as a list in the IN variables.
values = IN[0]

count_dict = {}

# Place your code below this line

for i, value in enumerate(values):
	if value is None:
		continue
		
	if not isinstance(value, basestring):
		value = tuple(value)

	if value not in count_dict.keys():
		count_dict[value] = [i]
	else:
		count_dict[value].append(i)

# Assign your output to the OUT variable.
OUT = count_dict.items()
# ----------------------------------------
transpose = List.Transpose(lists=python_script)
code_block = CodeBlock(a=transpose) { a[0]; a[1]; }
list = Output(code_block.out0)
indices = Output(code_block.out1)
