# Dynamo custom node TwoDimensionalArray.dyf (Dynamo 2.3.0.5885)
# category: Antler

a = Input(a: var[]..[])
b = Input(b: var[]..[])
python_script = Python(IN[0]=a, IN[1]=b)
# ---------- python_script.python (14 lines) ----------
A = IN[0]
B = IN[1]

# Place your code below this line


output = [[(a, b) for b in B] for a in A]


	
	

# Assign your output to the OUT variable.
OUT = output
# ----------------------------------------
array = Output(python_script)
