# Dynamo custom node Util.Append numbering.dyf "Append numbering" (Dynamo 2.0.2.6826)
# category: Antler.Utils.Numbering
# Numbering by appending an amount of numbers to existing numbers.

existing = Input(existing: var[]..[])
count = Input(count: int)
python_script = Python(IN[0]=existing, IN[1]=count)
# ---------- python_script.python (13 lines) ----------
# The inputs to this node will be stored as a list in the IN variables.
existing_numbers = IN[0]
count = IN[1]

try:
	last = int(sorted(existing_numbers)[-1])
except:
	last = 0

new_numbers = range(last + 1, last + count + 1)

# Assign your output to the OUT variable.
OUT = new_numbers
# ----------------------------------------
int = Output(python_script)
