# Dynamo custom node Util.Convert to Integer.dyf "Convert to Integer" (Dynamo 2.3.0.5885)
# category: Antler.Util

number = Input(number: var[]..[])
python_script = Python(IN[0]=number)
# ---------- python_script.python (8 lines) ----------
import clr
clr.AddReference('ProtoGeometry')
from Autodesk.DesignScript.Geometry import *
#The inputs to this node will be stored as a list in the IN variable.
inFloat = IN[0]

#Assign your output to the OUT variable
OUT = int(inFloat)
# ----------------------------------------
integer = Output(python_script)
