# Dynamo custom node Vector Angle On Plane.dyf (Dynamo 2.3.0.5885)
# category: tholth.Vector

a = Input(a: var[]..[])
b = Input(b: var[]..[])
plane = Input(plane: var[]..[])
python_script = Python(IN[0]=a, IN[1]=b, IN[2]=plane)
# ---------- python_script.python (35 lines) ----------
import clr

clr.AddReference('ProtoGeometry')
from Autodesk.DesignScript.Geometry import *

# Import RevitAPI
clr.AddReference( "RevitAPI")
import Autodesk

clr.AddReference("RevitNodes")
import Revit

# Import ToProtoType, ToRevitType geometry conversion extension methods
clr.ImportExtensions(Revit.GeometryConversion)

# Import Element wrapper extension methods
clr.ImportExtensions(Revit.Elements)


# Converts input to XYZ
def convertToXYZ(a):
	if type(a) == Autodesk.Revit.DB.XYZ:
		return a
	else:
		return a.ToXyz()	

# Inputs
vector0 = convertToXYZ(IN[0])
vector1 = convertToXYZ(IN[1])
normal = convertToXYZ(IN[2])

angle = vector0.AngleOnPlaneTo(vector1, normal)

#Assign your output to the OUT variable
OUT = angle
# ----------------------------------------
angle = Output(python_script)
