# Dynamo custom node Vector.AngleAlmostEqualTo.dyf "AngleAlmostEqualTo" (Dynamo 2.3.0.5885)
# category: Antler.Geometry.Vector.Query

a = Input(a: var[]..[])
b = Input(b: var[]..[])
tolerance = Input(tolerance: var[]..[])
python_script = Python(IN[0]=a, IN[1]=b, IN[2]=tolerance)
# ---------- python_script.python (38 lines) ----------
import clr
clr.AddReference('ProtoGeometry')
from Autodesk.DesignScript.Geometry import *

clr.AddReference("RevitNodes")
import Revit

# Import RevitAPI
clr.AddReference( "RevitAPI")
import Autodesk


# Import ToProtoType, ToRevitType geometry conversion extension methods
clr.ImportExtensions(Revit.GeometryConversion)

#The inputs to this node will be stored as a list in the IN variable.

# Converts input to XYZ
def convertToXYZ(a):
	if type(a) == Autodesk.Revit.DB.XYZ:
		return a
	else:
		return a.ToXyz()	

# Inputs
vec0 = convertToXYZ(IN[0])
vec1 = convertToXYZ(IN[1])
tolerance = IN[2]

result = False

if vec0.AngleTo(vec1) <= tolerance or vec0.AngleTo(vec1.Negate()) <= tolerance:
	result = True
else:
	result = False

#Assign your output to the OUT variable
OUT = result
# ----------------------------------------
boolean = Output(python_script)
