# Dynamo custom node Vector.AngleBetweenVectorsOnXYPlane.dyf "AngleBetweenVectorsOnXYPlane" (Dynamo 2.0.3.8104)
# category: Antler.Geometry.Vector.Query

vector_a = Input(vector_a: var[]..[])
vector_b = Input(vector_b: var[]..[])
python_script = Python(IN[0]=vector_a, IN[1]=vector_b)
# ---------- python_script.python (24 lines) ----------
import clr

clr.AddReference('ProtoGeometry')
from Autodesk.DesignScript.Geometry import *

clr.AddReference('RevitAPI')
from Autodesk.Revit.DB import *

clr.AddReference("RevitNodes")
import Revit

# Import ToProtoType, ToRevitType geometry conversion extension methods
clr.ImportExtensions(Revit.GeometryConversion)


#The inputs to this node will be stored as a list in the IN variable.
vector0 = IN[0]#.ToXyz()
vector1 = IN[1]#.ToXyz()
normal = XYZ.BasisZ

angle = vector0.AngleOnPlaneTo(vector1, normal)

#Assign your output to the OUT variable
OUT = angle
# ----------------------------------------
OUT = Output(python_script)
