# Dynamo custom node Vector.AngleOnXyPlane.dyf "AngleOnXyPlane" (Dynamo 2.3.0.5885)
# category: Antler.Geometry.Vector.Query
# Angle between two vectors on the XY-plane

a = Input(a: var[]..[])
b = Input(b: var[]..[])
python_script = Python(IN[0]=a, IN[1]=b)
# ---------- python_script.python (24 lines) ----------
import clr

clr.AddReference('ProtoGeometry')
from Autodesk.DesignScript.Geometry import *

clr.AddReference('RevitAPI')
from Autodesk.Revit.DB import *

clr.AddReference("RevitNodes")
import Revit

# Import ToProtoType, ToRevitType geometry conversion extension methods
clr.ImportExtensions(Revit.GeometryConversion)


#The inputs to this node will be stored as a list in the IN variable.
vector0 = IN[0].ToXyz()
vector1 = IN[1].ToXyz()
normal = XYZ.BasisZ

angle = vector0.AngleOnPlaneTo(vector1, normal)

#Assign your output to the OUT variable
OUT = angle
# ----------------------------------------
boolean = Output(python_script)
