# Dynamo custom node VectorToLine.dyf (Dynamo 2.3.0.5885)
# category: Antler.Vector
# Converts a vector to a line

origin = Point.Origin()
vector = Input(vector: var[]..[])
length = Vector.Length(vector=vector)
byStartPointDirectionLength = Line.ByStartPointDirectionLength(startPoint=origin, direction=vector, length=length)
line = Output(byStartPointDirectionLength)
