# Dynamo custom node View Origin and Directions.dyf (Dynamo 2.0.2.6826)
# category: tholth.Views
# Gets origin and direction vectors for view. Z-vector is towards the viewer.

view = Input(view: var[]..[])
python_script = Python(IN[0]=view)
# ---------- python_script.python (52 lines) ----------
# Enable Python support and load DesignScript library
import clr

clr.AddReference('ProtoGeometry')
from Autodesk.DesignScript.Geometry import *

# Import RevitAPI
#clr.AddReference("RevitAPI")
#from Autodesk.Revit.DB import *

# Import DocumentManager and TransactionManager
clr.AddReference("RevitServices")
import RevitServices
from RevitServices.Persistence import DocumentManager
from RevitServices.Transactions import TransactionManager

clr.AddReference('RevitNodes')
import Revit
clr.ImportExtensions(Revit.GeometryConversion)
clr.ImportExtensions(Revit.Elements)



#The inputs to this node will be stored as a list in the IN variables.
views = IN[0]

doc = DocumentManager.Instance.CurrentDBDocument
uiapp = DocumentManager.Instance.CurrentUIApplication
app = uiapp.Application


def view_directions(view):
	"""
	"""
	
	return  view.Origin.ToPoint(), view.RightDirection.ToVector(), view.UpDirection.ToVector(), view.ViewDirection.ToVector()

output = None

def to_list(item):
	if isinstance(item, list):
		return item
	else:
		return [item]

views = to_list(views)

output = [view_directions(view) for view in UnwrapElement(views)]


#Assign your output to the OUT variable.
OUT = output
# ----------------------------------------
transpose = List.Transpose(lists=python_script)
code_block = CodeBlock(t=transpose) { List.GetItemAtIndex(t, 0); List.GetItemAtIndex(t, 1); List.GetItemAtIndex(t, 2); List.GetItemAtIndex(t, 3); }
origin = Output(code_block.out0)
x = Output(code_block.out1)
y = Output(code_block.out2)
watch = Watch(code_block.out0)
z = Output(code_block.out3)
watch_2 = Watch(transpose)
