# Dynamo custom node View.ByName.dyf (Dynamo 2.3.0.5885)
# category: Antler.View
# Get view by name

name = Input(name: var[]..[])
python_script = Python(IN[0]=name)
# ---------- python_script.python (30 lines) ----------
import clr
clr.AddReference('ProtoGeometry')
from Autodesk.DesignScript.Geometry import *

# Import DocumentManager and TransactionManager
clr.AddReference ("RevitServices")
import RevitServices
from RevitServices.Persistence import DocumentManager
from RevitServices.Transactions import TransactionManager

clr.AddReference('RevitAPI')
import Autodesk
from Autodesk.Revit.DB import *

#The inputs to this node will be stored as a list in the IN variable.
view_names = IN[0]

# source: http://stackoverflow.com/questions/1835018/python-check-if-an-object-is-a-list-or-tuple-but-not-string
if isinstance(view_names, basestring):
	view_names = [view_names]

doc = DocumentManager.Instance.CurrentDBDocument

collector = FilteredElementCollector(doc)
collector = collector.OfClass(View).ToElements()

views = [a for a in collector if (a.Name in view_names)]

#Assign your output to the OUT variable
OUT = views
# ----------------------------------------
view = Output(python_script)
