# Dynamo custom node View.DependentViews.dyf (Dynamo 2.3.0.5885)
# category: tholth.View.Query
# Get dependent views from view

view = Input(view: var[]..[])
python_script = Python(IN[0]=view)
# ---------- python_script.python (26 lines) ----------
import clr
clr.AddReference('ProtoGeometry')
from Autodesk.DesignScript.Geometry import *

# Import DocumentManager and TransactionManager
clr.AddReference( "RevitServices")
import RevitServices
from RevitServices.Persistence import DocumentManager
from RevitServices.Transactions import TransactionManager

# Import ToDSType(bool) extension method
clr.AddReference( "RevitNodes")
import Revit
clr.ImportExtensions(Revit.Elements)

doc = DocumentManager.Instance.CurrentDBDocument

#The inputs to this node will be stored as a list in the IN variable.
input = UnwrapElement(IN[0])

ids = input.GetDependentViewIds()
elements = [doc.GetElement(a) for a in ids]


#Assign your output to the OUT variable
OUT = elements
# ----------------------------------------
views = Output(python_script)
