# Dynamo custom node View.ScopeBox.Name.dyf (Dynamo 2.3.0.5885)
# category: tholth.View.Query
# Gets name of the scope box of the view.

view = Input(view: var[]..[])
python_script = Python(IN[0]=view)
# ---------- python_script.python (34 lines) ----------
import clr
clr.AddReference('ProtoGeometry')
from Autodesk.DesignScript.Geometry import *

# Import DocumentManager and TransactionManager
clr.AddReference( "RevitServices")
import RevitServices
from RevitServices.Persistence import DocumentManager
from RevitServices.Transactions import TransactionManager

# Import ToDSType(bool) extension method
clr.AddReference( "RevitNodes")
import Revit
clr.ImportExtensions(Revit.Elements)

# Import RevitAPI
clr.AddReference("RevitAPI")
import Autodesk
from Autodesk.Revit.DB import *

doc = DocumentManager.Instance.CurrentDBDocument

#The inputs to this node will be stored as a list in the IN variable.
input = UnwrapElement(IN[0])

scope_box = input.get_Parameter(BuiltInParameter.VIEWER_VOLUME_OF_INTEREST_CROP).AsValueString()

#scope_box = [a.get_Parameter(BuiltInParameter.OST_VolumeOfInterest) for a in input]


#elements = [doc.GetElement(a) for a in scope_box]

#Assign your output to the OUT variable
OUT = scope_box
# ----------------------------------------
string = Output(python_script)
