# Dynamo custom node View.SetAnnotationCropOffset.dyf (Dynamo 2.0.2.6826)
# category: Antler.Views
# Sets annotation crop offset for given view. Offset in model space units.

python_script = Python()  # unwired: IN[0], IN[1], IN[2], IN[3], IN[4]
# ---------- python_script.python (65 lines) ----------
# Enable Python support and load DesignScript library
import clr

clr.AddReference('ProtoGeometry')
from Autodesk.DesignScript.Geometry import *

# Import RevitAPI
clr.AddReference("RevitAPI")
from Autodesk.Revit.DB import *

# Import DocumentManager and TransactionManager
clr.AddReference("RevitServices")
import RevitServices
from RevitServices.Persistence import DocumentManager
from RevitServices.Transactions import TransactionManager

clr.AddReference('RevitNodes')
import Revit
clr.ImportExtensions(Revit.GeometryConversion)
clr.ImportExtensions(Revit.Elements)

#The inputs to this node will be stored as a list in the IN variables.
views = IN[0]
top = IN[1]
bottom = IN[2]
left = IN[3]
right = IN[4]

doc = DocumentManager.Instance.CurrentDBDocument
uiapp = DocumentManager.Instance.CurrentUIApplication
app = uiapp.Application

def set_annotation_crop_shape(view):
	# Converts offset to internal units and multiplies by scale to set offset in model units
	crop_offset = UnitUtils.ConvertToInternalUnits(crop_offset, DisplayUnitType.DUT_MILLIMETERS) / view.Scale	
	
	if view:
		crop_manager = view.GetCropRegionShapeManager()
		
		crop_manager.TopAnnotationCropOffset = top
		crop_manager.BottomAnnotationCropOffset = bottom
		crop_manager.LeftAnnotationCropOffset = left
		crop_manager.RightAnnotationCropOffset = right
		
		return view

output = None
#crop_offset = crop_offset or 0.1

# Start Transaction
TransactionManager.Instance.EnsureInTransaction(doc)

# Transaction
# To handle single items or lists..

if isinstance(views, list):
	output = [set_annotation_crop_shape(view) for view in UnwrapElement(views)]
else:
	output = set_annotation_crop_shape(UnwrapElement(views))

# End Transaction
TransactionManager.Instance.TransactionTaskDone()

#Assign your output to the OUT variable.
OUT = views
# ----------------------------------------
view = Input(view: Revit.Elements.Views.View)
top = Input(top: double = 10)
bottom = Input(bottom: double = 10)
left = Input(left: double = 10)
right = Input(right: double = 10)
python_script_2 = Python(IN[0]=view, IN[1]=top, IN[2]=bottom, IN[3]=left, IN[4]=right)
# ---------- python_script_2.python (74 lines) ----------
# Enable Python support and load DesignScript library
import clr

clr.AddReference('ProtoGeometry')
from Autodesk.DesignScript.Geometry import *

# Import RevitAPI
clr.AddReference("RevitAPI")
from Autodesk.Revit.DB import *

# Import DocumentManager and TransactionManager
clr.AddReference("RevitServices")
import RevitServices
from RevitServices.Persistence import DocumentManager
from RevitServices.Transactions import TransactionManager

clr.AddReference('RevitNodes')
import Revit
clr.ImportExtensions(Revit.GeometryConversion)
clr.ImportExtensions(Revit.Elements)

#The inputs to this node will be stored as a list in the IN variables.
views = IN[0]
top = IN[1]
bottom = IN[2]
left = IN[3]
right = IN[4]

doc = DocumentManager.Instance.CurrentDBDocument
uiapp = DocumentManager.Instance.CurrentUIApplication
app = uiapp.Application



def set_annotation_crop_shape(view, top, bottom, left, right):
	# Converts offset to internal units and multiplies by scale to set offset in model units
	top = UnitUtils.ConvertToInternalUnits(top, DisplayUnitType.DUT_MILLIMETERS) / view.Scale
	
	bottom = UnitUtils.ConvertToInternalUnits(bottom, DisplayUnitType.DUT_MILLIMETERS) / view.Scale
	
	left = UnitUtils.ConvertToInternalUnits(left, DisplayUnitType.DUT_MILLIMETERS) / view.Scale
	
	right = UnitUtils.ConvertToInternalUnits(right, DisplayUnitType.DUT_MILLIMETERS) / view.Scale
	
	
	if view:
		crop_manager = view.GetCropRegionShapeManager()
		
		crop_manager.TopAnnotationCropOffset = top
		crop_manager.BottomAnnotationCropOffset = bottom
		crop_manager.LeftAnnotationCropOffset = left
		crop_manager.RightAnnotationCropOffset = right
		
		return view

output = None
#crop_offset = crop_offset or 0.1

# Start Transaction
TransactionManager.Instance.EnsureInTransaction(doc)

# Transaction
# To handle single items or lists..

if isinstance(views, list):
	output = [set_annotation_crop_shape(view, top, bottom, left, right) for view in UnwrapElement(views)]
else:
	output = set_annotation_crop_shape(UnwrapElement(views), top, bottom, left, right)

# End Transaction
TransactionManager.Instance.TransactionTaskDone()

#Assign your output to the OUT variable.
OUT = views
# ----------------------------------------
view_2 = Output(python_script_2)  # "view"
