# Dynamo custom node View.SetCropShape.dyf (Dynamo 2.0.2.6826)
# category: Antler.Views

view = Input(view: Revit.Elements.Views.View)
curves = Input(curves: var[]..[])
python_script = Python(IN[0]=view, IN[1]=curves)
# ---------- python_script.python (68 lines) ----------
# Enable Python support and load DesignScript library
import clr

clr.AddReference('ProtoGeometry')
from Autodesk.DesignScript.Geometry import *

# Import RevitAPI
clr.AddReference("RevitAPI")
from Autodesk.Revit.DB import *

# Import DocumentManager and TransactionManager
clr.AddReference("RevitServices")
import RevitServices
from RevitServices.Persistence import DocumentManager
from RevitServices.Transactions import TransactionManager

clr.AddReference('RevitNodes')
import Revit
clr.ImportExtensions(Revit.GeometryConversion)
clr.ImportExtensions(Revit.Elements)

#The inputs to this node will be stored as a list in the IN variables.
views = IN[0]
crvs = IN[1]

doc = DocumentManager.Instance.CurrentDBDocument
uiapp = DocumentManager.Instance.CurrentUIApplication
app = uiapp.Application

def crvs_to_crvloop(crvs):
	crv_loop = CurveLoop()
	
	[crv_loop.Append(crv.ToRevitType()) for crv in crvs]

	return crv_loop

def set_crop_shape(view, crv_loop):
	# Do something with item and get a result	
	
	if view and crv_loop:
		crop_manager = view.GetCropRegionShapeManager()
		crop_manager.SetCropShape(crv_loop)
	
		return view

output = None

if isinstance(crvs, list) :
	crv_loop = crvs_to_crvloop(UnwrapElement(crvs))
else:
	crv_loop = crvs_to_crvloop(UnwrapElement([crvs]))

# Start Transaction
TransactionManager.Instance.EnsureInTransaction(doc)

# Transaction
# To handle single items or lists..

if isinstance(views, list):
	output = [set_crop_shape(view, crv_loop) for view in UnwrapElement(views)]
else:
	output = set_crop_shape(UnwrapElement(views), crv_loop)

# End Transaction
TransactionManager.Instance.TransactionTaskDone()

#Assign your output to the OUT variable.
OUT = views
# ----------------------------------------
View = Output(python_script)
