# Dynamo custom node View.SetScopeBox.dyf (Dynamo 2.3.0.5885)
# category: Antler.View.Actions
# Set view scopebox.

view = Input(view: var[]..[])
scope_box = Input(scope_box: var[]..[])
python_script = Python(IN[0]=view, IN[1]=scope_box)
# ---------- python_script.python (43 lines) ----------
import clr
clr.AddReference('ProtoGeometry')
from Autodesk.DesignScript.Geometry import *

# Import DocumentManager and TransactionManager
clr.AddReference( "RevitServices")
import RevitServices
from RevitServices.Persistence import DocumentManager
from RevitServices.Transactions import TransactionManager

# Import ToDSType(bool) extension method
clr.AddReference( "RevitNodes")
import Revit
clr.ImportExtensions(Revit.Elements)

# Import RevitAPI
clr.AddReference("RevitAPI")
import Autodesk
from Autodesk.Revit.DB import *

doc = DocumentManager.Instance.CurrentDBDocument

#The inputs to this node will be stored as a list in the IN variable.
views = UnwrapElement(IN[0])
scope_boxes = UnwrapElement(IN[1])

parameters = [a.get_Parameter(BuiltInParameter.VIEWER_VOLUME_OF_INTEREST_CROP) for a in views]

# Start Transaction
TransactionManager.Instance.EnsureInTransaction(doc)

parameters = [a.Set(b.Id) for a,b in zip(parameters, scope_boxes)]

#scope_box = [a.get_Parameter(BuiltInParameter.OST_VolumeOfInterest) for a in input]


# End Transaction

TransactionManager.Instance.TransactionTaskDone()
#elements = [doc.GetElement(a) for a in scope_box]

#Assign your output to the OUT variable
OUT = None
# ----------------------------------------
view_2 = Output(python_script)  # "view"
