# Dynamo custom node View.SetViewName.dyf (Dynamo 2.3.0.5885)
# category: Antler.View.Actions
# Sets view name of view

view = Input(view: var[]..[])
name = Input(name: var[]..[])
python_script = Python(IN[0]=view, IN[1]=name)
# ---------- python_script.python (54 lines) ----------
import clr
clr.AddReference('ProtoGeometry')
from Autodesk.DesignScript.Geometry import *

# Import DocumentManager and TransactionManager
clr.AddReference( "RevitServices")
import RevitServices
from RevitServices.Persistence import DocumentManager
from RevitServices.Transactions import TransactionManager

# Import ToDSType(bool) extension method
clr.AddReference( "RevitNodes")
import Revit
clr.ImportExtensions(Revit.Elements)

# Import RevitAPI
clr.AddReference("RevitAPI")
import Autodesk
from Autodesk.Revit.DB import *

# Import DocumentManager and TransactionManager
clr.AddReference("RevitServices")
import RevitServices
from RevitServices.Persistence import DocumentManager
from RevitServices.Transactions import TransactionManager


doc = DocumentManager.Instance.CurrentDBDocument

#The inputs to this node will be stored as a list in the IN variable.
views = UnwrapElement(IN[0])
names = IN[1]




#scope_box = [a.get_Parameter(BuiltInParameter.OST_VolumeOfInterest) for a in input]

# Start Transaction
TransactionManager.Instance.EnsureInTransaction(doc)

# Example Transaction

for i, j in zip(views, names):
	parameter = i.get_Parameter(BuiltInParameter.VIEW_NAME)
	parameter.Set(j)

# End Transaction
TransactionManager.Instance.TransactionTaskDone()

#elements = [doc.GetElement(a) for a in scope_box]

#Assign your output to the OUT variable
OUT = views
# ----------------------------------------
view_2 = Output(python_script)  # "view"
