# Dynamo custom node View.SetVisibility.dyf (Dynamo 2.3.0.5885)
# category: Antler.View.Action
# Sets visibility of category in view to either on or off

views = Input(views: var[]..[])
categories = Input(categories: var[]..[])
boolean = Input(boolean: var[]..[])
setVisibility = Python(IN[0]=views, IN[1]=categories, IN[2]=boolean)  # "View.SetVisibility"
# ---------- setVisibility.python (51 lines) ----------
import clr

# Import RevitAPI
clr.AddReference("RevitAPI")
import Autodesk
from Autodesk.Revit.DB import *

# Import DocumentManager and TransactionManager
clr.AddReference("RevitServices")
import RevitServices
from RevitServices.Persistence import DocumentManager
from RevitServices.Transactions import TransactionManager

# Import ToDSType(bool) extension method
clr.AddReference("RevitNodes")
import Revit
clr.ImportExtensions(Revit.Elements)
clr.ImportExtensions(Revit.GeometryConversion)

#The input to this node will be stored in the IN[0] variable.
views = IN[0]
categories = IN[1]
visible = IN[2]


if not isinstance(views, list):
	views = UnwrapElement([views])
else:
	views = UnwrapElement(views)


if not isinstance(categories, list):
	categories = UnwrapElement([categories])
else:
	categories = UnwrapElement(categories)


doc =  DocumentManager.Instance.CurrentDBDocument

# Start Transaction
TransactionManager.Instance.EnsureInTransaction(doc)

# a,b,c = zip(*((x,y,z) for x in h for y in s for z in l))

set_visibility = [a.SetVisibility(b, visible) for a in views for b in categories]

# End Transaction
TransactionManager.Instance.TransactionTaskDone()

#Assign your output to the OUT variable
OUT = views
# ----------------------------------------
views_2 = Output(setVisibility)  # "views"
