# Dynamo custom node View.Sheet.dyf (Dynamo 2.0.2.6826)
# category: tholth.View.Query
# Get sheet from given view

IN_0 = Input(IN[0]: var[]..[])
python_script = Python(IN[0]=IN_0)
# ---------- python_script.python (32 lines) ----------
import clr
clr.AddReference('ProtoGeometry')
from Autodesk.DesignScript.Geometry import *

# Import DocumentManager and TransactionManager
clr.AddReference ("RevitServices")
import RevitServices
from RevitServices.Persistence import DocumentManager
from RevitServices.Transactions import TransactionManager

clr.AddReference('RevitAPI')
import Autodesk
from Autodesk.Revit.DB import *

#The inputs to this node will be stored as a list in the IN variable.
input_view = UnwrapElement(IN[0])

doc = DocumentManager.Instance.CurrentDBDocument

found_sheets = []

for sheet in FilteredElementCollector(doc).OfClass(ViewSheet).ToElements():

	for view_on_sheet_id in sheet.GetAllPlacedViews():
	
		if input_view.Id == view_on_sheet_id:
			found_sheets.append(sheet)

found_sheets = found_sheets or [None]

#Assign your output to the OUT variable
OUT = found_sheets
# ----------------------------------------
OUT = Output(python_script)
