# Dynamo custom node Viewport.ViewId.dyf (Dynamo 2.0.3.8810)
# category: Antler.Viewport

viewport = Input(viewport: var[]..[])
python_script = Python(IN[0]=viewport)
# ---------- python_script.python (39 lines) ----------
# Enable Python support and load DesignScript library
import clr

clr.AddReference('ProtoGeometry')
from Autodesk.DesignScript.Geometry import *

# Import RevitAPI
clr.AddReference("RevitAPI")
from Autodesk.Revit.DB import *

# Import DocumentManager and TransactionManager
clr.AddReference("RevitServices")
import RevitServices
from RevitServices.Persistence import DocumentManager
from RevitServices.Transactions import TransactionManager

# Import ToDSType(bool) extension method
clr.AddReference("RevitNodes")
import Revit
clr.ImportExtensions(Revit.Elements)
clr.ImportExtensions(Revit.GeometryConversion)

#The inputs to this node will be stored as a list in the IN variables.
item = IN[0]

doc = DocumentManager.Instance.CurrentDBDocument
uiapp = DocumentManager.Instance.CurrentUIApplication
app = uiapp.Application

def function(viewport):
	# Do something with item and get a result
	result = viewport.ViewId

	return result

output = function(UnwrapElement(item))

#Assign your output to the OUT variable.
OUT = output
# ----------------------------------------
id = Output(python_script)
