# Dynamo custom node Wall.Plane.dyf (Dynamo 2.0.3.8810)
# category: antler
# [WIP] Wall face Plane.

wall = Input(wall: var[]..[])
type = archilab.Revit.Elements.Elements.Type(element=wall)
python_script = Python(IN[0]=type)
# ---------- python_script.python (20 lines) ----------
# Enable Python support and load DesignScript library
import clr

# Import RevitAPI
clr.AddReference("RevitAPI")
from Autodesk.Revit import DB

#The inputs to this node will be stored as a list in the IN variable.
elements = IN[0]

def function(element):
	if isinstance(element, (list, tuple)):
		return [function(e) for e in element]
	else:
		# Code follows here:
		element = UnwrapElement(element)
		
		return element.Kind.ToString()

OUT = function(elements)
# ----------------------------------------
properties = Custom[Wall.Properties](wall=wall)  # Gets Wall properties.
code_block = CodeBlock { "Flipped"; }
valueAtKey = DesignScript.Builtin.Dictionary.ValueAtKey(dictionary=properties, key=code_block)
code_block_2 = CodeBlock { "Orientation"; }
valueAtKey_2 = DesignScript.Builtin.Dictionary.ValueAtKey(dictionary=properties, key=code_block_2)
code_block_3 = CodeBlock(kind=python_script, r=valueAtKey, v=valueAtKey_2) { iscurtainwall = kind=="Curtain"; !r && iscurtainwall? Vector.Reverse(v) : v; }
getLocation = Element.GetLocation(element=wall)
startPoint = Curve.StartPoint(curve=getLocation)
code_block_4 = CodeBlock(normal=code_block_3.out1, origin=startPoint) { new_normal = Vector.Cross(Vector.ZAxis(), normal); Plane.ByOriginXAxisYAxis(origin, new_normal, Vector.ZAxis()); }
plane = Output(code_block_4.out1)
