# Dynamo custom node Wall.Properties.dyf (Dynamo 2.0.3.8810)
# category: Antler
# Gets Wall properties.

wall = Input(wall: var[]..[])
python_script = Python(IN[0]=wall)
# ---------- python_script.python (34 lines) ----------
# Enable Python support and load DesignScript library
import clr

# Import RevitAPI
clr.AddReference("RevitAPI")
from Autodesk.Revit import DB

# Import ToDSType(bool) extension method
clr.AddReference("RevitNodes")
import Revit
clr.ImportExtensions(Revit.Elements)
clr.ImportExtensions(Revit.GeometryConversion)

#The inputs to this node will be stored as a list in the IN variable.
elements = IN[0]

def function(element):
	if isinstance(element, (list, tuple)):
		return [function(e) for e in element]
	else:
		# Code follows here:
		element = UnwrapElement(element)
		
		prop_dict = {
			"Flipped"         :  element.Flipped,
			"Orientation" :          element.Orientation.ToVector() ,

			}
		
		
		
		return prop_dict.keys(), prop_dict.values()

OUT = function(elements)
# ----------------------------------------
code_block = CodeBlock { 0; 1; }
getItemAtIndex = List.GetItemAtIndex(list=python_script@L3, index=code_block.out0)
getItemAtIndex_2 = List.GetItemAtIndex(list=python_script@L3, index=code_block.out1)
byKeysValues = DesignScript.Builtin.Dictionary.ByKeysValues(keys=getItemAtIndex@L2, values=getItemAtIndex_2@L2)
watch = Watch(byKeysValues)
properties = Output(watch)
