# Dynamo custom node WallType.dyf (Dynamo 2.0.3.8810)
# category: Antler.Walls
# Represents a specific type of wall, such as 'Generic -8" '.

wall = Input(wall: var[]..[])
python_script = Python(IN[0]=wall)
# ---------- python_script.python (20 lines) ----------
# Enable Python support and load DesignScript library
import clr

# Import RevitAPI
clr.AddReference("RevitAPI")
from Autodesk.Revit import DB

#The inputs to this node will be stored as a list in the IN variable.
elements = IN[0]

def function(element):
	if isinstance(element, (list, tuple)):
		return [function(e) for e in element]
	else:
		# Code follows here:
		element = UnwrapElement(element)
		
		return element.WallType

OUT = function(elements)
# ----------------------------------------
type = Output(python_script)
