# Dynamo custom node Workset.Name.dyf (Dynamo 2.0.2.6826)
# category: Antler.Workset.Query

workset = Input(workset: var[]..[])
python_script = Python(IN[0]=workset)
# ---------- python_script.python (49 lines) ----------
# Enable Python support and load DesignScript library
import clr

clr.AddReference('ProtoGeometry')
from Autodesk.DesignScript.Geometry import *

# Import RevitAPI
clr.AddReference("RevitAPI")
from Autodesk.Revit.DB import *

# Import DocumentManager and TransactionManager
clr.AddReference("RevitServices")
import RevitServices
from RevitServices.Persistence import DocumentManager
from RevitServices.Transactions import TransactionManager

# Import ToDSType(bool) extension method
clr.AddReference("RevitNodes")
import Revit
clr.ImportExtensions(Revit.Elements)
clr.ImportExtensions(Revit.GeometryConversion)

#The inputs to this node will be stored as a list in the IN variables.
items = IN[0]

doc = DocumentManager.Instance.CurrentDBDocument
uiapp = DocumentManager.Instance.CurrentUIApplication
app = uiapp.Application

def to_list(item):
	if isinstance(item, list):
		return item
	else:
		return [item]

def function(item):
	# Do something with item and get a result
	result = item.Name	

	return result

output = None

items = to_list(items)

output = [function(item) for item in UnwrapElement(items)]

#Assign your output to the OUT variable.
OUT = output
# ----------------------------------------
name = Output(python_script)
