# Dynamo custom node WorksetElementCount.dyf (Dynamo 2.0.2.6826)
# category: tholth.Workset.Query
# Counts elements on workset.

workset = Input(workset: var[]..[])
python_script = Python(IN[0]=workset)
# ---------- python_script.python (36 lines) ----------
import clr

# Import RevitAPI
clr.AddReference("RevitAPI")
import Autodesk
from Autodesk.Revit.DB import *

# Import DocumentManager and TransactionManager
clr.AddReference("RevitServices")
import RevitServices
from RevitServices.Persistence import DocumentManager
from RevitServices.Transactions import TransactionManager

# Import ToDSType(bool) extension method
clr.AddReference("RevitNodes")
import Revit
clr.ImportExtensions(Revit.Elements)
clr.ImportExtensions(Revit.GeometryConversion)

#The input to this node will be stored in the IN[0] variable.
workset = IN[0]

doc =  DocumentManager.Instance.CurrentDBDocument

# Collects all elements on given workset
elementCollector = FilteredElementCollector(doc)

elementWorksetFilter = ElementWorksetFilter(workset.Id)
worksetElemsfounds = elementCollector.WherePasses(elementWorksetFilter).ToElements()

# Counts the elements in collector
elementsCount = worksetElemsfounds.Count


#Assign your output to the OUT variable
OUT = elementsCount
# ----------------------------------------
count = Output(python_script)
