# Dynamo custom node string.compare.dyf (Dynamo 2.0.2.6826)
# category: Antler.String
# Compares 2 strings and returns similarity as a ratio.

a = Input(a: var[]..[])
b = Input(b: var[]..[])
python_script = Python(IN[0]=a, IN[1]=b)
# ---------- python_script.python (19 lines) ----------
# Enable Python support and load DesignScript library
import clr
clr.AddReference('ProtoGeometry')
from Autodesk.DesignScript.Geometry import *

import sys
path = r"C:\Program Files (x86)\IronPython 2.7\Lib"
if not path in sys.path: sys.path.append(path)
import difflib

# The inputs to this node will be stored as a list in the IN variables.
a = IN[0]
b = IN[1]

# Place your code below this line
ratio = difflib.SequenceMatcher(None, a, b).ratio()

# Assign your output to the OUT variable.
OUT = ratio
# ----------------------------------------
ratio = Output(python_script)
